# Grasshopper definition GeoToSchema.gh (Grasshopper 1.0.8)
# plug-ins: Human

name = Panel("layout-2")
name_2 = Panel("layout-4")
name_3 = Panel("layout-1")
name_4 = Panel("layout-3")
name_5 = Panel("layout-5")
name_6 = Panel("layout-6")
name_7 = Panel("Sample A")
name_8 = Panel("Sample B")
name_9 = Panel("Sample C")
name_10 = Panel("Sample D")
name_11 = Panel("Sample E")
name_12 = Panel("Sample F")

geo = Geometry(simplify([<point referenced from the Rhino model> x2, <curve referenced from the Rhino model>, <point referenced from the Rhino model>, <curve referenced from the Rhino model> x6]))
geo_2 = Geometry(simplify([<curve referenced from the Rhino model> x6, <point referenced from the Rhino model> x3, <curve referenced from the Rhino model>, <point referenced from the Rhino model>, <curve referenced from the Rhino model>]))
geo_3 = Geometry(simplify([<point referenced from the Rhino model> x5, <curve referenced from the Rhino model> x9]))
geo_4 = Geometry(simplify([<point referenced from the Rhino model> x8, <curve referenced from the Rhino model> x12]))
geo_5 = Geometry(simplify([<curve referenced from the Rhino model> x3, <point referenced from the Rhino model> x3, <curve referenced from the Rhino model> x2, <point referenced from the Rhino model> x3, <curve referenced from the Rhino model> x6]))
geo_6 = Geometry(simplify([<curve referenced from the Rhino model>, <point referenced from the Rhino model> x3, <curve referenced from the Rhino model> x6]))

cluster = Cluster_2(name=name_12, id=name_6, geo=geo_6)
cluster_2 = Cluster(name=name_7, id=name_3, geo=geo)
cluster_3 = Cluster_2(name=name_10, id=name_2, geo=geo_4)
cluster_4 = Cluster_2(name=name_9, id=name_4, geo=geo_3)
cluster_5 = Cluster_2(name=name_11, id=name_5, geo=geo_5)
cluster_6 = Cluster_2(name=name_8, id=name, geo=geo_2)
merge = Merge(Data1=cluster_2, Data2=cluster_6, Data3=cluster_4, Data4=cluster_3, Data5=cluster_5, Data6=cluster)
data = Data(flatten(merge))
item = ListItem(List=data, Index=Slider(0, range=0..5), Wrap=True)
panel = Panel(data)
geo_7 = Geometry()

country = Panel("NA")
name_13 = Panel("testname")
geo_8 = Geometry(simplify(geo_7))
database = Panel("default")
city = Panel("NA")

# ---- group: SORT : Program
crv = Curve(geo_8)
objdet = ObjectDetails(Object=crv)  # -> Referenced, Available, Name, Layer, Colour, Guid
tmatch = MatchText(Text=objdet.Layer, RegEx="Apartment::a_program", Case=False)
dispatch = Dispatch(List=crv, DispatchPattern=tmatch)  # -> ListA, ListB

# ---- group: SORT : Facade
crv_2 = Curve(geo_8)
objdet_2 = ObjectDetails(Object=crv_2)  # -> Referenced, Available, Name, Layer, Colour, Guid
tmatch_2 = MatchText(Text=objdet_2.Layer, Pattern="Apartment::facade", Case=True)
dispatch_2 = Dispatch(List=crv_2, DispatchPattern=tmatch_2)  # -> ListA, ListB

# ---- group: SORT : Circulation
crv_3 = Curve(geo_8)
objdet_3 = ObjectDetails(Object=crv_3)  # -> Referenced, Available, Name, Layer, Colour, Guid
tmatch_3 = MatchText(Text=objdet_3.Layer, Pattern="Apartment::circulation", Case=True)
dispatch_3 = Dispatch(List=crv_3, DispatchPattern=tmatch_3)  # -> ListA, ListB

# ---- group: SORT : BOUNDS
crv_4 = Curve(geo_8)
objdet_4 = ObjectDetails(Object=crv_4)  # -> Referenced, Available, Name, Layer, Colour, Guid
tmatch_4 = MatchText(Text=objdet_4.Layer, Pattern="Apartment::boundary", Case=True)
dispatch_4 = Dispatch(List=crv_4, DispatchPattern=tmatch_4)  # -> ListA, ListB
item_2 = ListItem(List=dispatch_4.ListA, Index=0, Wrap=True)

# ---- group: SORT : Circulation
crv_not_circulation = Curve(dispatch_3.ListB)
crv_circulation = Curve(dispatch_3.ListA)

# ---- group: SORT : Program
crv_not_program = Curve(dispatch.ListB)
crv_program = Curve(dispatch.ListA)

# ---- group: SORT : BOUNDS
crv_not_bounds = Curve(dispatch_4.ListB)
crv_bounds = Curve(item_2)

# ----
crv_bounds_2 = Curve(crv_bounds)
dpipeline = DynamicGeometryPipeline(
    LayerFilter="*",
    TypeFilter="text",
    NameFilter="*",
    GroupByLayer=False,
    GroupByType=False,
    IncludeHidden=True,
    IncludeLocked=True,
    enableFullPath=False,
    listenToAttributes=True)
txtobjinfo = TextObjectInfo(TextObjects=dpipeline)  # -> Plane, Text, Size, Alignment, VerticalAlignment
deplane = DeconstructPlane(Plane=txtobjinfo.Plane)  # -> Origin, XAxis, YAxis, ZAxis
crv_cp = CurveClosestPoint(Point=deplane.Origin, Curve=crv_bounds_2)  # -> Point, Parameter, Distance
sort = SortList(Keys=crv_cp.Distance, ValuesA=txtobjinfo.Text)  # -> Keys, ValuesA

item_3 = ListItem(List=sort.ValuesA, Index=0, Wrap=True)
panel_2 = Panel(item_3)
txt = Text(item_3)

# ---- group: SORT : Facade
crv_not_facade = Curve(dispatch_2.ListB)
crv_facade = Curve(dispatch_2.ListA)

# ----
pt = Point(geo_8)
move_to_0_0_0 = BooleanToggle(False)
pt_2 = Point(Point(0, 0, 0))
area = Area(Geometry=crv_bounds, UseTasks=False)  # -> Area, Centroid
vec = Vector(pt_2)
filter = StreamFilter(Gate=move_to_0_0_0, Stream0=flatten(area.Centroid), Stream1=flatten(vec))  # -> flatten(Stream)
rev = Reverse(Vector=filter)
vec_2 = Vector(rev)
filter_2 = StreamFilter(Gate=move_to_0_0_0, Stream0=flatten(vec_2), Stream1=flatten(vec))  # -> flatten(Stream)
move = Move(Geometry=crv_circulation, Motion=filter_2)  # -> Geometry, Transform
move_2 = Move(Geometry=crv_bounds, Motion=filter_2)  # -> Geometry, Transform
move_3 = Move(Geometry=crv_program, Motion=filter_2)  # -> Geometry, Transform
move_4 = Move(Geometry=crv_facade, Motion=filter_2)  # -> Geometry, Transform
objdet_5 = ObjectDetails(Object=crv_program)  # -> Referenced, Available, Name, Layer, Colour, Guid
crv_circulation_2 = Curve(move.Geometry)
crv_bounds_3 = Curve(move_2.Geometry)
crv_facade_2 = Curve(move_4.Geometry)
crv_program_2 = Curve(move_3.Geometry)
split = TextSplit(Text=objdet_5.Layer, Separators="::")
item_4 = ListItem(List=split, Index=Slider(4, range=0..10), Wrap=True)  # -> flatten(Item)

# ---- group: SORT : Door PT
objdet_6 = ObjectDetails(Object=pt)  # -> Referenced, Available, Name, Layer, Colour, Guid
tmatch_5 = MatchText(Text=objdet_6.Layer, Pattern="Apartment::a_circpt", Case=True)
dispatch_5 = Dispatch(List=pt, DispatchPattern=tmatch_5)  # -> ListA, ListB

# ----
pt_circpt = Point(dispatch_5.ListA)
move_5 = Move(Geometry=pt_circpt, Motion=filter_2)  # -> Geometry, Transform
pt_circpt_2 = Point(move_5.Geometry)

panel_3 = Panel(crv_bounds_3)
panel_4 = Panel(item_4)

# ---- group: Convert Crv to Json
c_script = CSharpScript(
    database=database,
    country=country,
    city=city,
    name=name_13,
    crv=crv_program_2,
    u=item_4,
    ptCirc=pt_circpt_2,
    crvBounds=crv_bounds_3,
    crvFacade=crv_facade_2,
    crvCirc=crv_circulation_2,
    id=txt,
    Reference=["C:\USERS\ECORI\SOURCE\IAAC\AIA_STUDIO\HYPERGRAPH\SAMPLES\_REQUIREDDLLS\MathNet.Numerics.dll", "C:\USERS\ECORI\SOURCE\IAAC\AIA_STUDIO\HYPERGRAPH\SAMPLES\_REQUIREDDLLS\RGeoLib.dll", "C:\USERS\ECORI\SOURCE\IAAC\AIA_STUDIO\HYPERGRAPH\SAMPLES\_REQUIREDDLLS\Microsoft.Bcl.AsyncInterfaces.dll", "C:\USERS\ECORI\SOURCE\IAAC\AIA_STUDIO\HYPERGRAPH\SAMPLES\_REQUIREDDLLS\System.Buffers.dll", "C:\USERS\ECORI\SOURCE\IAAC\AIA_STUDIO\HYPERGRAPH\SAMPLES\_REQUIREDDLLS\System.Memory.dll", "C:\USERS\ECORI\SOURCE\IAAC\AIA_STUDIO\HYPERGRAPH\SAMPLES\_REQUIREDDLLS\System.Numerics.Vectors.dll", "C:\USERS\ECORI\SOURCE\IAAC\AIA_STUDIO\HYPERGRAPH\SAMPLES\_REQUIREDDLLS\System.Runtime.CompilerServices.Unsafe.dll", "C:\USERS\ECORI\SOURCE\IAAC\AIA_STUDIO\HYPERGRAPH\SAMPLES\_REQUIREDDLLS\System.Text.Encodings.Web.dll", "C:\USERS\ECORI\SOURCE\IAAC\AIA_STUDIO\HYPERGRAPH\SAMPLES\_REQUIREDDLLS\System.Text.Json.dll", "C:\USERS\ECORI\SOURCE\IAAC\AIA_STUDIO\HYPERGRAPH\SAMPLES\_REQUIREDDLLS\System.Threading.Tasks.Extensions.dll", "C:\USERS\ECORI\SOURCE\IAAC\AIA_STUDIO\HYPERGRAPH\SAMPLES\_REQUIREDDLLS\System.ValueTuple.dll"])  # -> out, splitGraphJson, boundsJson, facadeJson, circulationJson, apt; inputs database: String, country: String, city: String, name: String, crv: list of Polyline, u: list of String, ptCirc: list of Point3d, crvBounds: Polyline, crvFacade: list of Polyline, crvCirc: list of Polyline, id: String
# ---------- c_script: C# usings ----------
using System.Linq;
using RGeoLib;
# ---------- c_script: C# ----------
    // IMPORT
    List<Vec3d> inputPt = RhConvert.RhPointListToVec3dList(ptCirc);
    NFace bounds = RhConvert.RhPolylineToNFace(crvBounds);
    List<NLine> facade = RhConvert.RhPolylineListToNLineList(crvFacade);
    List<NLine> circulation = RhConvert.RhPolylineListToNLineList(crvCirc);

    // CONVERT
    NMesh inputMesh = RhConvert.RhPolylineListToNMeshWithNames(crv, u);
    DataNode rootNode = DataNode.dataNodeFromNMeshAndBoundsWithConnectivity(inputMesh, bounds, inputPt);

    // JSON
    splitGraphJson = DataNode.serializeDataNode(rootNode);
    boundsJson = NFace.serializeNFace(bounds);
    facadeJson = NLine.serializeNLineList(facade);
    circulationJson = NLine.serializeNLineList(circulation);

    string jsonBounds = NFace.serializeNFace(bounds);
    string jsonFacade = NLine.serializeNLineList(facade);
    string jsonCirculation = NLine.serializeNLineList(circulation);
    string jsonSplit = DataNode.serializeDataNode(rootNode);


    Apartment newApartment = new Apartment(jsonBounds, jsonFacade, jsonCirculation, jsonSplit);
    newApartment.id = id;
    newApartment.database = database;
    newApartment.country = country;
    newApartment.city = city;
    newApartment.name = name;

    apt = newApartment;
# ---------- end c_script ----------

# ----
apt = Apt(c_script.apt)

# ==== cluster Cluster
geo = ClusterInput()
name = ClusterInput()
id = ClusterInput()

geo_2 = Geometry(simplify(geo))

# ---- group: SORT : Program
crv = Curve(geo_2)
objdet = ObjectDetails(Object=crv)  # -> Referenced, Available, Name, Layer, Colour, Guid
tmatch = MatchText(Text=objdet.Layer, RegEx="Apartment::a_program", Case=False)
dispatch = Dispatch(List=crv, DispatchPattern=tmatch)  # -> ListA, ListB
crv_program = Curve(dispatch.ListA)

# ---- group: SORT : Facade
crv_2 = Curve(geo_2)
objdet_2 = ObjectDetails(Object=crv_2)  # -> Referenced, Available, Name, Layer, Colour, Guid
tmatch_2 = MatchText(Text=objdet_2.Layer, Pattern="Apartment::facade", Case=True)
dispatch_2 = Dispatch(List=crv_2, DispatchPattern=tmatch_2)  # -> ListA, ListB

# ---- group: SORT : Circulation
crv_3 = Curve(geo_2)
objdet_3 = ObjectDetails(Object=crv_3)  # -> Referenced, Available, Name, Layer, Colour, Guid
tmatch_3 = MatchText(Text=objdet_3.Layer, Pattern="Apartment::circulation", Case=True)
dispatch_3 = Dispatch(List=crv_3, DispatchPattern=tmatch_3)  # -> ListA, ListB

# ---- group: SORT : BOUNDS
crv_4 = Curve(geo_2)
objdet_4 = ObjectDetails(Object=crv_4)  # -> Referenced, Available, Name, Layer, Colour, Guid
tmatch_4 = MatchText(Text=objdet_4.Layer, Pattern="Apartment::boundary", Case=True)
dispatch_4 = Dispatch(List=crv_4, DispatchPattern=tmatch_4)  # -> ListA, ListB
item = ListItem(List=dispatch_4.ListA, Index=0, Wrap=True)
crv_bounds = Curve(item)

# ----
pt = Point(geo_2)
move_to_0_0_0 = BooleanToggle(True)
crv_circulation = Curve(dispatch_3.ListA)
crv_facade = Curve(dispatch_2.ListA)
pt_2 = Point(Point(0, 0, 0))
area = Area(Geometry=crv_bounds, UseTasks=False)  # -> Area, Centroid
vec = Vector(pt_2)
filter = StreamFilter(Gate=move_to_0_0_0, Stream0=flatten(vec), Stream1=flatten(area.Centroid))  # -> flatten(Stream)
rev = Reverse(Vector=filter)
vec_2 = Vector(rev)
filter_2 = StreamFilter(Gate=move_to_0_0_0, Stream0=flatten(vec), Stream1=flatten(vec_2))  # -> flatten(Stream)
move = Move(Geometry=crv_bounds, Motion=filter_2)  # -> Geometry, Transform
move_2 = Move(Geometry=crv_program, Motion=filter_2)  # -> Geometry, Transform
objdet_5 = ObjectDetails(Object=crv_program)  # -> Referenced, Available, Name, Layer, Colour, Guid
move_3 = Move(Geometry=crv_facade, Motion=filter_2)  # -> Geometry, Transform
move_4 = Move(Geometry=crv_circulation, Motion=filter_2)  # -> Geometry, Transform
crv_program_2 = Curve(move_2.Geometry)
crv_facade_2 = Curve(move_3.Geometry)
crv_circulation_2 = Curve(move_4.Geometry)
crv_bounds_2 = Curve(move.Geometry)
split = TextSplit(Text=objdet_5.Layer, Separators="::")
item_2 = ListItem(List=split, Index=Slider(4, range=0..10), Wrap=True)  # -> flatten(Item)

# ---- group: SORT : Door PT
objdet_6 = ObjectDetails(Object=pt)  # -> Referenced, Available, Name, Layer, Colour, Guid
tmatch_5 = MatchText(Text=objdet_6.Layer, Pattern="Apartment::a_circpt", Case=True)
dispatch_5 = Dispatch(List=pt, DispatchPattern=tmatch_5)  # -> ListA, ListB

# ----
pt_circpt = Point(dispatch_5.ListA)
move_5 = Move(Geometry=pt_circpt, Motion=filter_2)  # -> Geometry, Transform
pt_circpt_2 = Point(move_5.Geometry)

panel = Panel(crv_bounds_2)
panel_2 = Panel(item_2)
py3 = Python3Script(
    name=flatten(name),
    crv=flatten(crv_program_2),
    u=flatten(item_2),
    ptCirc=flatten(pt_circpt_2),
    crvBounds=flatten(crv_bounds_2),
    crvFacade=flatten(crv_facade_2),
    crvCirc=flatten(crv_circulation_2),
    id=flatten(id))  # -> out, a; inputs name: tree, crv: list of Polyline, u: String, ptCirc: list of Point3d, crvBounds: Polyline, crvFacade: list of Polyline, crvCirc: list of Polyline, id: String
# ---------- py3: Python ----------
import json
from os import name
from typing import List, Tuple, Dict, Any
from pathlib import Path


def polyline_to_coords(polyline) -> List[Tuple[float, float]]:
    """Convert Rhino Polyline to list of [x, y] coordinates"""
    coords = []
    for i in range(polyline.Count):
        pt = polyline[i]
        coords.append([pt.X, pt.Y])
    return coords


def point3d_to_coords(point) -> Tuple[float, float]:
    """Convert Rhino Point3d to [x, y]"""
    return [point.X, point.Y]


def line_to_coords(line) -> List[List[float]]:
    """Convert Rhino Line to [[x1, y1], [x2, y2]]"""
    return [[line.From.X, line.From.Y], [line.To.X, line.To.Y]]


def calculate_polygon_area(coords: List[List[float]]) -> float:
    """Calculate polygon area using shoelace formula"""
    if len(coords) < 3:
        return 0.0
    area = 0.0
    for i in range(len(coords) - 1):
        area += coords[i][0] * coords[i + 1][1]
        area -= coords[i + 1][0] * coords[i][1]
    return abs(area) / 2.0


def calculate_polyline_length(coords: List[List[float]]) -> float:
    """Calculate total length of a polyline"""
    if len(coords) < 2:
        return 0.0
    length = 0.0
    for i in range(len(coords) - 1):
        dx = coords[i + 1][0] - coords[i][0]
        dy = coords[i + 1][1] - coords[i][1]
        length += (dx**2 + dy**2) ** 0.5
    return round(length, 2)


def find_adjacent_rooms(door_coords: List[List[float]], rooms_coords: Dict[str, List[List[float]]]) -> List[str]:
    """Find which rooms a door connects to (simple proximity check)"""
    door_pt = door_coords[0]  # Use first point
    adjacent = []
    
    for room_id, coords in rooms_coords.items():
        # Check if door is near room boundary
        for i in range(len(coords) - 1):
            p1 = coords[i]
            p2 = coords[i + 1]
            dist = point_to_line_distance(door_pt, p1, p2)
            if dist < 0.5:  # Threshold: door within 0.5 units of boundary
                if room_id not in adjacent:
                    adjacent.append(room_id)
                break
    
    return adjacent


def point_to_line_distance(pt: List[float], p1: List[float], p2: List[float]) -> float:
    """Calculate distance from point to line segment"""
    x, y = pt
    x1, y1 = p1
    x2, y2 = p2
    
    denom = (x2 - x1) ** 2 + (y2 - y1) ** 2
    if denom == 0:
        return ((x - x1) ** 2 + (y - y1) ** 2) ** 0.5
    
    t = max(0, min(1, ((x - x1) * (x2 - x1) + (y - y1) * (y2 - y1)) / denom))
    closest_x = x1 + t * (x2 - x1)
    closest_y = y1 + t * (y2 - y1)
    
    return ((x - closest_x) ** 2 + (y - closest_y) ** 2) ** 0.5


def geometry_to_layout_schema(
    crvBounds,
    crv: List,
    u: List[str],
    crvFacade: List = None,
    crvCirc: List = None,
    ptCirc: List = None,
    layout_id: str = "Layout-001",
    apartment_id: str = "apartment-1",
    apartment_name: str = "Sample Apartment"
) -> Dict[str, Any]:
    """
    Convert Grasshopper geometry to extended layout schema
    
    Args:
        crvBounds: Single polyline for building outline
        crv: List of polylines for room boundaries
        u: List of room program names (e.g., ["living", "bed", "kitchen"])
        crvFacade: List of polylines for facade elements
        crvCirc: List of polylines for circulation
        ptCirc: List of Point3d for door locations
        layout_id: ID for the layout
        apartment_id: ID for the apartment
        apartment_name: Name for the apartment
    
    Returns:
        Dictionary with extended layout_schema structure
    """
    
    # Convert bounds
    outline_coords = polyline_to_coords(crvBounds)
    outline_area = calculate_polygon_area(outline_coords)
    
    # Create apartment object
    apartment = {
        "id": apartment_id,
        "name": apartment_name,
        "geometry": outline_coords,
        "attributes": {
            "area": round(outline_area, 2)
        }
    }
    
    # Process rooms
    rooms = []
    rooms_coords = {}
    
    for i, room_polyline in enumerate(crv):
        room_coords = polyline_to_coords(room_polyline)
        room_id = f"room-{i + 1}"
        rooms_coords[room_id] = room_coords
        
        room_program = u[i] if i < len(u) else "unknown"
        room_area = calculate_polygon_area(room_coords)
        
        room = {
            "id": room_id,
            "name": f"{room_program.capitalize()} {i + 1}",
            "program": room_program,
            "geometry": room_coords,
            "attributes": {
                "area": round(room_area, 2)
            }
        }
        rooms.append(room)
    
    # Process doors
    doors = []
    if ptCirc:
        for i, door_pt in enumerate(ptCirc):
            door_coords = [point3d_to_coords(door_pt)]
            adjacent_rooms = find_adjacent_rooms(door_coords, rooms_coords)
            
            door = {
                "id": f"door-{i + 1}",
                "name": f"Door {i + 1}",
                "geometry": door_coords,
                "attributes": {
                    "connectsRooms": adjacent_rooms
                }
            }
            doors.append(door)
    
    # Process facades
    facades = []
    if crvFacade:
        for i, facade_polyline in enumerate(crvFacade):
            facade_coords = polyline_to_coords(facade_polyline)
            facade_length = calculate_polyline_length(facade_coords)
            facade = {
                "id": f"facade-{i + 1}",
                "name": f"Facade {i + 1}",
                "geometry": facade_coords,
                "attributes": {
                    "type": "exterior",
                    "length": facade_length
                }
            }
            facades.append(facade)
    
    # Process circulation
    circulation = []
    if crvCirc:
        for i, circ_polyline in enumerate(crvCirc):
            circ_coords = polyline_to_coords(circ_polyline)
            circ_length = calculate_polyline_length(circ_coords)
            circ = {
                "id": f"circulation-{i + 1}",
                "name": f"Circulation {i + 1}",
                "geometry": circ_coords,
                "attributes": {
                    "type": "circulation",
                    "length": circ_length
                }
            }
            circulation.append(circ)
    
    # Build schema
    schema = {
        "layoutId": layout_id,
        "apartment": apartment,
        "outline": outline_coords,
        "rooms": rooms,
        "doors": doors,
        "facades": facades,
        "circulation": circulation,
        "windows": [],
        "furniture": [],
        "mep": [],
        "structure": []
    }
    
    return schema

schema = geometry_to_layout_schema(
        crvBounds,
        crv,
        u,
        crvFacade,
        crvCirc,
        ptCirc,
        id,
        id,
       name
     )

a = json.dumps(schema, indent=2)
# ---------- end py3 ----------
a = ClusterOutput(py3.a)

# ==== cluster Cluster_2
geo = ClusterInput()

geo_2 = Geometry(simplify(geo))

# ---- group: SORT : Program
crv = Curve(geo_2)
objdet = ObjectDetails(Object=crv)  # -> Referenced, Available, Name, Layer, Colour, Guid
tmatch = MatchText(Text=objdet.Layer, RegEx="Apartment::a_program", Case=False)
dispatch = Dispatch(List=crv, DispatchPattern=tmatch)  # -> ListA, ListB
crv_program = Curve(dispatch.ListA)

# ---- group: SORT : Facade
crv_2 = Curve(geo_2)
objdet_2 = ObjectDetails(Object=crv_2)  # -> Referenced, Available, Name, Layer, Colour, Guid
tmatch_2 = MatchText(Text=objdet_2.Layer, Pattern="Apartment::facade", Case=True)
dispatch_2 = Dispatch(List=crv_2, DispatchPattern=tmatch_2)  # -> ListA, ListB

# ---- group: SORT : Circulation
crv_3 = Curve(geo_2)
objdet_3 = ObjectDetails(Object=crv_3)  # -> Referenced, Available, Name, Layer, Colour, Guid
tmatch_3 = MatchText(Text=objdet_3.Layer, Pattern="Apartment::circulation", Case=True)
dispatch_3 = Dispatch(List=crv_3, DispatchPattern=tmatch_3)  # -> ListA, ListB

# ---- group: SORT : BOUNDS
crv_4 = Curve(geo_2)
objdet_4 = ObjectDetails(Object=crv_4)  # -> Referenced, Available, Name, Layer, Colour, Guid
tmatch_4 = MatchText(Text=objdet_4.Layer, Pattern="Apartment::boundary", Case=True)
dispatch_4 = Dispatch(List=crv_4, DispatchPattern=tmatch_4)  # -> ListA, ListB
item = ListItem(List=dispatch_4.ListA, Index=0, Wrap=True)
crv_bounds = Curve(item)

# ----
name = ClusterInput()
id = ClusterInput()

pt = Point(geo_2)
move_to_0_0_0 = BooleanToggle(True)
crv_circulation = Curve(dispatch_3.ListA)
crv_facade = Curve(dispatch_2.ListA)
pt_2 = Point(Point(0, 0, 0))
area = Area(Geometry=crv_bounds, UseTasks=False)  # -> Area, Centroid
vec = Vector(pt_2)
filter = StreamFilter(Gate=move_to_0_0_0, Stream0=flatten(vec), Stream1=flatten(area.Centroid))  # -> flatten(Stream)
rev = Reverse(Vector=filter)
vec_2 = Vector(rev)
filter_2 = StreamFilter(Gate=move_to_0_0_0, Stream0=flatten(vec), Stream1=flatten(vec_2))  # -> flatten(Stream)
move = Move(Geometry=crv_bounds, Motion=filter_2)  # -> Geometry, Transform
move_2 = Move(Geometry=crv_program, Motion=filter_2)  # -> Geometry, Transform
objdet_5 = ObjectDetails(Object=crv_program)  # -> Referenced, Available, Name, Layer, Colour, Guid
move_3 = Move(Geometry=crv_facade, Motion=filter_2)  # -> Geometry, Transform
move_4 = Move(Geometry=crv_circulation, Motion=filter_2)  # -> Geometry, Transform
crv_program_2 = Curve(move_2.Geometry)
crv_facade_2 = Curve(move_3.Geometry)
crv_circulation_2 = Curve(move_4.Geometry)
crv_bounds_2 = Curve(move.Geometry)
split = TextSplit(Text=objdet_5.Layer, Separators="::")
item_2 = ListItem(List=split, Index=Slider(4, range=0..10), Wrap=True)  # -> flatten(Item)

# ---- group: SORT : Door PT
objdet_6 = ObjectDetails(Object=pt)  # -> Referenced, Available, Name, Layer, Colour, Guid
tmatch_5 = MatchText(Text=objdet_6.Layer, Pattern="Apartment::a_circpt", Case=True)
dispatch_5 = Dispatch(List=pt, DispatchPattern=tmatch_5)  # -> ListA, ListB

# ----
pt_circpt = Point(dispatch_5.ListA)
move_5 = Move(Geometry=pt_circpt, Motion=filter_2)  # -> Geometry, Transform
pt_circpt_2 = Point(move_5.Geometry)

panel = Panel(crv_bounds_2)
panel_2 = Panel(item_2)
py3 = Python3Script(
    name=flatten(name),
    crv=flatten(crv_program_2),
    u=flatten(item_2),
    ptCirc=flatten(pt_circpt_2),
    crvBounds=flatten(crv_bounds_2),
    crvFacade=flatten(crv_facade_2),
    crvCirc=flatten(crv_circulation_2),
    id=flatten(id))  # -> out, a; inputs name: tree, crv: list of Polyline, u: String, ptCirc: list of Point3d, crvBounds: Polyline, crvFacade: list of Polyline, crvCirc: list of Polyline, id: String; same code as py3
a = ClusterOutput(py3.a)
