# Grasshopper definition Weber2024 Hypergraph Reference Script 0 Load Hypergraph.gh (Grasshopper 1.0.8)
# plug-ins: Human

# ---- group: Read Database
# Hypergraph Reference Script 0
# (c) Ramon Weber 2024, reweber@mit.edu
# 
# Load a json hypergraph file from local directory
# 01 Input Json
path_to_json_file = Panel("C:\Users\ecori\source\iaac\aia_studio\hypergraph\notebooks\src\sample_hypergraphs.json")
c_script = CSharpScript(
    pathVar=path_to_json_file,
    run=Toggle(True),
    Reference=["C:\USERS\ECORI\SOURCE\IAAC\AIA_STUDIO\HYPERGRAPH\SAMPLES\_REQUIREDDLLS\MathNet.Numerics.dll", "C:\USERS\ECORI\SOURCE\IAAC\AIA_STUDIO\HYPERGRAPH\SAMPLES\_REQUIREDDLLS\RGeoLib.dll", "C:\USERS\ECORI\SOURCE\IAAC\AIA_STUDIO\HYPERGRAPH\SAMPLES\_REQUIREDDLLS\Dbscan.dll", "C:\USERS\ECORI\SOURCE\IAAC\AIA_STUDIO\HYPERGRAPH\SAMPLES\_REQUIREDDLLS\System.Text.Json.dll", "C:\USERS\ECORI\SOURCE\IAAC\AIA_STUDIO\HYPERGRAPH\SAMPLES\_REQUIREDDLLS\System.Text.Encodings.Web.dll", "C:\USERS\ECORI\SOURCE\IAAC\AIA_STUDIO\HYPERGRAPH\SAMPLES\_REQUIREDDLLS\System.Json.dll"])  # -> simplify(out), A; inputs pathVar: String, run: Boolean
# ---------- c_script: C# usings ----------
using System.Linq;
using RGeoLib;
using RGeoLib.BuildingSolver;
using System.Text.Json;
using System.Collections.Generic;
using System.IO;
# ---------- c_script: C# ----------
    // GLOBAL VALUES
    List<Apartment> referenceApartmentList = new List<Apartment>();

    if (run)
    {
      referenceApartmentList = ALibrary.ReadApartmentsFromJson(pathVar);
    }
      
    
    A = referenceApartmentList;
    //Apartment refA = new Apartment(database, id, country, city, name, refB, refF, refC, refS);
    // A INITIALIZE APT LIST
    //refA.updateMerged();
    //refA.updateDoorsWithAdjacency();

    //if (refA.rooms.faceList.Count > 1)
    //{
    //  resultApt = refA;
    //}
    //meshMerged = RhConvert.NFaceToRhLineCurveList(refA.bounds);
    //A = RhConvert.NLineListToRhLineCurveList(refA.circulation);
# ---------- c_script: C# additional code ----------
  //-----------------------------------------------------------------
# ---------- end c_script ----------

# ---- group: Conversion
c_script_2 = CSharpScript(
    refApt=c_script.A,
    Reference=["C:\USERS\ECORI\SOURCE\IAAC\AIA_STUDIO\HYPERGRAPH\SAMPLES\_REQUIREDDLLS\MathNet.Numerics.dll", "C:\USERS\ECORI\SOURCE\IAAC\AIA_STUDIO\HYPERGRAPH\SAMPLES\_REQUIREDDLLS\RGeoLib.dll", "C:\USERS\ECORI\SOURCE\IAAC\AIA_STUDIO\HYPERGRAPH\SAMPLES\_REQUIREDDLLS\Dbscan.dll"])  # -> out, apts, A, B, C
# ---------- c_script_2: C# ----------
    // GLOBAL VALUES


    Apartment importApt = (Apartment) refApt;

    importApt.updateDoorsWithAdjacency();
    
    apts = importApt;
# ---------- c_script_2: C# additional code ----------
  /*
  public void updateCirculation()
  {
  for (int i = 0; i < this.roomsMerged.faceList.Count; i++)
  {
  string mergeIdTemp = this.roomsMerged.faceList[i].merge_id;

  this.roomsMerged.faceList[i] = NFace.deleteInternalLines(this.roomsMerged.faceList[i]);
  this.roomsMerged.faceList[i].merge_id = mergeIdTemp;

  }
  // Extraction STEP 3: Circulation

  // shattered circulation lines from all rooms --> for access
  // intersect circulation mesh with lines that go to merged mesh, living, foyer.
  List<NLine> roomLinesList = new List<NLine>();
  for (int i = 0; i < this.roomsMerged.faceList.Count; i++)
  {
  if (this.roomsMerged.faceList[i].merge_id == "living" || this.roomsMerged.faceList[i].merge_id == "foyer" || this.roomsMerged.faceList[i].merge_id == "kitchen")
  {
  List<NLine> currentRoomLines = RhConvert.NFaceToLineList(this.roomsMerged.faceList[i]);
  roomLinesList.AddRange(currentRoomLines);
  }
  }

  List<NLine> intersectionCircTemp = RIntersection.lowTolBoolIntersection(roomLinesList, this.circulation, 0.15);
  this.circulation = intersectionCircTemp;

  // Update Eval Function
  this.updateCircEval();
  }
  */
# ---------- end c_script_2 ----------
apt_data = Data(c_script_2.apts)

# ----
# Apartment selector
number_slider = Slider(0, range=0..5)
item = ListItem(List=apt_data, Index=number_slider, Wrap=True)

# ----
# 02 Evaluate and Visualize
# Minimum Size List: Studio - 21.4m2
# 1Bed - 33.4m2
# 2Bed - 45.4m2
# 3Bed - 58.2m2
# 4Bed - 66.2m2
# 5Bed - 74.2m2
update = Button()
filter = StreamFilter(Gate=update, Stream0=item)
c_script_3 = CSharpScript(
    testApt1=filter,
    mergeDelta=Slider(0.25, range=0..1),
    wall_inside=Slider(0.075, range=0..0.1),
    wall_outside=Slider(0.12, range=0..1),
    Reference=["C:\USERS\ECORI\SOURCE\IAAC\AIA_STUDIO\HYPERGRAPH\SAMPLES\_REQUIREDDLLS\MathNet.Numerics.dll", "C:\USERS\ECORI\SOURCE\IAAC\AIA_STUDIO\HYPERGRAPH\SAMPLES\_REQUIREDDLLS\RGeoLib.dll", "C:\USERS\ECORI\SOURCE\IAAC\AIA_STUDIO\HYPERGRAPH\SAMPLES\_REQUIREDDLLS\Dbscan.dll", "C:\USERS\ECORI\SOURCE\IAAC\AIA_STUDIO\HYPERGRAPH\SAMPLES\_REQUIREDDLLS\System.Text.Json.dll", "C:\USERS\ECORI\SOURCE\IAAC\AIA_STUDIO\HYPERGRAPH\SAMPLES\_REQUIREDDLLS\Clipper2Lib.dll"])  # -> out, boundsOut, facOut, circOut, rooms, roomsNames, roomsMerged, roomsMergedNames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; inputs mergeDelta: Double, wall_inside: Double, wall_outside: Double
# ---------- c_script_3: C# ----------
    Apartment aptIn = (Apartment) testApt1;

    aptIn.rooms = NMesh.cleanInOut(aptIn.rooms, -mergeDelta);
    aptIn.rooms = NMesh.cleanInOut(aptIn.rooms, mergeDelta);

    rooms = RhConvert.NMeshToRhLinePolylineList(aptIn.rooms);

    aptIn.updateMerged();



    roomsNames = aptIn.getRoomNames();
    roomsMergedNames = aptIn.getRoomMergedNames();

    // Extraction STEP 1: Facade
    facOut = RhConvert.NLineListToRhLineCurveList(aptIn.facade);

    // Extraction STEP 2: Bounds
    NFace bounds = aptIn.bounds;
    bounds.makeCounterClockwise();
    boundsOut = RhConvert.NFaceToRhLineCurveList(bounds);

    // Extraction STEP 3: Circulation
    circOut = RhConvert.NLineListToRhLineCurveList(aptIn.circulation);

    // Extraction STEP 4: Doors
    doorsOut = RhConvert.NLineListToRhLineCurveList(aptIn.doors);

    // Extraction STEP 5: Rooms Merged
    roomsMerged = RhConvert.NMeshToRhLinePolylineList(aptIn.roomsMerged);


    doors_all = RhConvert.NLineListToRhLineCurveList(aptIn.doorsAll);

    ///////////////////////////////////////////////////////////////////////
    ///Visualize Bounds

    NMesh internalMesh = aptIn.roomsMerged;

    List<NFace> outFaces = new List<NFace>();

    for (int i = 0;i < internalMesh.faceList.Count; i++)
    {
      NMesh tempMesh = RClipper.clipperInflatePathsMitterPolygon(internalMesh.faceList[i], -wall_inside);
      outFaces.AddRange(tempMesh.faceList);
    }

    NMesh outMesh = new NMesh(outFaces);

    draw_rooms = RhConvert.NMeshToRhLinePolylineList(outMesh);
    NMesh mergedRoomsNMesh = outMesh;

    NMesh outsideMesh = RClipper.clipperInflatePathsMitterPolygon(bounds, wall_outside);

    draw_bounds = RhConvert.NMeshToRhLinePolylineList(outsideMesh);




    List<NFace> intersectionRoomsList = new List<NFace>();

    for (int i = 0; i < aptIn.rooms.faceList.Count; i++)
    {

      for (int j = 0; j < mergedRoomsNMesh.faceList.Count; j++)
      {
        NMesh intersectionRooms = RClipper.clipperIntersection(aptIn.rooms.faceList[i], mergedRoomsNMesh.faceList[j]);
        intersectionRoomsList.AddRange(intersectionRooms.faceList);
      }
    }

    NMesh outMesh2 = new NMesh(intersectionRoomsList);
    draw_cut_rooms = RhConvert.NMeshToRhLinePolylineList(outMesh2);



    // Populate with furniture:

    ///////////////////////////////////////////
    // Rooms

    // offset inside line

    ///////////////////////////////////////////
    // DOORS


    // Blocked entrance

    // get longest line from entrance lines
    // offset on side and return line

    // Blocked doors
    // get doors

    // add blocking squares

    ///////////////////////////////////////////

    // Room Graph
    // check if in the room graph, the bedroom has an extra room attached:
    // if yes, no storage, if no, storage

    // dining room table only in one?

    ///////////////////////////////////////////////
    // Create Scoring metric


    double doorWidth = 0.8;
    double doorOffset = 0.2;
    double doorClearance = 1.5;
    double wallThickness = -0.15;

    bool leftOrient = true;
    List<NLine> doorActual = new List<NLine>();
    List<NFace> doorDrawing = new List<NFace>();

    for (int i = 0;i < aptIn.doors.Count;i++)
    {

      NLine selectedLine = aptIn.doors[i];

      Vec3d dirVecBlocked = Vec3d.ScaleToLen(selectedLine.Direction, doorOffset + doorWidth + doorOffset);
      Vec3d dirVecOffset = Vec3d.ScaleToLen(selectedLine.Direction, doorOffset);
      Vec3d dirVecDoor = Vec3d.ScaleToLen(selectedLine.Direction, doorWidth);

      //List<NLine> doorBlockedLine = new List<NLine>();
      //List<NLine> doorActual = new List<NLine>();


      /////////////////////////////////////////////////////////////////////////////
      // Check orientation and do left one or right one

      if (leftOrient)
      {
        NLine tempDoor = new NLine(selectedLine.start, selectedLine.start + dirVecBlocked);

        if (tempDoor.Length < selectedLine.Length)
        {
          // DOOR valid if smaller length than right door
          //doorBlockedLine.Add(tempDoor);
          NLine tempActual = new NLine(selectedLine.start + dirVecOffset, selectedLine.start + dirVecOffset + dirVecDoor);
          doorActual.Add(tempActual);

          List<NLine> tempList = new List<NLine>();
          tempList.Add(tempActual);
          NPolyLine tempActualPoly = new NPolyLine(tempList);
          NMesh tempFace = RClipper.clipperInflatePolylineMiterButtMesh(tempActualPoly, wallThickness);
          doorDrawing.AddRange(tempFace.faceList);
        }
      }
      else
      {
        NLine tempDoor = new NLine(selectedLine.end - dirVecBlocked, selectedLine.end);

        if (tempDoor.Length < selectedLine.Length)
        {
          // DOOR valid if smaller length than right door
          //doorBlockedLine.Add(tempDoor);
          NLine tempActual = new NLine(selectedLine.end - dirVecOffset - dirVecDoor, selectedLine.end - dirVecOffset);
          doorActual.Add(tempActual);

          List<NLine> tempList = new List<NLine>();
          tempList.Add(tempActual);
          NPolyLine tempActualPoly = new NPolyLine(tempList);
          NMesh tempFace = RClipper.clipperInflatePolylineMiterButtMesh(tempActualPoly, wallThickness);
          doorDrawing.AddRange(tempFace.faceList);

        }
      }
    }

    doors_center = RhConvert.NLineListToRhLineCurveList(doorActual);



    NMesh doorDrawMesh = new NMesh(doorDrawing);
    doors_rect = RhConvert.NMeshToRhLinePolylineList(doorDrawMesh);
# ---------- c_script_3: C# additional code ----------
  //-----------------------------------------------------------------
# ---------- end c_script_3 ----------
wall_external = Slider(0.12, range=0..1)
wall_internal = Slider(0.08, range=0..1)
cluster = Cluster(geo=c_script_3.facOut, internalwallthickness=wall_internal, outsidewallthickness=wall_external, C=c_script_3.roomsMerged)  # -> G_2, swatch, number_slider_4, V, internalwallthickness_3, outsidewallthickness_3, G_3, G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
cluster_2 = Cluster_2(
    T=cluster.V,
    crv=c_script_3.circOut,
    T_2=cluster.V,
    outsidewallthickness=cluster.outsidewallthickness_3,
    internalwallthickness=cluster.internalwallthickness_3)  # -> G_2, swatch_4, G_3, number_slider_2, swatch_3, number_slider_3, crv_7, swatch_5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
cluster_3 = Cluster_3(crv=c_script_3.doors_rect, crv_2=c_script_3.doors_center, T=cluster.V)  # -> crv_5, swatch_2, number_slider_3, crv_6, swatch, number_slider_2, G, swatch_3, number_slider
number_slider_2 = Slider(2, range=0..10)
swatch = ColourSwatch(SwatchColor=RGB(0, 0, 0))
crv = Curve(c_script_3.draw_rooms)
previewlw = CustomPreviewLineweights(Geometry=crv, Shader=swatch, Thickness=number_slider_2, Absolute=False)
previewlw_2 = CustomPreviewLineweights(Geometry=cluster.G_2, Shader=cluster.swatch, Thickness=cluster.number_slider_4, Absolute=False)
previewlw_3 = CustomPreviewLineweights(Geometry=cluster.G_3, Shader=cluster.swatch_2, Thickness=cluster.number_slider_5, Absolute=False)
previewlw_4 = CustomPreviewLineweights(Geometry=cluster.G, Shader=cluster.swatch_2, Thickness=cluster.number_slider_3, Absolute=False)

# ---- group: Minimum Furnishing
furniture_cluster = FurnitureCluster()  # -> studio_bed_2, studio_living_2, studio_kitchen_2, studio_dining_2, studio_bath_1_2, studio_bath_2_2, studio_bath_3_2, _1_bed_bed_2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
c_script_4 = CSharpScript(
    aptIn=graft(filter),
    studio_bed=furniture_cluster.studio_bed_2,
    studio_living=furniture_cluster.studio_living_2,
    studio_kitchen=furniture_cluster.studio_kitchen_2,
    studio_dining=furniture_cluster.studio_dining_2,
    studio_bath1=furniture_cluster.studio_bath_1_2,
    studio_bath2=furniture_cluster.studio_bath_2_2,
    studio_bath3=furniture_cluster.studio_bath_3_2,
    oneBed_bed=furniture_cluster._1_bed_bed_2,
    oneBed_storage=furniture_cluster._1_bed_storage_2,
    oneBed_living=furniture_cluster._1_bed_living_2,
    oneBed_kitchen=furniture_cluster._1_bed_kitchen_2,
    oneBed_dining=furniture_cluster._1_bed_dining_2,
    oneBed_bath1=furniture_cluster._1_bed_bath_1_2,
    oneBed_bath2=furniture_cluster._1_bed_bath_2_2,
    oneBed_bath3=furniture_cluster._1_bed_bath_3_2,
    twoBed_bed=furniture_cluster._2_bed_bed_2,
    twoBed_storage=furniture_cluster._2_bed_storage_2,
    twoBed_bedSecondary=furniture_cluster._2_bed_bed_secondary_2,
    twoBed_storageSecondary=furniture_cluster._2_bed_storage_secondary_2,
    twoBed_living=furniture_cluster._2_bed_living_2,
    twoBed_kitchen=furniture_cluster._2_bed_kitchen_2,
    twoBed_dining=furniture_cluster._2_bed_dining_2,
    twoBed_bath1=furniture_cluster._2_bed_bath_1_2,
    twoBed_bath2=furniture_cluster._2_bed_bath_2_2,
    twoBed_bath3=furniture_cluster._2_bed_bath_3_2,
    threeBed_bed=furniture_cluster._3_bed_bed_2,
    threeBed_storage=furniture_cluster._3_bed_storage_2,
    threeBed_bedSecondary=furniture_cluster._3_bed_bed_secondary_2,
    threeBed_storageSecondary=furniture_cluster._3_bed_storage_secondary_2,
    threeBed_living=furniture_cluster._3_bed_living_2,
    threeBed_kitchen=furniture_cluster._3_bed_kitchen_2,
    threeBed_dining=furniture_cluster._3_bed_dining_2,
    threeBed_bath1=furniture_cluster._3_bed_bath_1_2,
    threeBed_bath2=furniture_cluster._3_bed_bath_2_2,
    threeBed_bath3=furniture_cluster._3_bed_bath_3_2,
    Reference=["C:\USERS\ECORI\SOURCE\IAAC\AIA_STUDIO\HYPERGRAPH\SAMPLES\_REQUIREDDLLS\MathNet.Numerics.dll", "C:\USERS\ECORI\SOURCE\IAAC\AIA_STUDIO\HYPERGRAPH\SAMPLES\_REQUIREDDLLS\RGeoLib.dll", "C:\USERS\ECORI\SOURCE\IAAC\AIA_STUDIO\HYPERGRAPH\SAMPLES\_REQUIREDDLLS\Dbscan.dll", "C:\USERS\ECORI\SOURCE\IAAC\AIA_STUDIO\HYPERGRAPH\SAMPLES\_REQUIREDDLLS\Clipper2Lib.dll"])  # -> out, outApt, furnitureDrawing, roomDrawing, minFurnitureValid, minfurnitureArea, numberOfBedrooms, furnitureAreas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; inputs studio_bed: list, studio_living: list, studio_kitchen: list, studio_dining: list, studio_bath1: list, studio_bath2: list, studio_bath3: list, oneBed_bed: list, oneBed_storage: list, oneBed_living: list, oneBed_kitchen: list, oneBed_dining: list, oneBed_bath1: list, oneBed_bath2: list, oneBed_bath3: list, twoBed_bed: list, twoBed_storage: list, twoBed_bedSecondary: list, twoBed_storageSecondary: list, twoBed_living: list, twoBed_kitchen: list, twoBed_dining: list, twoBed_bath1: list, twoBed_bath2: list, twoBed_bath3: list, threeBed_bed: list, threeBed_storage: list, threeBed_bedSecondary: list, threeBed_storageSecondary: list, threeBed_living: list, threeBed_kitchen: list, threeBed_dining: list, threeBed_bath1: list, threeBed_bath2: list, threeBed_bath3: list
# ---------- c_script_4: C# ----------
    Apartment currentApt = (Apartment) aptIn;

    /////////////////////////////////////////////////////

    // Studio
    List<Furniture> studio_furniture_bed = studio_bed.Cast<Furniture>().ToList();
    List<Furniture> studio_furniture_living = studio_living.Cast<Furniture>().ToList();
    List<Furniture> studio_furniture_kitchen = studio_kitchen.Cast<Furniture>().ToList();
    List<Furniture> studio_furniture_dining = studio_dining.Cast<Furniture>().ToList();

    List<Furniture> studio_furniture_bath1_toilet = studio_bath1.Cast<Furniture>().ToList();
    List<Furniture> studio_furniture_bath2_sink = studio_bath2.Cast<Furniture>().ToList();
    List<Furniture> studio_furniture_bath3_shower = studio_bath3.Cast<Furniture>().ToList();

    // 1 Bed
    List<Furniture> oneBed_furniture_bed = oneBed_bed.Cast<Furniture>().ToList();
    List<Furniture> oneBed_furniture_storage = oneBed_storage.Cast<Furniture>().ToList();
    List<Furniture> oneBed_furniture_living = oneBed_living.Cast<Furniture>().ToList();
    List<Furniture> oneBed_furniture_kitchen = oneBed_kitchen.Cast<Furniture>().ToList();
    List<Furniture> oneBed_furniture_dining = oneBed_dining.Cast<Furniture>().ToList();

    List<Furniture> oneBed_furniture_bath1_toilet = oneBed_bath1.Cast<Furniture>().ToList();
    List<Furniture> oneBed_furniture_bath2_sink = oneBed_bath2.Cast<Furniture>().ToList();
    List<Furniture> oneBed_furniture_bath3_shower = oneBed_bath3.Cast<Furniture>().ToList();

    // 2 Bed
    List<Furniture> twoBed_furniture_bed = twoBed_bed.Cast<Furniture>().ToList();
    List<Furniture> twoBed_furniture_storage = twoBed_storage.Cast<Furniture>().ToList();
    List<Furniture> twoBed_furniture_bedSecondary = twoBed_bedSecondary.Cast<Furniture>().ToList();
    List<Furniture> twoBed_furniture_storageSecondary = twoBed_storageSecondary.Cast<Furniture>().ToList();

    List<Furniture> twoBed_furniture_living = twoBed_living.Cast<Furniture>().ToList();
    List<Furniture> twoBed_furniture_kitchen = twoBed_kitchen.Cast<Furniture>().ToList();
    List<Furniture> twoBed_furniture_dining = twoBed_dining.Cast<Furniture>().ToList();

    List<Furniture> twoBed_furniture_bath1_toilet = twoBed_bath1.Cast<Furniture>().ToList();
    List<Furniture> twoBed_furniture_bath2_sink = twoBed_bath2.Cast<Furniture>().ToList();
    List<Furniture> twoBed_furniture_bath3_shower = twoBed_bath3.Cast<Furniture>().ToList();

    // 3 Bed
    List<Furniture> threeBed_furniture_bed = threeBed_bed.Cast<Furniture>().ToList();
    List<Furniture> threeBed_furniture_storage = threeBed_storage.Cast<Furniture>().ToList();
    List<Furniture> threeBed_furniture_bedSecondary = threeBed_bedSecondary.Cast<Furniture>().ToList();
    List<Furniture> threeBed_furniture_storageSecondary = threeBed_storageSecondary.Cast<Furniture>().ToList();

    List<Furniture> threeBed_furniture_living = threeBed_living.Cast<Furniture>().ToList();
    List<Furniture> threeBed_furniture_kitchen = threeBed_kitchen.Cast<Furniture>().ToList();
    List<Furniture> threeBed_furniture_dining = threeBed_dining.Cast<Furniture>().ToList();

    List<Furniture> threeBed_furniture_bath1_toilet = threeBed_bath1.Cast<Furniture>().ToList();
    List<Furniture> threeBed_furniture_bath2_sink = threeBed_bath2.Cast<Furniture>().ToList();
    List<Furniture> threeBed_furniture_bath3_shower = threeBed_bath3.Cast<Furniture>().ToList();

    //



    List < string > labelList = new List<string>(){
        "Studio",
        "1 - Bed",
        "2 - Bed",
        "3 - Bed",
        "4 - Bed",
        "5 - Bed"
        };



    // Count rooms
    int numBeds = 0;
    for (int i = 0; i < currentApt.rooms.faceList.Count; i++)
    {
      if (currentApt.rooms.faceList[i].merge_id == "bed")
        numBeds++;
    }

    // Evaluate rooms
    string bedrooms = "default";
    List<List<Room>> roomsAllOptions = new List<List<Room>>();


    if (numBeds == 0)
    {
      bedrooms = "0";

      roomsAllOptions = populateStudio(currentApt,

        studio_furniture_bed,
        studio_furniture_living,
        studio_furniture_kitchen,
        studio_furniture_dining,

        studio_furniture_bath1_toilet,
        studio_furniture_bath2_sink,
        studio_furniture_bath3_shower
        );


    }

    else if (numBeds == 1)
    {
      bedrooms = "1";

      roomsAllOptions = populateOneRoom(currentApt,

        oneBed_furniture_bed,
        oneBed_furniture_storage,

        oneBed_furniture_living,
        oneBed_furniture_kitchen,
        oneBed_furniture_dining,

        oneBed_furniture_bath1_toilet,
        oneBed_furniture_bath2_sink,
        oneBed_furniture_bath3_shower
        );


    }
    else if (numBeds == 2)
    {
      bedrooms = "2";

      roomsAllOptions = populateMultiRoom(currentApt,

        twoBed_furniture_bed,
        twoBed_furniture_storage,
        twoBed_furniture_bedSecondary,
        twoBed_furniture_storageSecondary,

        twoBed_furniture_living,
        twoBed_furniture_kitchen,
        twoBed_furniture_dining,

        twoBed_furniture_bath1_toilet,
        twoBed_furniture_bath2_sink,
        twoBed_furniture_bath3_shower
        );


    }

    else if (numBeds >= 3)
    {
      bedrooms = "3+";
      roomsAllOptions = populateMultiRoom(currentApt,

        threeBed_furniture_bed,
        threeBed_furniture_storage,
        threeBed_furniture_bedSecondary,
        threeBed_furniture_storageSecondary,

        threeBed_furniture_living,
        threeBed_furniture_kitchen,
        threeBed_furniture_dining,

        threeBed_furniture_bath1_toilet,
        threeBed_furniture_bath2_sink,
        threeBed_furniture_bath3_shower
        );

    }


    List<Room> roomsOutIter = new List<Room>();
    int iter = 0;
    for (int i = 0; i < roomsAllOptions.Count; i++)
    {
      if (roomsAllOptions[i].Count != 0)
      {
        if (iter >= roomsAllOptions[i].Count)
        {
          int itertemp = iter % roomsAllOptions[i].Count;
          roomsOutIter.Add(roomsAllOptions[i][itertemp]);

        } else
        {
          roomsOutIter.Add(roomsAllOptions[i][iter]);
        }
      }
    }


    ////////////////////////////////////////////////////////////////
    // Calculate furniture Area for excess carbon

    double furnitureTotalArea = 0;
    currentApt.roomList = roomsOutIter;

    List<NFace> furnitureFaces = new List<NFace>();
    for (int i = 0; i < currentApt.rooms.faceList.Count; i++)
    {
      if (currentApt.rooms.faceList[i].merge_id == "extra")
      {
        furnitureTotalArea += currentApt.rooms.faceList[i].Area;
        furnitureFaces.Add(currentApt.rooms.faceList[i]);
      }
    }

    for (int i = 0; i < currentApt.roomList.Count; i++)
    {
      for (int j = 0;j < currentApt.roomList[i].furniture.Count; j++)
      {
        furnitureTotalArea += currentApt.roomList[i].furniture[j].path.Area;
        furnitureFaces.Add(currentApt.roomList[i].furniture[j].path);
      }
    }

    currentApt.eval.minfurnitureArea = furnitureTotalArea;
    currentApt.eval.minfurnitureBool = furnitureValidationSimple(roomsOutIter, currentApt);;

    ////////////////////////////////////////////////////////////////


    minfurnitureArea = furnitureTotalArea;
    minFurnitureValid = furnitureValidationSimple(roomsOutIter, currentApt);
    numberOfBedrooms = bedrooms;

    // Preview Furniture
    NMesh furnitureAreaMesh = new NMesh(furnitureFaces);
    furnitureAreaMesh.facesClockwise();
    furnitureAreas = RhConvert.NMeshToRhLinePolylineList(furnitureAreaMesh);
    roomAreas = RhConvert.NMeshToRhLinePolylineList(currentApt.rooms);
    roomDrawing = RhConvert.RoomDrawPaths(roomsOutIter);

    furnitureDrawing = RhConvert.RoomDrawFurniture(roomsOutIter);
    totalArea = currentApt.rooms.Area;

    nRooms = currentApt.eval.numRooms;


    /*
        Studio - 21.4m2
        1Bed - 33.4m2
        2Bed - 45.4m2
        3Bed - 58.2m2
        4Bed - 66.2m2
        5Bed - 74.2m2
    */

    List <double> minAreaList = new List<double>(){
        21.4,
        33.4,
        45.4,
        58.2,
        66.2,
        74.2
        };

    bool minfurnitureBool = false;
    double furnitureAreaActual = furnitureAreaMesh.Area;
    double furnitureAreaCapped = minAreaList[numBeds];
    if (furnitureAreaActual >= furnitureAreaCapped)
    {
      furnitureAreaCapped = furnitureAreaActual;
      minfurnitureBool = true;
    }

    double excessArea = currentApt.rooms.Area - furnitureAreaCapped * 1.8;

    currentApt.eval.minfurnitureArea = minAreaList[numBeds];
    currentApt.eval.furnitureAreaActual = furnitureAreaActual;
    currentApt.eval.furnitureAreaCapped = furnitureAreaCapped;
    //currentApt.eval.minfurnitureBool = minfurnitureBool;

    currentApt.eval.excessArea = excessArea;




    outApt = currentApt;
# ---------- c_script_4: C# additional code ----------
  public static bool furnitureValidationSimple(List<Room> inputRoomList, Apartment inputApartment)
  {
    List < double > validScoreList = new List<double>(){
        140,//"Studio",
        143,//"1 - Bed",
        165,//"2 - Bed",
        187,//"3 - Bed",
        209,//"4 - Bed",
        231 //"5 - Bed"
        };

    bool furnitureValidSimple = false;

    NMesh bedrooms = inputApartment.rooms.filterNMeshByProperty("bed");
    int numBedrooms = bedrooms.faceList.Count;
    inputApartment.eval.numRooms = numBedrooms;

    List<Furniture> furnitureList = new List<Furniture>();
    double currentScore = 0;

    for (int i = 0; i < inputRoomList.Count; i++)
    {
      currentScore += inputRoomList[i].Score;
    }

    if (currentScore >= validScoreList[numBedrooms])
      furnitureValidSimple = true;

    inputApartment.eval.scoreBoolFurniture = furnitureValidSimple;

    return furnitureValidSimple;
  }

  private static bool CheckDiningExists(List<Room> rooms) {
    return rooms.Any(room => room.furniture.Any(f => f.name == "Dining"));
  }

  public static List<List<Room>> populateStudio(Apartment currentApt,

    List<Furniture> studio_furniture_bed,
    List<Furniture> studio_furniture_living,
    List<Furniture> studio_furniture_kitchen,
    List<Furniture> studio_furniture_dining,

    List<Furniture> studio_furniture_bath1_toilet,
    List<Furniture> studio_furniture_bath2_sink,
    List<Furniture> studio_furniture_bath3_shower
    )
  {

    List<List<Room>> allAptsList = new List<List<Room>>();

    List<string> roomNames = currentApt.getRoomNames();
    double wallThickness = -0.075;
    double doorWidth = 0.8;
    double doorOffset = 0.2;
    double doorClearance = 1.5;
    bool leftOrient = true;

    int numBedrooms = currentApt.rooms.filterNMeshByProperty("bed").faceList.Count;
    currentApt.eval.numRooms = numBedrooms;

    List<NFace> doorClearanceFaceList = new List<NFace>();
    List<NLine> validLinesAll = new List<NLine>();


    List<NLine> doorLines = currentApt.doorsAll;
    List<NLine> circLines = currentApt.circulation;
    doorLines.AddRange(circLines);

    List<NFace> blockedFaces = new List<NFace>();

    // boolean to see if the primary bed was placed.
    bool primaryBathExists = false;
    bool diningExists = false;

    // sort rooms by size (so largest bedroom and bathroom get populated first!
    currentApt.rooms.faceList = currentApt.rooms.faceList.OrderBy(o => o.Area).ToList();
    currentApt.rooms.faceList.Reverse();


    // boolean to see if the bed was placed for studio apt. (otherwise multiple beds if multiple living spaces)
    bool studioBedExists = false;


    for (int i = 0; i < currentApt.rooms.faceList.Count; i++)
    {
      List<Room> roomIterationsList = new List<Room>();

      NFace bounds = currentApt.rooms.faceList[i];
      string program = currentApt.rooms.faceList[i].merge_id;


      List<NLine> boundsLines = RhConvert.NFaceToLineList(bounds);
      List<NLine> doorLinesPerRoom = RIntersection.lineListBooleanIntersectionTol(doorLines, boundsLines, 0.01);

      Room roomInput = new Room(program, bounds, doorLinesPerRoom, wallThickness, doorWidth, doorOffset, doorClearance, leftOrient);

      if (roomInput.blocked.faceList != null)
      {
        doorClearanceFaceList.AddRange(roomInput.blocked.faceList);
        blockedFaces.AddRange(roomInput.blocked.faceList);
      }

      // Fit Furniture in room

      List<Room> allRooms = new List<Room>();
      Room validRoom = roomInput.DeepCopy();


      //



      /////////////////////////////////////////////////////////////////////////
      /// 01 Living / Bedroom Studio
      /////////////////////////////////////////////////////////////////////////

      if (program == "living")
      {
        if (studioBedExists == false)
        {
          Tuple<bool, List<Room>> placementTupleStudio = Room.createStudioLiving(studioBedExists, roomInput, studio_furniture_bed, studio_furniture_living, studio_furniture_dining);
          allRooms = placementTupleStudio.Item2;
          studioBedExists = placementTupleStudio.Item1;

        } else
        {
          // create normal living room
          allRooms = Room.placeFurnitureItemsHierarchically(roomInput, studio_furniture_living, true);

          // 2 Dining - Hierarchy Fill
          if (diningExists == false)
          {
            Tuple<bool, List<Room>> diningPlacementTuple = PlaceFurnitureItemsHierarchicallyBoolList(allRooms, studio_furniture_dining, true);
            diningExists = diningPlacementTuple.Item1;
            allRooms = diningPlacementTuple.Item2;
          }
        }
        roomIterationsList.AddRange(allRooms);
      }

        /////////////////////////////////////////////////////////////////////////
        /// 02 Kitchen
        /////////////////////////////////////////////////////////////////////////

      else if (program == "kitchen")
      {
        // 1 Kitchen - Hierarchy fill
        allRooms = Room.placeFurnitureItemsHierarchically(roomInput, studio_furniture_kitchen, true);


        // 2 Dining - Hierarchy Fill
        if (diningExists == false)
        {
          Tuple<bool, List<Room>> diningPlacementTuple = PlaceFurnitureItemsHierarchicallyBoolList(allRooms, studio_furniture_dining, true);
          diningExists = diningPlacementTuple.Item1;
          allRooms = diningPlacementTuple.Item2;
        }

        roomIterationsList.AddRange(allRooms);
      }

        /////////////////////////////////////////////////////////////////////////
        /// 02 Bath
        /////////////////////////////////////////////////////////////////////////

      else if (program == "bath")
      {

        if (primaryBathExists == false)
        {
          allRooms = Room.placeFurnitureItemsHierarchically(roomInput, studio_furniture_bath1_toilet);
          allRooms = Room.placeFurnitureItemsHierarchically(allRooms, studio_furniture_bath2_sink);
          allRooms = Room.placeFurnitureItemsHierarchically(allRooms, studio_furniture_bath3_shower);

          primaryBathExists = true;
        } else
        {
          allRooms = Room.placeFurnitureItemsHierarchically(roomInput, studio_furniture_bath1_toilet);
          allRooms = Room.placeFurnitureItemsHierarchically(allRooms, studio_furniture_bath2_sink);
        }
        roomIterationsList.AddRange(allRooms);
      }


      /////////////////////////////////////////////////////////////////////////
      /// 03 RETURN
      /////////////////////////////////////////////////////////////////////////

      allAptsList.Add(roomIterationsList);

      // Check if dining room exists
      if (!diningExists) {
        diningExists = CheckDiningExists(allRooms);
      }
    }


    return allAptsList;
  }

  public static List<List<Room>> populateOneRoom(Apartment currentApt,

    List<Furniture> oneBed_furniture_bed,
    List<Furniture> oneBed_furniture_storage,

    List<Furniture> oneBed_furniture_living,
    List<Furniture> oneBed_furniture_kitchen,
    List<Furniture> oneBed_furniture_dining,

    List<Furniture> oneBed_furniture_bath1_toilet,
    List<Furniture> oneBed_furniture_bath2_sink,
    List<Furniture> oneBed_furniture_bath3_shower
    )
  {

    List<List<Room>> allAptsList = new List<List<Room>>();

    List<string> roomNames = currentApt.getRoomNames();
    double wallThickness = -0.075;
    double doorWidth = 0.8;
    double doorOffset = 0.2;
    double doorClearance = 1.5;
    bool leftOrient = true;

    int numBedrooms = currentApt.rooms.filterNMeshByProperty("bed").faceList.Count;
    currentApt.eval.numRooms = numBedrooms;

    List<NFace> doorClearanceFaceList = new List<NFace>();
    List<NLine> validLinesAll = new List<NLine>();


    List<NLine> doorLines = currentApt.doorsAll;
    List<NLine> circLines = currentApt.circulation;
    doorLines.AddRange(circLines);

    List<NFace> blockedFaces = new List<NFace>();

    // boolean to see if the primary bed was placed.
    bool primaryBathExists = false;
    bool diningExists = false;

    // sort rooms by size (so largest bedroom and bathroom get populated first!
    currentApt.rooms.faceList = currentApt.rooms.faceList.OrderBy(o => o.Area).ToList();
    currentApt.rooms.faceList.Reverse();

    for (int i = 0; i < currentApt.rooms.faceList.Count; i++)
    {
      List<Room> roomIterationsList = new List<Room>();

      NFace bounds = currentApt.rooms.faceList[i];
      string program = currentApt.rooms.faceList[i].merge_id;


      List<NLine> boundsLines = RhConvert.NFaceToLineList(bounds);
      List<NLine> doorLinesPerRoom = RIntersection.lineListBooleanIntersectionTol(doorLines, boundsLines, 0.01);

      Room roomInput = new Room(program, bounds, doorLinesPerRoom, wallThickness, doorWidth, doorOffset, doorClearance, leftOrient);

      if (roomInput.blocked.faceList != null)
      {
        doorClearanceFaceList.AddRange(roomInput.blocked.faceList);
        blockedFaces.AddRange(roomInput.blocked.faceList);
      }

      // Fit Furniture in room

      List<Room> allRooms = new List<Room>();
      Room validRoom = roomInput.DeepCopy();

      /////////////////////////////////////////////////////////////////////////
      /// 01 BED
      /////////////////////////////////////////////////////////////////////////
      if (program == "bed")
      {
        // Check if extra is connected
        NMesh extraMesh = currentApt.rooms.filterNMeshByProperty("extra");
        bool extraConnected = Room.hasExtraConnected(roomInput.bounds, extraMesh, doorLinesPerRoom);
        bool placeStorage = !extraConnected;

        allRooms = Room.placeFurnitureItemsHierarchically(roomInput, oneBed_furniture_bed);

        if (placeStorage == true)
        {
          allRooms = Room.placeFurnitureItemsHierarchyWithScoreFill(allRooms, oneBed_furniture_storage, 0.75);
        }

        roomIterationsList.AddRange(allRooms);
      }

        /////////////////////////////////////////////////////////////////////////
        /// 02 Kitchen
        /////////////////////////////////////////////////////////////////////////

      else if (program == "kitchen")
      {
        // 1 Kitchen - Hierarchy fill
        allRooms = Room.placeFurnitureItemsHierarchically(roomInput, oneBed_furniture_kitchen, true);



        // 2 Dining - Hierarchy Fill
        if (diningExists == false)
        {
          Tuple<bool, List<Room>> diningPlacementTuple = PlaceFurnitureItemsHierarchicallyBoolList(allRooms, oneBed_furniture_dining, true);
          diningExists = diningPlacementTuple.Item1;
          allRooms = diningPlacementTuple.Item2;
        }

        roomIterationsList.AddRange(allRooms);
      }

        /////////////////////////////////////////////////////////////////////////
        /// 02 Living
        /////////////////////////////////////////////////////////////////////////

      else if (program == "living")
      {
        // create normal living room
        // 1 Sofa - Hierarchy fill
        allRooms = Room.placeFurnitureItemsHierarchically(roomInput, oneBed_furniture_living, true);
        // 2 Seating - Hierarchy Fill
        //allRooms = Room.placeFurnitureItemsHierarchically(allRooms, oneBed_furniture_dining);

        // 2 Dining - Hierarchy Fill
        if (diningExists == false)
        {
          Tuple<bool, List<Room>> diningPlacementTuple = PlaceFurnitureItemsHierarchicallyBoolList(allRooms, oneBed_furniture_dining, true);
          diningExists = diningPlacementTuple.Item1;
          allRooms = diningPlacementTuple.Item2;
        }


        roomIterationsList.AddRange(allRooms);
      }

        /////////////////////////////////////////////////////////////////////////
        /// 02 Bath
        /////////////////////////////////////////////////////////////////////////

      else if (program == "bath")
      {

        if (primaryBathExists == false)
        {
          allRooms = Room.placeFurnitureItemsHierarchically(roomInput, oneBed_furniture_bath1_toilet);
          allRooms = Room.placeFurnitureItemsHierarchically(allRooms, oneBed_furniture_bath2_sink);
          allRooms = Room.placeFurnitureItemsHierarchically(allRooms, oneBed_furniture_bath3_shower);

          primaryBathExists = true;
        } else
        {
          allRooms = Room.placeFurnitureItemsHierarchically(roomInput, oneBed_furniture_bath1_toilet);
          allRooms = Room.placeFurnitureItemsHierarchically(allRooms, oneBed_furniture_bath2_sink);
        }
        roomIterationsList.AddRange(allRooms);
      }

      allAptsList.Add(roomIterationsList);

      // Check if dining room exists
      if (!diningExists) {
        diningExists = CheckDiningExists(allRooms);
      }

    }


    return allAptsList;
  }


  public static List<List<Room>> populateMultiRoom(Apartment currentApt,

    List<Furniture> threeBed_furniture_bed,
    List<Furniture> threeBed_furniture_storage,
    List<Furniture> threeBed_furniture_bedSecondary,
    List<Furniture> threeBed_furniture_storageSecondary,

    List<Furniture> threeBed_furniture_living,
    List<Furniture> threeBed_furniture_kitchen,
    List<Furniture> threeBed_furniture_dining,

    List<Furniture> threeBed_furniture_bath1_toilet,
    List<Furniture> threeBed_furniture_bath2_sink,
    List<Furniture> threeBed_furniture_bath3_shower
    )
  {

    List<List<Room>> allAptsList = new List<List<Room>>();

    List<string> roomNames = currentApt.getRoomNames();
    double wallThickness = -0.075;
    double doorWidth = 0.8;
    double doorOffset = 0.2;
    double doorClearance = 1.5;
    bool leftOrient = true;

    int numBedrooms = currentApt.rooms.filterNMeshByProperty("bed").faceList.Count;
    currentApt.eval.numRooms = numBedrooms;

    List<NFace> doorClearanceFaceList = new List<NFace>();
    List<NLine> validLinesAll = new List<NLine>();


    List<NLine> doorLines = currentApt.doorsAll;
    List<NLine> circLines = currentApt.circulation;
    doorLines.AddRange(circLines);

    List<NFace> blockedFaces = new List<NFace>();

    // boolean to see if the primary bed was placed.
    bool primaryBedExists = false;
    bool primaryBathExists = false;
    bool diningExists = false;

    // sort rooms by size (so largest bedroom and bathroom get populated first!
    currentApt.rooms.faceList = currentApt.rooms.faceList.OrderBy(o => o.Area).ToList();
    currentApt.rooms.faceList.Reverse();

    for (int i = 0; i < currentApt.rooms.faceList.Count; i++)
    {
      List<Room> roomIterationsList = new List<Room>();

      NFace bounds = currentApt.rooms.faceList[i];
      string program = currentApt.rooms.faceList[i].merge_id;


      List<NLine> boundsLines = RhConvert.NFaceToLineList(bounds);
      List<NLine> doorLinesPerRoom = RIntersection.lineListBooleanIntersectionTol(doorLines, boundsLines, 0.01);

      Room roomInput = new Room(program, bounds, doorLinesPerRoom, wallThickness, doorWidth, doorOffset, doorClearance, leftOrient);

      if (roomInput.blocked.faceList != null)
      {
        doorClearanceFaceList.AddRange(roomInput.blocked.faceList);
        blockedFaces.AddRange(roomInput.blocked.faceList);
      }

      // Fit Furniture in room

      List<Room> allRooms = new List<Room>();
      Room validRoom = roomInput.DeepCopy();

      /////////////////////////////////////////////////////////////////////////
      /// 01 BED
      /////////////////////////////////////////////////////////////////////////
      if (program == "bed")
      {
        // Check if extra is connected
        NMesh extraMesh = currentApt.rooms.filterNMeshByProperty("extra");
        bool extraConnected = Room.hasExtraConnected(roomInput.bounds, extraMesh, doorLinesPerRoom);
        bool placeStorage = !extraConnected;

        if (primaryBedExists == false)
        {

          Tuple<bool, List<Room>> betPlacementTuple = Room.placeFurnitureItemsHierarchicallyBool(roomInput, threeBed_furniture_bed, true);

          primaryBedExists = betPlacementTuple.Item1;
          allRooms = betPlacementTuple.Item2;

          //allRooms = Room.placeFurnitureItemsHierarchically(roomInput, threeBed_furniture_bed);
          //primaryBedExists = true;

          if (primaryBedExists == true && placeStorage == true)
          {
            allRooms = Room.placeFurnitureItemsHierarchyWithScoreFill(allRooms, threeBed_furniture_storage, 0.75);
          }
          if (primaryBedExists == false)
          {
            //allRooms = Room.placeFurnitureItemsHierarchically(roomInput, threeBed_furniture_bed);
            allRooms = Room.placeFurnitureItemsHierarchically(roomInput, threeBed_furniture_bedSecondary);

            if (placeStorage == true)
            {
              allRooms = Room.placeFurnitureItemsHierarchyWithScoreFill(allRooms, threeBed_furniture_storageSecondary, 0.5);
            }
          }

        } else
        {
          //allRooms = Room.placeFurnitureItemsHierarchically(roomInput, threeBed_furniture_bed);
          allRooms = Room.placeFurnitureItemsHierarchically(roomInput, threeBed_furniture_bedSecondary);

          if (placeStorage == true)
          {
            allRooms = Room.placeFurnitureItemsHierarchyWithScoreFill(allRooms, threeBed_furniture_storageSecondary, 0.5);
          }
        }

        roomIterationsList.AddRange(allRooms);
      }

        /////////////////////////////////////////////////////////////////////////
        /// 02 Kitchen
        /////////////////////////////////////////////////////////////////////////

      else if (program == "kitchen")
      {
        // 1 Kitchen - Hierarchy fill
        allRooms = Room.placeFurnitureItemsHierarchically(roomInput, threeBed_furniture_kitchen, true);

        // 2 Dining - Hierarchy Fill
        if (diningExists == false)
        {
          Tuple<bool, List<Room>> diningPlacementTuple = PlaceFurnitureItemsHierarchicallyBoolList(allRooms, threeBed_furniture_dining, true);
          diningExists = diningPlacementTuple.Item1;
          allRooms = diningPlacementTuple.Item2;
        }  //allRooms = Room.placeFurnitureItemsHierarchically(allRooms, threeBed_furniture_dining);

        roomIterationsList.AddRange(allRooms);
      }

        /////////////////////////////////////////////////////////////////////////
        /// 02 Living
        /////////////////////////////////////////////////////////////////////////

      else if (program == "living")
      {
        // create normal living room
        // 1 Sofa - Hierarchy fill
        allRooms = Room.placeFurnitureItemsHierarchically(roomInput, threeBed_furniture_living, true);
        // 2 Seating - Hierarchy Fill
        //allRooms = Room.placeFurnitureItemsHierarchically(allRooms, threeBed_furniture_dining);
        // 2 Dining - Hierarchy Fill
        if (diningExists == false)
        {
          Tuple<bool, List<Room>> diningPlacementTupleL = PlaceFurnitureItemsHierarchicallyBoolList(allRooms, threeBed_furniture_dining, true);
          diningExists = diningPlacementTupleL.Item1;
          allRooms = diningPlacementTupleL.Item2;
        }  //allRooms = Room.placeFurnitureItemsHierarchically(allRooms, threeBed_furniture_dining);

        roomIterationsList.AddRange(allRooms);
      }

        /////////////////////////////////////////////////////////////////////////
        /// 02 Bath
        /////////////////////////////////////////////////////////////////////////

      else if (program == "bath")
      {

        if (primaryBathExists == false)
        {
          allRooms = Room.placeFurnitureItemsHierarchically(roomInput, threeBed_furniture_bath1_toilet);
          allRooms = Room.placeFurnitureItemsHierarchically(allRooms, threeBed_furniture_bath2_sink);
          allRooms = Room.placeFurnitureItemsHierarchically(allRooms, threeBed_furniture_bath3_shower);

          primaryBathExists = true;
        } else
        {
          allRooms = Room.placeFurnitureItemsHierarchically(roomInput, threeBed_furniture_bath1_toilet);
          allRooms = Room.placeFurnitureItemsHierarchically(allRooms, threeBed_furniture_bath2_sink);

        }


        roomIterationsList.AddRange(allRooms);
      }

      allAptsList.Add(roomIterationsList);

      // Check if dining room exists
      if (!diningExists) {
        diningExists = CheckDiningExists(allRooms);
      }
    }


    return allAptsList;
  }

  public static Tuple<bool, List<Room>> PlaceFurnitureItemsHierarchicallyBoolList(List<Room> roomInputList, List<Furniture> furnitureList, bool insidePlacement = false)
  {
    bool placementSuccess = false; // Initialize as false since we don't know if any placement will succeed.
    List<Room> outRooms = new List<Room>();

    foreach (var roomInput in roomInputList)
    {
      for (int i = 0; i < furnitureList.Count; i++)
      {
        List<Room> validRooms = Room.placeFurnitureItem(roomInput, furnitureList[i], insidePlacement);
        if (validRooms.Count > 0)
        {
          outRooms.AddRange(validRooms);
          placementSuccess = true; // Set true as furniture is placed successfully.
          break; // Break inner loop as furniture is placed in the current room.
        }
      }
    }

    // if no furniture was placed, return original list of rooms, without placed furniture
    if (!placementSuccess)
    {
      outRooms.AddRange(roomInputList);
    }

    List<Room> sortedOutput = outRooms.OrderBy(o => o.Score).ToList();
    sortedOutput.Reverse();

    return new Tuple<bool, List<Room>>(placementSuccess, sortedOutput);
  }
# ---------- end c_script_4 ----------

# ----
bed = ColourSwatch(SwatchColor=RGB(58, 38, 102))
bath = ColourSwatch(SwatchColor=RGB(100, 48, 105))
rooms_names = Text(c_script_3.roomsNames)
panel = Panel("""kitchen
bath
foyer
living
bed
extra""")
area = Area(Geometry=c_script_3.rooms, UseTasks=False)  # -> Area, Centroid
crv_2 = Curve(c_script_3.draw_cut_rooms)
flip = FlipCurve(Curve=crv_2)  # -> Curve, Flag
merge = Merge(
    Data1=bath,
    Data2=ColourSwatch(SwatchColor=RGB(255, 187, 51)),
    Data3=ColourSwatch(SwatchColor=RGB(252, 114, 96)),
    Data4=ColourSwatch(SwatchColor=RGB(191, 75, 98)),
    Data5=bed,
    Data6=ColourSwatch(SwatchColor=RGB(242, 119, 145)))
pt = Point(area.Centroid)
Z = UnitZ(Factor=Slider(0.01, range=0..0.01))
crv_3 = Curve(c_script_3.facOut)
crv_4 = Curve(c_script_3.draw_bounds)
boundary = BoundarySurfaces(Edges=graft(flip.Curve), UseTasks=False)  # -> flatten(Surfaces)
replace = ReplaceMembers(Set=rooms_names, Find=panel, Replace=merge)
move = Move(Geometry=flatten(crv_3), Motion=Z)  # -> Geometry, Transform
bed_2 = ColourSwatch(SwatchColor=RGB(255, 255, 255))
preview = CustomPreview(Geometry=flatten(boundary), Material=flatten(replace))
previewlw_5 = CustomPreviewLineweights(Geometry=move.Geometry, Shader=ColourSwatch(SwatchColor=RGB(0, 0, 0)), Thickness=Slider(10, range=0..10), Absolute=False)
tag = TextTag(Location=pt, Text=rooms_names, Colour=bed_2)

apartment_area = Panel(c_script_4.minFurnitureValid)
number_of_bedrooms = Panel(c_script_4.minfurnitureArea)
number_of_bedrooms_2 = Panel(c_script_4.numberOfBedrooms)
area_2 = Area(Geometry=c_script_4.roomDrawing, UseTasks=False)  # -> Area, Centroid
avr = Average(Input=area_2.Centroid)
previewlw_6 = CustomPreviewLineweights(Geometry=c_script_4.furnitureDrawing, Shader=ColourSwatch(SwatchColor=RGB(0, 0, 0)), Absolute=False)
previewlw_7 = CustomPreviewLineweights(
    Geometry=c_script_4.roomDrawing,
    Shader=ColourSwatch(SwatchColor=RGB(191, 191, 191)),
    Thickness=Slider(2, range=0..10),
    Absolute=False)
previewlw_8 = CustomPreviewLineweights(Geometry=crv_2, Shader=swatch, Thickness=number_slider_2, Absolute=False)
previewlw_9 = CustomPreviewLineweights(Geometry=crv_4, Shader=ColourSwatch(SwatchColor=RGB(0, 0, 0)), Thickness=Slider(2.7, range=0..10), Absolute=False)

# ---- group: Visualize All Rooms
geo_rooms_area = Geometry(c_script_4.roomAreas)
number_slider_3 = Slider(18, range=0..100)
X = UnitX(Factor=number_slider_3)
move_2 = Move(Geometry=geo_rooms_area, Motion=X)  # -> Geometry, Transform
previewlw_10 = CustomPreviewLineweights(
    Geometry=move_2.Geometry,
    Shader=ColourSwatch(SwatchColor=RGB(0, 0, 0)),
    Thickness=Slider(2, range=0..10),
    Absolute=False)

# ---- group: Visualize Furniture Area for Furniture Loss factor
geo_furniture = Geometry(c_script_4.furnitureDrawing)
geo_furniture_area = Geometry(c_script_4.furnitureAreas)
number_slider_4 = Slider(12, range=0..100)
number_slider_5 = Slider(12, range=0..100)
X_2 = UnitX(Factor=number_slider_3)
X_3 = UnitX(Factor=number_slider_3)
move_3 = Move(Geometry=geo_furniture, Motion=X_2)  # -> Geometry, Transform
move_4 = Move(Geometry=geo_furniture_area, Motion=X_3)  # -> Geometry, Transform
boundary_2 = BoundarySurfaces(Edges=move_4.Geometry)
preview_2 = CustomPreview(Geometry=boundary_2, Material=ColourSwatch(SwatchColor=RGBA(83, 164, 194, 161)))
previewlw_11 = CustomPreviewLineweights(
    Geometry=move_3.Geometry,
    Shader=ColourSwatch(SwatchColor=RGB(89, 89, 89)),
    Thickness=Slider(1, range=0..10),
    Absolute=False)

# ----
preview_3 = CustomPreview(Geometry=cluster_2.S, Material=cluster_2.swatch)
previewlw_12 = CustomPreviewLineweights(Geometry=cluster_2.G_2, Shader=cluster_2.swatch_4, Thickness=cluster_2.number_slider_2, Absolute=False)
previewlw_13 = CustomPreviewLineweights(Geometry=cluster_2.G_3, Shader=cluster_2.swatch_3, Thickness=cluster_2.number_slider_3, Absolute=False)
previewlw_14 = CustomPreviewLineweights(Geometry=cluster_2.crv_7, Shader=cluster_2.swatch_5, Thickness=cluster_2.number_slider_4, Absolute=False)
previewlw_15 = CustomPreviewLineweights(Geometry=cluster_2.G, Shader=cluster_2.swatch_2, Thickness=cluster_2.number_slider, Absolute=False)

previewlw_16 = CustomPreviewLineweights(Geometry=cluster_3.crv_5, Shader=cluster_3.swatch_2, Thickness=cluster_3.number_slider_3, Absolute=False)
previewlw_17 = CustomPreviewLineweights(Geometry=cluster_3.crv_6, Shader=cluster_3.swatch, Thickness=cluster_3.number_slider_2, Absolute=False)
previewlw_18 = CustomPreviewLineweights(Geometry=cluster_3.G, Shader=cluster_3.swatch_3, Thickness=cluster_3.number_slider, Absolute=False)

# ==== cluster FurnitureCluster
placementint = Panel("""0
2
3""")
placementint_3 = Panel("2")
program = Panel("Bed_StorageThree")
importance = Panel("2")
score = Panel("3")
program_2 = Panel("Bed_StorageTwo")
placementint_4 = Panel("2")
placementint_5 = Panel("2")
importance_2 = Panel("2")
importance_3 = Panel("2")
score_2 = Panel("2")
program_3 = Panel("Bed_StorageOne")
score_3 = Panel("1")
program_4 = Panel("Dining")
placementint_6 = Panel("""1
2
3""")
importance_4 = Panel("1")
score_4 = Panel("20")
program_5 = Panel("Bed")
placementint_7 = Panel("""2
3""")
importance_5 = Panel("1")
score_5 = Panel("20")
placementint_8 = Panel("2")
program_6 = Panel("Bed_StorageThree")
importance_6 = Panel("2")
score_6 = Panel("3")
program_7 = Panel("Bed_StorageTwo")
placementint_9 = Panel("2")
placementint_10 = Panel("2")
importance_7 = Panel("2")
importance_8 = Panel("2")
score_7 = Panel("2")
program_8 = Panel("Bed_StorageOne")
score_8 = Panel("1")
program_9 = Panel("Bath")
placementint_11 = Panel("2")
importance_9 = Panel("1")
program_10 = Panel("Bed")
placementint_12 = Panel("""1
2
3""")
importance_10 = Panel("1")
program_11 = Panel("Bed")
placementint_13 = Panel("""2
3""")
importance_11 = Panel("1")
score_9 = Panel("20")
program_12 = Panel("Bath")
placementint_14 = Panel("2")
importance_12 = Panel("1")
score_10 = Panel("20")
score_11 = Panel("20")
score_12 = Panel("20")
program_13 = Panel("Kitchen")
placementint_15 = Panel("3")
importance_13 = Panel("1")
score_13 = Panel("20")
program_14 = Panel("Dining")
placementint_16 = Panel("""1
2
3""")
importance_14 = Panel("1")
score_14 = Panel("20")
program_15 = Panel("Bath")
placementint_17 = Panel("2")
importance_15 = Panel("1")
score_15 = Panel("20")
program_16 = Panel("Bed")
placementint_18 = Panel("""2
3""")
importance_16 = Panel("1")
placementint_19 = Panel("2")
program_17 = Panel("Living")
placementint_20 = Panel("""1
2
3""")
importance_17 = Panel("1")
score_16 = Panel("20")
score_17 = Panel("20")
program_18 = Panel("Bed_StorageThree")
importance_18 = Panel("2")
score_18 = Panel("3")
program_19 = Panel("Bed_StorageTwo")
placementint_21 = Panel("2")
placementint_22 = Panel("2")
importance_19 = Panel("2")
program_20 = Panel("Bed_StorageTwo")
placementint_23 = Panel("2")
placementint_24 = Panel("2")
importance_20 = Panel("2")
importance_21 = Panel("2")
score_19 = Panel("2")
program_21 = Panel("Bed_StorageOne")
score_20 = Panel("1")
importance_22 = Panel("2")
score_21 = Panel("2")
program_22 = Panel("Bed_StorageOne")
score_22 = Panel("1")
program_23 = Panel("Bath")
placementint_25 = Panel("2")
importance_23 = Panel("1")
program_24 = Panel("Bed")
placementint_26 = Panel("""1
2
3""")
importance_24 = Panel("1")
program_25 = Panel("Kitchen")
placementint_27 = Panel("3")
importance_25 = Panel("1")
score_23 = Panel("20")
program_26 = Panel("Bath")
placementint_28 = Panel("2")
importance_26 = Panel("1")
score_24 = Panel("20")
score_25 = Panel("20")
program_27 = Panel("Bed")
placementint_29 = Panel("""2
3""")
importance_27 = Panel("1")
score_26 = Panel("20")
score_27 = Panel("20")
program_28 = Panel("Kitchen")
placementint_30 = Panel("""0
1""")
importance_28 = Panel("1")
score_28 = Panel("20")
program_29 = Panel("Kitchen")
placementint_31 = Panel("""1
2""")
importance_29 = Panel("1")
score_29 = Panel("20")
program_30 = Panel("Dining")
placementint_32 = Panel("""1
2
3""")
importance_30 = Panel("1")
score_30 = Panel("20")
program_31 = Panel("Bath")
placementint_33 = Panel("2")
importance_31 = Panel("1")
program_32 = Panel("Bed")
placementint_34 = Panel("""2
3""")
importance_32 = Panel("1")
score_31 = Panel("20")
score_32 = Panel("20")
program_33 = Panel("Living")
placementint_35 = Panel("""0
1
2
3""")
importance_33 = Panel("1")
score_33 = Panel("20")
program_34 = Panel("Bed_StorageTwo")
placementint_36 = Panel("2")
placementint_37 = Panel("2")
importance_34 = Panel("2")
importance_35 = Panel("2")
score_34 = Panel("2")
program_35 = Panel("Bed_StorageOne")
score_35 = Panel("1")
program_36 = Panel("Bath")
placementint_38 = Panel("2")
importance_36 = Panel("1")
program_37 = Panel("Bed")
placementint_39 = Panel("""1
2
3""")
importance_37 = Panel("1")
program_38 = Panel("Bed")
placementint_40 = Panel("""2
3""")
importance_38 = Panel("1")
program_39 = Panel("Kitchen")
placementint_41 = Panel("3")
importance_39 = Panel("1")
score_36 = Panel("20")
program_40 = Panel("Bath")
placementint_42 = Panel("2")
importance_40 = Panel("1")
score_37 = Panel("20")
score_38 = Panel("20")
score_39 = Panel("20")
score_40 = Panel("20")
program_41 = Panel("Kitchen")
placementint_43 = Panel("""0
1""")
importance_41 = Panel("1")
score_41 = Panel("20")
program_42 = Panel("Kitchen")
placementint_44 = Panel("""2
3""")
importance_42 = Panel("1")
score_42 = Panel("20")
program_43 = Panel("Dining")
placementint_45 = Panel("""0
1
2
3""")
importance_43 = Panel("1")
score_43 = Panel("20")
program_44 = Panel("Bath")
placementint_46 = Panel("2")
importance_44 = Panel("1")
program_45 = Panel("Living")
program_46 = Panel("Living")
placementint_47 = Panel("""0
1
2
3""")
importance_45 = Panel("1")
score_44 = Panel("20")
program_47 = Panel("Living")
placementint_48 = Panel("""0
1
2
3""")
importance_46 = Panel("1")
score_45 = Panel("20")
placementint_49 = Panel("""0
1
2
3""")
importance_47 = Panel("1")
score_46 = Panel("20")
score_47 = Panel("20")
program_48 = Panel("Kitchen")
placementint_50 = Panel("1")
importance_48 = Panel("1")
score_48 = Panel("20")
program_49 = Panel("Bath")
placementint_51 = Panel("2")
importance_49 = Panel("1")
program_50 = Panel("Bed")
placementint_52 = Panel("""1
2
3""")
importance_50 = Panel("1")
program_51 = Panel("Bed")
placementint_53 = Panel("""1
2
3""")
importance_51 = Panel("1")
score_49 = Panel("20")
program_52 = Panel("Bed")
placementint_54 = Panel("""0
1
2
3""")
importance_52 = Panel("1")
program_53 = Panel("Bed")
placementint_55 = Panel("""2
3""")
importance_53 = Panel("1")
score_50 = Panel("20")
score_51 = Panel("20")
program_54 = Panel("Bath")
placementint_56 = Panel("2")
importance_54 = Panel("1")
score_52 = Panel("20")
score_53 = Panel("20")
score_54 = Panel("20")
program_55 = Panel("Kitchen")
placementint_57 = Panel("""2
3""")
importance_55 = Panel("1")
score_55 = Panel("20")
program_56 = Panel("Kitchen")
placementint_58 = Panel("""1
2""")
importance_56 = Panel("1")
score_56 = Panel("20")
program_57 = Panel("Bath")
placementint_59 = Panel("2")
importance_57 = Panel("1")
program_58 = Panel("Bed")
score_57 = Panel("20")
placementint_60 = Panel("""2
3""")
importance_58 = Panel("1")
score_58 = Panel("20")
program_59 = Panel("Living")
placementint_61 = Panel("""0
1
2
3""")
importance_59 = Panel("1")
score_59 = Panel("20")
program_60 = Panel("Living")
placementint_62 = Panel("""0
1
2
3""")
importance_60 = Panel("1")
score_60 = Panel("20")
program_61 = Panel("Bed")
placementint_63 = Panel("""0
3""")
importance_61 = Panel("1")
program_62 = Panel("Bed")
placementint_64 = Panel("""0
3""")
importance_62 = Panel("1")
score_61 = Panel("20")
score_62 = Panel("20")

# ---- group: Prepare and Sort
txt_name = Text(program_4)
int_placement = Integer(placementint_6)
geo = Geometry(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)
geo_2 = Geometry([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])
geo_3 = Geometry(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)

txt_name_2 = Text(program_5)
int_placement_2 = Integer(placementint_7)
geo_4 = Geometry(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)
geo_5 = Geometry(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)
geo_6 = Geometry([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])

# ----
int_importance = Integer(importance_4)
int_importance_2 = Integer(importance_5)

# ---- group: Prepare and Sort
txt_name_3 = Text(program_9)
int_placement_3 = Integer(placementint_11)
geo_7 = Geometry(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)
geo_8 = Geometry([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])
geo_9 = Geometry(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)

txt_name_4 = Text(program_10)
int_placement_4 = Integer(placementint_12)
geo_10 = Geometry(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)
geo_11 = Geometry([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])
geo_12 = Geometry(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)

txt_name_5 = Text(program_11)
int_placement_5 = Integer(placementint_13)
geo_13 = Geometry(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)
geo_14 = Geometry([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])
geo_15 = Geometry(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)

txt_name_6 = Text(program_12)
int_placement_6 = Integer(placementint_14)
geo_16 = Geometry(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)
geo_17 = Geometry(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)
geo_18 = Geometry([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])

txt_name_7 = Text(program_13)
int_placement_7 = Integer(placementint_15)
geo_19 = Geometry(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)
geo_20 = Geometry(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)
geo_21 = Geometry([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])

# ----
int_importance_3 = Integer(importance_9)
int_importance_4 = Integer(importance_10)
int_importance_5 = Integer(importance_11)
int_importance_6 = Integer(importance_12)

# ---- group: Prepare and Sort
txt_name_8 = Text(program_14)
int_placement_8 = Integer(placementint_16)
geo_22 = Geometry(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)
geo_23 = Geometry([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])
geo_24 = Geometry(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)

# ----
int_importance_7 = Integer(importance_13)

# ---- group: Prepare and Sort
txt_name_9 = Text(program_15)
int_placement_9 = Integer(placementint_17)
geo_25 = Geometry(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)
geo_26 = Geometry([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])
geo_27 = Geometry(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)

# ----
int_importance_8 = Integer(importance_14)

# ---- group: Prepare and Sort
txt_name_10 = Text(program_17)
int_placement_10 = Integer(placementint_20)
geo_28 = Geometry(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)
geo_29 = Geometry(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)
geo_30 = Geometry([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])

txt_name_11 = Text(program_16)
int_placement_11 = Integer(placementint_18)
geo_31 = Geometry(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)
geo_32 = Geometry([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])
geo_33 = Geometry(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)

# ----
num_score = Number(score_4)
int_importance_9 = Integer(importance_15)
int_importance_10 = Integer(importance_16)
num_score_2 = Number(score_5)
int_importance_11 = Integer(importance_17)

# ---- group: Prepare and Sort
txt_name_12 = Text(program_23)
int_placement_12 = Integer(placementint_25)
geo_34 = Geometry(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)
geo_35 = Geometry([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])
geo_36 = Geometry(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)

txt_name_13 = Text(program_24)
int_placement_13 = Integer(placementint_26)
geo_37 = Geometry(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)
geo_38 = Geometry([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])
geo_39 = Geometry(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)

txt_name_14 = Text(program_27)
int_placement_14 = Integer(placementint_29)
geo_40 = Geometry(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)
geo_41 = Geometry(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)
geo_42 = Geometry([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])

txt_name_15 = Text(program_25)
int_placement_15 = Integer(placementint_27)
geo_43 = Geometry(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)
geo_44 = Geometry([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])
geo_45 = Geometry(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)

txt_name_16 = Text(program_26)
int_placement_16 = Integer(placementint_28)
geo_46 = Geometry(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)
geo_47 = Geometry(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)
geo_48 = Geometry([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])

txt_name_17 = Text(program_28)
int_placement_17 = Integer(placementint_30)
geo_49 = Geometry(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)
geo_50 = Geometry(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)
geo_51 = Geometry([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])

# ----
int_importance_12 = Integer(importance_23)
int_importance_13 = Integer(importance_24)

# ---- group: Prepare and Sort
txt_name_18 = Text(program_29)
int_placement_18 = Integer(placementint_31)
geo_52 = Geometry(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)
geo_53 = Geometry(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)
geo_54 = Geometry([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])

# ----
int_importance_14 = Integer(importance_25)
int_importance_15 = Integer(importance_26)

# ---- group: Prepare and Sort
txt_name_19 = Text(program_30)
int_placement_19 = Integer(placementint_32)
geo_55 = Geometry(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)
geo_56 = Geometry([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])
geo_57 = Geometry(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)

# ----
num_score_3 = Number(score_9)
num_score_4 = Number(score_10)
int_importance_16 = Integer(importance_27)
num_score_5 = Number(score_11)
num_score_6 = Number(score_12)
int_importance_17 = Integer(importance_28)
int_importance_18 = Integer(importance_29)

# ---- group: Prepare and Sort
txt_name_20 = Text(program_31)
int_placement_20 = Integer(placementint_33)
geo_58 = Geometry(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)
geo_59 = Geometry([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])
geo_60 = Geometry(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)

txt_name_21 = Text(program_32)
int_placement_21 = Integer(placementint_34)
geo_61 = Geometry(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)
geo_62 = Geometry([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])
geo_63 = Geometry(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)

# ----
int_importance_19 = Integer(importance_30)
num_score_7 = Number(score_13)

# ---- group: Prepare and Sort
txt_name_22 = Text(program_33)
int_placement_22 = Integer(placementint_35)
geo_64 = Geometry(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)
geo_65 = Geometry(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)
geo_66 = Geometry([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])

txt_name_23 = Text(program)
int_placement_23 = Integer(placementint_3)
geo_67 = Geometry([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])
geo_68 = Geometry(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)
geo_69 = Geometry(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)

# ----
num_score_8 = Number(score_14)
int_importance_20 = Integer(importance_31)
int_importance_21 = Integer(importance_32)
num_score_9 = Number(score_15)
num_score_10 = Number(score_17)

# ---- group: Prepare and Sort
txt_name_24 = Text(program_2)
int_placement_24 = Integer(placementint_4)
geo_70 = Geometry([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])
geo_71 = Geometry(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)
geo_72 = Geometry(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)

# ----
int_importance_22 = Integer(importance_33)
num_score_11 = Number(score_16)

# ---- group: Prepare and Sort
txt_name_25 = Text(program_3)
int_placement_25 = Integer(placementint_5)
geo_73 = Geometry(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)
geo_74 = Geometry(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)
geo_75 = Geometry([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])

# ----
importance_63 = Integer(importance_2)
num_score_12 = Number(score_3)
int_importance_23 = Integer(importance_45)

# ---- group: Prepare and Sort
txt_name_26 = Text(program_36)
int_placement_26 = Integer(placementint_38)
geo_76 = Geometry(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)
geo_77 = Geometry([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])
geo_78 = Geometry(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)

txt_name_27 = Text(program_37)
int_placement_27 = Integer(placementint_39)
geo_79 = Geometry(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)
geo_80 = Geometry(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)
geo_81 = Geometry([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])

# ----
int_importance_24 = Integer(importance_37)
num_score_13 = Number(score_38)

# ---- group: Prepare and Sort
txt_name_28 = Text(program_38)
int_placement_28 = Integer(placementint_40)
geo_82 = Geometry(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)
geo_83 = Geometry([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])
geo_84 = Geometry(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)

txt_name_29 = Text(program_6)
int_placement_29 = Integer(placementint_8)
geo_85 = Geometry(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)
geo_86 = Geometry(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)
geo_87 = Geometry([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])

# ----
importance_64 = Integer(importance_6)
num_score_14 = Number(score_6)

# ---- group: Prepare and Sort
txt_name_30 = Text(program_7)
int_placement_30 = Integer(placementint_9)
geo_88 = Geometry(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)
geo_89 = Geometry(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)
geo_90 = Geometry([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])

# ----
int_importance_25 = Integer(importance_8)
num_score_15 = Number(score_7)

# ---- group: Prepare and Sort
txt_name_31 = Text(program_8)
int_placement_31 = Integer(placementint_10)
geo_91 = Geometry(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)
geo_92 = Geometry(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)
geo_93 = Geometry([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])

# ----
importance_65 = Integer(importance_7)
num_score_16 = Number(score_8)

# ---- group: Prepare and Sort
txt_name_32 = Text(program_47)
int_placement_32 = Integer(placementint_48)
geo_94 = Geometry(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)
geo_95 = Geometry(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)
geo_96 = Geometry([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])

# ----
int_importance_26 = Integer(importance_46)
num_score_17 = Number(score_45)

# ---- group: Prepare and Sort
txt_name_33 = Text(program_45)
int_placement_33 = Integer(placementint_49)
geo_97 = Geometry(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)
geo_98 = Geometry(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)
geo_99 = Geometry([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])

# ----
int_importance_27 = Integer(importance_47)
num_score_18 = Number(score_46)

# ---- group: Prepare and Sort
txt_name_34 = Text(program_46)
int_placement_34 = Integer(placementint_47)
geo_100 = Geometry(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)
geo_101 = Geometry(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)
geo_102 = Geometry([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])

# ----
num_score_19 = Number(score_47)

# ---- group: Prepare and Sort
txt_name_35 = Text(program_39)
int_placement_35 = Integer(placementint_41)
geo_103 = Geometry(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)
geo_104 = Geometry([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])
geo_105 = Geometry(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)

txt_name_36 = Text(program_40)
int_placement_36 = Integer(placementint_42)
geo_106 = Geometry(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)
geo_107 = Geometry(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)
geo_108 = Geometry([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])

# ----
num_score_20 = Number(score_2)

# ---- group: Prepare and Sort
txt_name_37 = Text(program_41)
int_placement_37 = Integer(placementint_43)
geo_109 = Geometry(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)
geo_110 = Geometry(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)
geo_111 = Geometry([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])

# ----
int_importance_28 = Integer(importance_36)
num_score_21 = Number(score)
int_importance_29 = Integer(importance_38)

# ---- group: Prepare and Sort
txt_name_38 = Text(program_42)
int_placement_38 = Integer(placementint_44)
geo_112 = Geometry(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)
geo_113 = Geometry(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)
geo_114 = Geometry([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])

# ----
int_importance_30 = Integer(importance_39)
int_importance_31 = Integer(importance_40)

# ---- group: Prepare and Sort
txt_name_39 = Text(program_43)
int_placement_39 = Integer(placementint_45)
geo_115 = Geometry(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)
geo_116 = Geometry([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])
geo_117 = Geometry(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)

# ----
num_score_22 = Number(score_27)
num_score_23 = Number(score_23)
num_score_24 = Number(score_24)
num_score_25 = Number(score_25)
num_score_26 = Number(score_26)
int_importance_32 = Integer(importance_41)
int_importance_33 = Integer(importance_42)

# ---- group: Prepare and Sort
txt_name_40 = Text(program_44)
int_placement_40 = Integer(placementint_46)
geo_118 = Geometry(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)
geo_119 = Geometry([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])
geo_120 = Geometry(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)

# ----
int_importance_34 = Integer(importance_43)
int_importance_35 = Integer(importance_3)
num_score_27 = Number(score_28)
num_score_28 = Number(score_29)

# ---- group: Prepare and Sort
txt_name_41 = Text(program_48)
int_placement_41 = Integer(placementint_50)
geo_121 = Geometry(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)
geo_122 = Geometry(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)
geo_123 = Geometry([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])

# ----
importance_66 = Integer(importance)
num_score_29 = Number(score_30)
int_importance_36 = Integer(importance_44)
num_score_30 = Number(score_31)
num_score_31 = Number(score_32)
int_importance_37 = Integer(importance_48)
num_score_32 = Number(score_33)
num_score_33 = Number(score_49)

# ---- group: Prepare and Sort
geo_124 = Geometry(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)
txt_name_42 = Text(program_51)
int_placement_42 = Integer(placementint_53)
geo_125 = Geometry(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)
geo_126 = Geometry([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])

txt_name_43 = Text(program_49)
int_placement_43 = Integer(placementint_51)
geo_127 = Geometry(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)
geo_128 = Geometry([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])
geo_129 = Geometry(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)

txt_name_44 = Text(program_50)
int_placement_44 = Integer(placementint_52)
geo_130 = Geometry(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)
geo_131 = Geometry(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)
geo_132 = Geometry([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])

# ----
int_importance_38 = Integer(importance_50)
num_score_34 = Number(score_53)
int_importance_39 = Integer(importance_51)

# ---- group: Prepare and Sort
txt_name_45 = Text(program_19)
int_placement_45 = Integer(placementint_21)
geo_133 = Geometry(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)
geo_134 = Geometry(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)
geo_135 = Geometry([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])

# ----
int_importance_40 = Integer(importance_21)
num_score_35 = Number(score_19)

# ---- group: Prepare and Sort
txt_name_46 = Text(program_21)
int_placement_46 = Integer(placementint_22)
geo_136 = Geometry(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)
geo_137 = Geometry(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)
geo_138 = Geometry([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])

# ----
importance_67 = Integer(importance_19)
num_score_36 = Number(score_20)

# ---- group: Prepare and Sort
txt_name_47 = Text(program_52)
int_placement_47 = Integer(placementint_54)
geo_139 = Geometry(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)
geo_140 = Geometry(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)
geo_141 = Geometry([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])

# ----
int_importance_41 = Integer(importance_52)
num_score_37 = Number(score_54)

# ---- group: Prepare and Sort
txt_name_48 = Text(program_53)
int_placement_48 = Integer(placementint_55)
geo_142 = Geometry(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)
geo_143 = Geometry(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)
geo_144 = Geometry([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])

txt_name_49 = Text(program_18)
int_placement_49 = Integer(placementint_19)
geo_145 = Geometry(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)
geo_146 = Geometry(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)
geo_147 = Geometry([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])

# ----
importance_68 = Integer(importance_18)
num_score_38 = Number(score_18)

# ---- group: Prepare and Sort
txt_name_50 = Text(program_20)
int_placement_50 = Integer(placementint_23)
geo_148 = Geometry(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)
geo_149 = Geometry(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)
geo_150 = Geometry([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])

# ----
int_importance_42 = Integer(importance_22)
num_score_39 = Number(score_21)

# ---- group: Prepare and Sort
txt_name_51 = Text(program_22)
int_placement_51 = Integer(placementint_24)
geo_151 = Geometry(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)
geo_152 = Geometry(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)
geo_153 = Geometry([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])

# ----
importance_69 = Integer(importance_20)
num_score_40 = Number(score_22)

# ---- group: Prepare and Sort
txt_name_52 = Text(program_59)
int_placement_52 = Integer(placementint_61)
geo_154 = Geometry(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)
geo_155 = Geometry(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)
geo_156 = Geometry([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])

# ----
int_importance_43 = Integer(importance_59)
num_score_41 = Number(score_59)

# ---- group: Prepare and Sort
txt_name_53 = Text(program_54)
int_placement_53 = Integer(placementint_56)
geo_157 = Geometry(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)
geo_158 = Geometry(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)
geo_159 = Geometry([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])

# ----
int_importance_44 = Integer(importance_60)
num_score_42 = Number(score_60)

# ---- group: Prepare and Sort
geo_160 = Geometry(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)
geo_161 = Geometry([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])
txt_name_54 = Text(program_60)
int_placement_54 = Integer(placementint_62)
geo_162 = Geometry(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)

txt_name_55 = Text(program_55)
int_placement_55 = Integer(placementint_57)
geo_163 = Geometry(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)
geo_164 = Geometry(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)
geo_165 = Geometry([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])

# ----
int_importance_45 = Integer(importance_49)
int_importance_46 = Integer(importance_53)

# ---- group: Prepare and Sort
txt_name_56 = Text(program_56)
int_placement_56 = Integer(placementint_58)
geo_166 = Geometry(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)
geo_167 = Geometry(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)
geo_168 = Geometry([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])

# ----
int_importance_47 = Integer(importance_54)
num_score_43 = Number(score_40)
num_score_44 = Number(score_36)
num_score_45 = Number(score_37)
num_score_46 = Number(score_39)
int_importance_48 = Integer(importance_55)
int_importance_49 = Integer(importance_56)

# ---- group: Prepare and Sort
txt_name_57 = Text(program_57)
int_placement_57 = Integer(placementint_59)
geo_169 = Geometry(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)
geo_170 = Geometry([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])
geo_171 = Geometry(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)

# ----
num_score_47 = Number(score_41)
num_score_48 = Number(score_42)

# ---- group: Prepare and Sort
txt_name_58 = Text(program_58)
int_placement_58 = Integer(placementint_60)
geo_172 = Geometry(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)
geo_173 = Geometry(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)
geo_174 = Geometry([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])

# ----
num_score_49 = Number(score_43)
int_importance_50 = Integer(importance_57)
num_score_50 = Number(score_44)
int_importance_51 = Integer(importance_58)
num_score_51 = Number(score_61)

# ---- group: Prepare and Sort
geo_175 = Geometry(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)
txt_name_59 = Text(program_62)
int_placement_59 = Integer(placementint_64)
geo_176 = Geometry(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)
geo_177 = Geometry([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])

# ----
num_score_52 = Number(score_48)

# ---- group: Prepare and Sort
txt_name_60 = Text(program_61)
int_placement_60 = Integer(placementint_63)
geo_178 = Geometry(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)
geo_179 = Geometry(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)
geo_180 = Geometry([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])

# ----
int_importance_52 = Integer(importance_61)
num_score_53 = Number(score_62)
int_importance_53 = Integer(importance_62)

# ---- group: Prepare and Sort
txt_name_61 = Text(program_34)
int_placement_61 = Integer(placementint_36)
geo_181 = Geometry(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)
geo_182 = Geometry(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)
geo_183 = Geometry([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])

# ----
int_importance_54 = Integer(importance_35)
num_score_54 = Number(score_34)

# ---- group: Prepare and Sort
txt_name_62 = Text(program_35)
int_placement_62 = Integer(placementint_37)
geo_184 = Geometry(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)
geo_185 = Geometry(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)
geo_186 = Geometry([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])

# ----
importance_70 = Integer(importance_34)
num_score_55 = Number(score_35)
num_score_56 = Number(score_50)
num_score_57 = Number(score_51)
num_score_58 = Number(score_52)
num_score_59 = Number(score_55)
num_score_60 = Number(score_56)
num_score_61 = Number(score_57)
num_score_62 = Number(score_58)

# ---- group: Prepare and Sort
explode = Explode(Curve=geo_68, Recursive=True)  # -> Segments, Vertices
item = ListItem(List=explode.Segments, Index=int_placement_23, Wrap=True)
previewlw = CustomPreviewLineweights(Geometry=item, Shader=ColourSwatch(SwatchColor=RGB(33, 33, 33)), Thickness=Slider(6, range=0..10), Absolute=False)
c_script = CSharpScript(
    name=txt_name_23,
    placementIn=int_placement_23,
    importanceIn=importance_66,
    scoreIn=num_score_21,
    pathIn=geo_68,
    blockedIn=geo_69,
    drawingIn=geo_67,
    Reference=["C:\USERS\ECORI\SOURCE\IAAC\AIA_STUDIO\HYPERGRAPH\SAMPLES\_REQUIREDDLLS\MathNet.Numerics.dll", "C:\USERS\ECORI\SOURCE\IAAC\AIA_STUDIO\HYPERGRAPH\SAMPLES\_REQUIREDDLLS\RGeoLib.dll", "C:\USERS\ECORI\SOURCE\IAAC\AIA_STUDIO\HYPERGRAPH\SAMPLES\_REQUIREDDLLS\Dbscan.dll"])  # -> out, simplify(furniture); inputs name: String, placementIn: list of Int32, importanceIn: Int32, scoreIn: Double, pathIn: Polyline, blockedIn: Polyline, drawingIn: list of Polyline
# ---------- c_script: C# usings ----------
using System.Linq;
using RGeoLib;
using RGeoLib.BuildingSolver;
# ---------- c_script: C# ----------
    // Create Furniture Object
    string furnitureName = name;
    NFace pathF = RhConvert.RhPolylineToNFace(pathIn);
    NFace blockedF = RhConvert.RhPolylineToNFace(blockedIn);
    List<NLine> drawingLineList = RhConvert.RhPolylineListToNLineList(drawingIn);

    Furniture bedQueen = new Furniture(furnitureName, pathF, blockedF, drawingLineList, placementIn,  scoreIn, importanceIn);

    furniture = bedQueen;
# ---------- end c_script ----------
data_bed_single = Data(c_script.furniture)

# ----
explode_2 = Explode(Curve=geo, Recursive=True)  # -> Segments, Vertices

# ---- group: Prepare and Sort
explode_3 = Explode(Curve=geo_71, Recursive=True)  # -> Segments, Vertices
item_2 = ListItem(List=explode_3.Segments, Index=int_placement_24, Wrap=True)
previewlw_2 = CustomPreviewLineweights(Geometry=item_2, Shader=ColourSwatch(SwatchColor=RGB(33, 33, 33)), Thickness=Slider(6, range=0..10), Absolute=False)
c_script_2 = CSharpScript(
    name=txt_name_24,
    placementIn=int_placement_24,
    importanceIn=int_importance_35,
    scoreIn=num_score_20,
    pathIn=geo_71,
    blockedIn=geo_72,
    drawingIn=geo_70,
    Reference=["C:\USERS\ECORI\SOURCE\IAAC\AIA_STUDIO\HYPERGRAPH\SAMPLES\_REQUIREDDLLS\MathNet.Numerics.dll", "C:\USERS\ECORI\SOURCE\IAAC\AIA_STUDIO\HYPERGRAPH\SAMPLES\_REQUIREDDLLS\RGeoLib.dll", "C:\USERS\ECORI\SOURCE\IAAC\AIA_STUDIO\HYPERGRAPH\SAMPLES\_REQUIREDDLLS\Dbscan.dll"])  # -> out, simplify(furniture); inputs name: String, placementIn: list of Int32, importanceIn: Int32, scoreIn: Double, pathIn: Polyline, blockedIn: Polyline, drawingIn: list of Polyline; same code as c_script
data_bed_single_2 = Data(c_script_2.furniture)

# ----
explode_4 = Explode(Curve=geo_4, Recursive=True)  # -> Segments, Vertices

# ---- group: Prepare and Sort
explode_5 = Explode(Curve=geo_73, Recursive=True)  # -> Segments, Vertices
item_3 = ListItem(List=explode_5.Segments, Index=int_placement_25, Wrap=True)
previewlw_3 = CustomPreviewLineweights(Geometry=item_3, Shader=ColourSwatch(SwatchColor=RGB(33, 33, 33)), Thickness=Slider(6, range=0..10), Absolute=False)
c_script_3 = CSharpScript(
    name=txt_name_25,
    placementIn=int_placement_25,
    importanceIn=importance_63,
    scoreIn=num_score_12,
    pathIn=geo_73,
    blockedIn=geo_74,
    drawingIn=geo_75,
    Reference=["C:\USERS\ECORI\SOURCE\IAAC\AIA_STUDIO\HYPERGRAPH\SAMPLES\_REQUIREDDLLS\MathNet.Numerics.dll", "C:\USERS\ECORI\SOURCE\IAAC\AIA_STUDIO\HYPERGRAPH\SAMPLES\_REQUIREDDLLS\RGeoLib.dll", "C:\USERS\ECORI\SOURCE\IAAC\AIA_STUDIO\HYPERGRAPH\SAMPLES\_REQUIREDDLLS\Dbscan.dll"])  # -> out, simplify(furniture); inputs name: String, placementIn: list of Int32, importanceIn: Int32, scoreIn: Double, pathIn: Polyline, blockedIn: Polyline, drawingIn: list of Polyline; same code as c_script
data_bed_single_3 = Data(c_script_3.furniture)

# ----
explode_6 = Explode(Curve=geo_7, Recursive=True)  # -> Segments, Vertices
explode_7 = Explode(Curve=geo_16, Recursive=True)  # -> Segments, Vertices
explode_8 = Explode(Curve=geo_13, Recursive=True)  # -> Segments, Vertices

# ---- group: Prepare and Sort
explode_9 = Explode(Curve=geo_85, Recursive=True)  # -> Segments, Vertices
item_4 = ListItem(List=explode_9.Segments, Index=int_placement_29, Wrap=True)
previewlw_4 = CustomPreviewLineweights(Geometry=item_4, Shader=ColourSwatch(SwatchColor=RGB(33, 33, 33)), Thickness=Slider(6, range=0..10), Absolute=False)
c_script_4 = CSharpScript(
    name=txt_name_29,
    placementIn=int_placement_29,
    importanceIn=importance_64,
    scoreIn=num_score_14,
    pathIn=geo_85,
    blockedIn=geo_86,
    drawingIn=geo_87,
    Reference=["C:\USERS\ECORI\SOURCE\IAAC\AIA_STUDIO\HYPERGRAPH\SAMPLES\_REQUIREDDLLS\MathNet.Numerics.dll", "C:\USERS\ECORI\SOURCE\IAAC\AIA_STUDIO\HYPERGRAPH\SAMPLES\_REQUIREDDLLS\RGeoLib.dll", "C:\USERS\ECORI\SOURCE\IAAC\AIA_STUDIO\HYPERGRAPH\SAMPLES\_REQUIREDDLLS\Dbscan.dll"])  # -> out, simplify(furniture); inputs name: String, placementIn: list of Int32, importanceIn: Int32, scoreIn: Double, pathIn: Polyline, blockedIn: Polyline, drawingIn: list of Polyline; same code as c_script
data_bed_single_4 = Data(c_script_4.furniture)

# ----
# Studio
explode_10 = Explode(Curve=geo_10, Recursive=True)  # -> Segments, Vertices
explode_11 = Explode(Curve=geo_19, Recursive=True)  # -> Segments, Vertices
explode_12 = Explode(Curve=geo_22, Recursive=True)  # -> Segments, Vertices

# ---- group: Prepare and Sort
explode_13 = Explode(Curve=geo_88, Recursive=True)  # -> Segments, Vertices
item_5 = ListItem(List=explode_13.Segments, Index=int_placement_30, Wrap=True)
previewlw_5 = CustomPreviewLineweights(Geometry=item_5, Shader=ColourSwatch(SwatchColor=RGB(33, 33, 33)), Thickness=Slider(6, range=0..10), Absolute=False)
c_script_5 = CSharpScript(
    name=txt_name_30,
    placementIn=int_placement_30,
    importanceIn=int_importance_25,
    scoreIn=num_score_15,
    pathIn=geo_88,
    blockedIn=geo_89,
    drawingIn=geo_90,
    Reference=["C:\USERS\ECORI\SOURCE\IAAC\AIA_STUDIO\HYPERGRAPH\SAMPLES\_REQUIREDDLLS\MathNet.Numerics.dll", "C:\USERS\ECORI\SOURCE\IAAC\AIA_STUDIO\HYPERGRAPH\SAMPLES\_REQUIREDDLLS\RGeoLib.dll", "C:\USERS\ECORI\SOURCE\IAAC\AIA_STUDIO\HYPERGRAPH\SAMPLES\_REQUIREDDLLS\Dbscan.dll"])  # -> out, simplify(furniture); inputs name: String, placementIn: list of Int32, importanceIn: Int32, scoreIn: Double, pathIn: Polyline, blockedIn: Polyline, drawingIn: list of Polyline; same code as c_script
data_bed_single_5 = Data(c_script_5.furniture)

# ----
number_slider = Slider(6, range=0..10)
explode_14 = Explode(Curve=geo_25, Recursive=True)  # -> Segments, Vertices
explode_15 = Explode(Curve=geo_31, Recursive=True)  # -> Segments, Vertices

# ---- group: Prepare and Sort
explode_16 = Explode(Curve=geo_91, Recursive=True)  # -> Segments, Vertices
item_6 = ListItem(List=explode_16.Segments, Index=int_placement_31, Wrap=True)
previewlw_6 = CustomPreviewLineweights(Geometry=item_6, Shader=ColourSwatch(SwatchColor=RGB(33, 33, 33)), Thickness=Slider(6, range=0..10), Absolute=False)
c_script_6 = CSharpScript(
    name=txt_name_31,
    placementIn=int_placement_31,
    importanceIn=importance_65,
    scoreIn=num_score_16,
    pathIn=geo_91,
    blockedIn=geo_92,
    drawingIn=geo_93,
    Reference=["C:\USERS\ECORI\SOURCE\IAAC\AIA_STUDIO\HYPERGRAPH\SAMPLES\_REQUIREDDLLS\MathNet.Numerics.dll", "C:\USERS\ECORI\SOURCE\IAAC\AIA_STUDIO\HYPERGRAPH\SAMPLES\_REQUIREDDLLS\RGeoLib.dll", "C:\USERS\ECORI\SOURCE\IAAC\AIA_STUDIO\HYPERGRAPH\SAMPLES\_REQUIREDDLLS\Dbscan.dll"])  # -> out, simplify(furniture); inputs name: String, placementIn: list of Int32, importanceIn: Int32, scoreIn: Double, pathIn: Polyline, blockedIn: Polyline, drawingIn: list of Polyline; same code as c_script
data_bed_single_6 = Data(c_script_6.furniture)

# ----
explode_17 = Explode(Curve=geo_28, Recursive=True)  # -> Segments, Vertices
explode_18 = Explode(Curve=geo_34, Recursive=True)  # -> Segments, Vertices
explode_19 = Explode(Curve=geo_46, Recursive=True)  # -> Segments, Vertices
explode_20 = Explode(Curve=geo_43, Recursive=True)  # -> Segments, Vertices

# ---- group: Prepare and Sort
explode_21 = Explode(Curve=geo_145, Recursive=True)  # -> Segments, Vertices
item_7 = ListItem(List=explode_21.Segments, Index=int_placement_49, Wrap=True)
previewlw_7 = CustomPreviewLineweights(Geometry=item_7, Shader=ColourSwatch(SwatchColor=RGB(33, 33, 33)), Thickness=Slider(6, range=0..10), Absolute=False)
c_script_7 = CSharpScript(
    name=txt_name_49,
    placementIn=int_placement_49,
    importanceIn=importance_68,
    scoreIn=num_score_38,
    pathIn=geo_145,
    blockedIn=geo_146,
    drawingIn=geo_147,
    Reference=["C:\USERS\ECORI\SOURCE\IAAC\AIA_STUDIO\HYPERGRAPH\SAMPLES\_REQUIREDDLLS\MathNet.Numerics.dll", "C:\USERS\ECORI\SOURCE\IAAC\AIA_STUDIO\HYPERGRAPH\SAMPLES\_REQUIREDDLLS\RGeoLib.dll", "C:\USERS\ECORI\SOURCE\IAAC\AIA_STUDIO\HYPERGRAPH\SAMPLES\_REQUIREDDLLS\Dbscan.dll"])  # -> out, simplify(furniture); inputs name: String, placementIn: list of Int32, importanceIn: Int32, scoreIn: Double, pathIn: Polyline, blockedIn: Polyline, drawingIn: list of Polyline; same code as c_script
data_bed_single_7 = Data(c_script_7.furniture)

# ----
# 1 Bed
explode_22 = Explode(Curve=geo_37, Recursive=True)  # -> Segments, Vertices
explode_23 = Explode(Curve=geo_40, Recursive=True)  # -> Segments, Vertices
explode_24 = Explode(Curve=geo_49, Recursive=True)  # -> Segments, Vertices
explode_25 = Explode(Curve=geo_52, Recursive=True)  # -> Segments, Vertices
explode_26 = Explode(Curve=geo_61, Recursive=True)  # -> Segments, Vertices

# ---- group: Prepare and Sort
explode_27 = Explode(Curve=geo_133, Recursive=True)  # -> Segments, Vertices
item_8 = ListItem(List=explode_27.Segments, Index=int_placement_45, Wrap=True)
previewlw_8 = CustomPreviewLineweights(Geometry=item_8, Shader=ColourSwatch(SwatchColor=RGB(33, 33, 33)), Thickness=Slider(6, range=0..10), Absolute=False)
c_script_8 = CSharpScript(
    name=txt_name_45,
    placementIn=int_placement_45,
    importanceIn=int_importance_40,
    scoreIn=num_score_35,
    pathIn=geo_133,
    blockedIn=geo_134,
    drawingIn=geo_135,
    Reference=["C:\USERS\ECORI\SOURCE\IAAC\AIA_STUDIO\HYPERGRAPH\SAMPLES\_REQUIREDDLLS\MathNet.Numerics.dll", "C:\USERS\ECORI\SOURCE\IAAC\AIA_STUDIO\HYPERGRAPH\SAMPLES\_REQUIREDDLLS\RGeoLib.dll", "C:\USERS\ECORI\SOURCE\IAAC\AIA_STUDIO\HYPERGRAPH\SAMPLES\_REQUIREDDLLS\Dbscan.dll"])  # -> out, simplify(furniture); inputs name: String, placementIn: list of Int32, importanceIn: Int32, scoreIn: Double, pathIn: Polyline, blockedIn: Polyline, drawingIn: list of Polyline; same code as c_script
data_bed_single_8 = Data(c_script_8.furniture)

# ----
explode_28 = Explode(Curve=geo_55, Recursive=True)  # -> Segments, Vertices

# ---- group: Prepare and Sort
explode_29 = Explode(Curve=geo_148, Recursive=True)  # -> Segments, Vertices
item_9 = ListItem(List=explode_29.Segments, Index=int_placement_50, Wrap=True)
previewlw_9 = CustomPreviewLineweights(Geometry=item_9, Shader=ColourSwatch(SwatchColor=RGB(33, 33, 33)), Thickness=Slider(6, range=0..10), Absolute=False)
c_script_9 = CSharpScript(
    name=txt_name_50,
    placementIn=int_placement_50,
    importanceIn=int_importance_42,
    scoreIn=num_score_39,
    pathIn=geo_148,
    blockedIn=geo_149,
    drawingIn=geo_150,
    Reference=["C:\USERS\ECORI\SOURCE\IAAC\AIA_STUDIO\HYPERGRAPH\SAMPLES\_REQUIREDDLLS\MathNet.Numerics.dll", "C:\USERS\ECORI\SOURCE\IAAC\AIA_STUDIO\HYPERGRAPH\SAMPLES\_REQUIREDDLLS\RGeoLib.dll", "C:\USERS\ECORI\SOURCE\IAAC\AIA_STUDIO\HYPERGRAPH\SAMPLES\_REQUIREDDLLS\Dbscan.dll"])  # -> out, simplify(furniture); inputs name: String, placementIn: list of Int32, importanceIn: Int32, scoreIn: Double, pathIn: Polyline, blockedIn: Polyline, drawingIn: list of Polyline; same code as c_script
data_bed_single_9 = Data(c_script_9.furniture)

# ----
explode_30 = Explode(Curve=geo_58, Recursive=True)  # -> Segments, Vertices

# ---- group: Prepare and Sort
explode_31 = Explode(Curve=geo_136, Recursive=True)  # -> Segments, Vertices
item_10 = ListItem(List=explode_31.Segments, Index=int_placement_46, Wrap=True)
previewlw_10 = CustomPreviewLineweights(Geometry=item_10, Shader=ColourSwatch(SwatchColor=RGB(33, 33, 33)), Thickness=Slider(6, range=0..10), Absolute=False)
c_script_10 = CSharpScript(
    name=txt_name_46,
    placementIn=int_placement_46,
    importanceIn=importance_67,
    scoreIn=num_score_36,
    pathIn=geo_136,
    blockedIn=geo_137,
    drawingIn=geo_138,
    Reference=["C:\USERS\ECORI\SOURCE\IAAC\AIA_STUDIO\HYPERGRAPH\SAMPLES\_REQUIREDDLLS\MathNet.Numerics.dll", "C:\USERS\ECORI\SOURCE\IAAC\AIA_STUDIO\HYPERGRAPH\SAMPLES\_REQUIREDDLLS\RGeoLib.dll", "C:\USERS\ECORI\SOURCE\IAAC\AIA_STUDIO\HYPERGRAPH\SAMPLES\_REQUIREDDLLS\Dbscan.dll"])  # -> out, simplify(furniture); inputs name: String, placementIn: list of Int32, importanceIn: Int32, scoreIn: Double, pathIn: Polyline, blockedIn: Polyline, drawingIn: list of Polyline; same code as c_script
data_bed_single_10 = Data(c_script_10.furniture)

explode_32 = Explode(Curve=geo_151, Recursive=True)  # -> Segments, Vertices
item_11 = ListItem(List=explode_32.Segments, Index=int_placement_51, Wrap=True)
previewlw_11 = CustomPreviewLineweights(Geometry=item_11, Shader=ColourSwatch(SwatchColor=RGB(33, 33, 33)), Thickness=Slider(6, range=0..10), Absolute=False)
c_script_11 = CSharpScript(
    name=txt_name_51,
    placementIn=int_placement_51,
    importanceIn=importance_69,
    scoreIn=num_score_40,
    pathIn=geo_151,
    blockedIn=geo_152,
    drawingIn=geo_153,
    Reference=["C:\USERS\ECORI\SOURCE\IAAC\AIA_STUDIO\HYPERGRAPH\SAMPLES\_REQUIREDDLLS\MathNet.Numerics.dll", "C:\USERS\ECORI\SOURCE\IAAC\AIA_STUDIO\HYPERGRAPH\SAMPLES\_REQUIREDDLLS\RGeoLib.dll", "C:\USERS\ECORI\SOURCE\IAAC\AIA_STUDIO\HYPERGRAPH\SAMPLES\_REQUIREDDLLS\Dbscan.dll"])  # -> out, simplify(furniture); inputs name: String, placementIn: list of Int32, importanceIn: Int32, scoreIn: Double, pathIn: Polyline, blockedIn: Polyline, drawingIn: list of Polyline; same code as c_script
data_bed_single_11 = Data(c_script_11.furniture)

# ----
explode_33 = Explode(Curve=geo_64, Recursive=True)  # -> Segments, Vertices
explode_34 = Explode(Curve=geo_82, Recursive=True)  # -> Segments, Vertices
explode_35 = Explode(Curve=geo_76, Recursive=True)  # -> Segments, Vertices
explode_36 = Explode(Curve=geo_106, Recursive=True)  # -> Segments, Vertices
number_slider_2 = Slider(6, range=0..10)
explode_37 = Explode(Curve=geo_103, Recursive=True)  # -> Segments, Vertices
# 2 Bed
explode_38 = Explode(Curve=geo_79, Recursive=True)  # -> Segments, Vertices
explode_39 = Explode(Curve=geo_109, Recursive=True)  # -> Segments, Vertices
explode_40 = Explode(Curve=geo_112, Recursive=True)  # -> Segments, Vertices

# ---- group: Prepare and Sort
explode_41 = Explode(Curve=geo_181, Recursive=True)  # -> Segments, Vertices
item_12 = ListItem(List=explode_41.Segments, Index=int_placement_61, Wrap=True)
previewlw_12 = CustomPreviewLineweights(Geometry=item_12, Shader=ColourSwatch(SwatchColor=RGB(33, 33, 33)), Thickness=Slider(6, range=0..10), Absolute=False)
c_script_12 = CSharpScript(
    name=txt_name_61,
    placementIn=int_placement_61,
    importanceIn=int_importance_54,
    scoreIn=num_score_54,
    pathIn=geo_181,
    blockedIn=geo_182,
    drawingIn=geo_183,
    Reference=["C:\USERS\ECORI\SOURCE\IAAC\AIA_STUDIO\HYPERGRAPH\SAMPLES\_REQUIREDDLLS\MathNet.Numerics.dll", "C:\USERS\ECORI\SOURCE\IAAC\AIA_STUDIO\HYPERGRAPH\SAMPLES\_REQUIREDDLLS\RGeoLib.dll", "C:\USERS\ECORI\SOURCE\IAAC\AIA_STUDIO\HYPERGRAPH\SAMPLES\_REQUIREDDLLS\Dbscan.dll"])  # -> out, simplify(furniture); inputs name: String, placementIn: list of Int32, importanceIn: Int32, scoreIn: Double, pathIn: Polyline, blockedIn: Polyline, drawingIn: list of Polyline; same code as c_script
data_bed_single_12 = Data(c_script_12.furniture)

# ----
explode_42 = Explode(Curve=geo_115, Recursive=True)  # -> Segments, Vertices
explode_43 = Explode(Curve=geo_118, Recursive=True)  # -> Segments, Vertices
explode_44 = Explode(Curve=geo_100, Recursive=True)  # -> Segments, Vertices
explode_45 = Explode(Curve=geo_121, Recursive=True)  # -> Segments, Vertices
explode_46 = Explode(Curve=geo_97, Recursive=True)  # -> Segments, Vertices

# ---- group: Prepare and Sort
explode_47 = Explode(Curve=geo_184, Recursive=True)  # -> Segments, Vertices
item_13 = ListItem(List=explode_47.Segments, Index=int_placement_62, Wrap=True)
previewlw_13 = CustomPreviewLineweights(Geometry=item_13, Shader=ColourSwatch(SwatchColor=RGB(33, 33, 33)), Thickness=Slider(6, range=0..10), Absolute=False)
c_script_13 = CSharpScript(
    name=txt_name_62,
    placementIn=int_placement_62,
    importanceIn=importance_70,
    scoreIn=num_score_55,
    pathIn=geo_184,
    blockedIn=geo_185,
    drawingIn=geo_186,
    Reference=["C:\USERS\ECORI\SOURCE\IAAC\AIA_STUDIO\HYPERGRAPH\SAMPLES\_REQUIREDDLLS\MathNet.Numerics.dll", "C:\USERS\ECORI\SOURCE\IAAC\AIA_STUDIO\HYPERGRAPH\SAMPLES\_REQUIREDDLLS\RGeoLib.dll", "C:\USERS\ECORI\SOURCE\IAAC\AIA_STUDIO\HYPERGRAPH\SAMPLES\_REQUIREDDLLS\Dbscan.dll"])  # -> out, simplify(furniture); inputs name: String, placementIn: list of Int32, importanceIn: Int32, scoreIn: Double, pathIn: Polyline, blockedIn: Polyline, drawingIn: list of Polyline; same code as c_script
data_bed_single_13 = Data(c_script_13.furniture)

# ----
explode_48 = Explode(Curve=geo_94, Recursive=True)  # -> Segments, Vertices
explode_49 = Explode(Curve=geo_142, Recursive=True)  # -> Segments, Vertices
explode_50 = Explode(Curve=geo_127, Recursive=True)  # -> Segments, Vertices
explode_51 = Explode(Curve=geo_157, Recursive=True)  # -> Segments, Vertices
explode_52 = Explode(Curve=geo_125, Recursive=True)  # -> Segments, Vertices
explode_53 = Explode(Curve=geo_130, Recursive=True)  # -> Segments, Vertices
# 3+ Bed
explode_54 = Explode(Curve=geo_139, Recursive=True)  # -> Segments, Vertices
explode_55 = Explode(Curve=geo_163, Recursive=True)  # -> Segments, Vertices
explode_56 = Explode(Curve=geo_166, Recursive=True)  # -> Segments, Vertices
explode_57 = Explode(Curve=geo_172, Recursive=True)  # -> Segments, Vertices
explode_58 = Explode(Curve=geo_169, Recursive=True)  # -> Segments, Vertices
explode_59 = Explode(Curve=geo_154, Recursive=True)  # -> Segments, Vertices
explode_60 = Explode(Curve=geo_162, Recursive=True)  # -> Segments, Vertices
explode_61 = Explode(Curve=geo_176, Recursive=True)  # -> Segments, Vertices
explode_62 = Explode(Curve=geo_178, Recursive=True)  # -> Segments, Vertices
item_14 = ListItem(List=explode_2.Segments, Index=int_placement, Wrap=True)
item_15 = ListItem(List=explode_4.Segments, Index=int_placement_2, Wrap=True)
item_16 = ListItem(List=explode_6.Segments, Index=int_placement_3, Wrap=True)
item_17 = ListItem(List=explode_7.Segments, Index=int_placement_6, Wrap=True)
item_18 = ListItem(List=explode_8.Segments, Index=int_placement_5, Wrap=True)
item_19 = ListItem(List=explode_10.Segments, Index=int_placement_4, Wrap=True)
item_20 = ListItem(List=explode_11.Segments, Index=int_placement_7, Wrap=True)
item_21 = ListItem(List=explode_12.Segments, Index=int_placement_8, Wrap=True)
item_22 = ListItem(List=explode_14.Segments, Index=int_placement_9, Wrap=True)
swatch = ColourSwatch(SwatchColor=RGB(33, 33, 33))
item_23 = ListItem(List=explode_15.Segments, Index=int_placement_11, Wrap=True)
item_24 = ListItem(List=explode_17.Segments, Index=int_placement_10, Wrap=True)
item_25 = ListItem(List=explode_18.Segments, Index=int_placement_12, Wrap=True)
item_26 = ListItem(List=explode_19.Segments, Index=int_placement_16, Wrap=True)
item_27 = ListItem(List=explode_20.Segments, Index=int_placement_15, Wrap=True)
item_28 = ListItem(List=explode_22.Segments, Index=int_placement_13, Wrap=True)
item_29 = ListItem(List=explode_23.Segments, Index=int_placement_14, Wrap=True)
item_30 = ListItem(List=explode_24.Segments, Index=int_placement_17, Wrap=True)
item_31 = ListItem(List=explode_25.Segments, Index=int_placement_18, Wrap=True)
item_32 = ListItem(List=explode_26.Segments, Index=int_placement_21, Wrap=True)
item_33 = ListItem(List=explode_28.Segments, Index=int_placement_19, Wrap=True)
item_34 = ListItem(List=explode_30.Segments, Index=int_placement_20, Wrap=True)
item_35 = ListItem(List=explode_33.Segments, Index=int_placement_22, Wrap=True)
item_36 = ListItem(List=explode_34.Segments, Index=int_placement_28, Wrap=True)
item_37 = ListItem(List=explode_35.Segments, Index=int_placement_26, Wrap=True)
item_38 = ListItem(List=explode_36.Segments, Index=int_placement_36, Wrap=True)
swatch_2 = ColourSwatch(SwatchColor=RGB(33, 33, 33))
item_39 = ListItem(List=explode_37.Segments, Index=int_placement_35, Wrap=True)
item_40 = ListItem(List=explode_38.Segments, Index=int_placement_27, Wrap=True)
item_41 = ListItem(List=explode_39.Segments, Index=int_placement_37, Wrap=True)
item_42 = ListItem(List=explode_40.Segments, Index=int_placement_38, Wrap=True)
item_43 = ListItem(List=explode_42.Segments, Index=int_placement_39, Wrap=True)
item_44 = ListItem(List=explode_43.Segments, Index=int_placement_40, Wrap=True)
item_45 = ListItem(List=explode_44.Segments, Index=int_placement_34, Wrap=True)
item_46 = ListItem(List=explode_45.Segments, Index=int_placement_41, Wrap=True)
item_47 = ListItem(List=explode_46.Segments, Index=int_placement_33, Wrap=True)
item_48 = ListItem(List=explode_48.Segments, Index=int_placement_32, Wrap=True)
item_49 = ListItem(List=explode_49.Segments, Index=int_placement_48, Wrap=True)
item_50 = ListItem(List=explode_50.Segments, Index=int_placement_43, Wrap=True)
item_51 = ListItem(List=explode_51.Segments, Index=int_placement_53, Wrap=True)
item_52 = ListItem(List=explode_52.Segments, Index=int_placement_42, Wrap=True)
item_53 = ListItem(List=explode_53.Segments, Index=int_placement_44, Wrap=True)
item_54 = ListItem(List=explode_54.Segments, Index=int_placement_47, Wrap=True)
item_55 = ListItem(List=explode_55.Segments, Index=int_placement_55, Wrap=True)
item_56 = ListItem(List=explode_56.Segments, Index=int_placement_56, Wrap=True)
item_57 = ListItem(List=explode_57.Segments, Index=int_placement_58, Wrap=True)
item_58 = ListItem(List=explode_58.Segments, Index=int_placement_57, Wrap=True)
item_59 = ListItem(List=explode_59.Segments, Index=int_placement_52, Wrap=True)
item_60 = ListItem(List=explode_60.Segments, Index=int_placement_54, Wrap=True)
item_61 = ListItem(List=explode_61.Segments, Index=int_placement_59, Wrap=True)
item_62 = ListItem(List=explode_62.Segments, Index=int_placement_60, Wrap=True)
previewlw_14 = CustomPreviewLineweights(Geometry=item_14, Shader=ColourSwatch(SwatchColor=RGB(33, 33, 33)), Thickness=Slider(6, range=0..10), Absolute=False)
previewlw_15 = CustomPreviewLineweights(Geometry=item_15, Shader=ColourSwatch(SwatchColor=RGB(33, 33, 33)), Thickness=Slider(6, range=0..10), Absolute=False)
previewlw_16 = CustomPreviewLineweights(Geometry=item_16, Shader=ColourSwatch(SwatchColor=RGB(33, 33, 33)), Thickness=Slider(6, range=0..10), Absolute=False)
previewlw_17 = CustomPreviewLineweights(Geometry=item_17, Shader=ColourSwatch(SwatchColor=RGB(33, 33, 33)), Thickness=Slider(6, range=0..10), Absolute=False)
previewlw_18 = CustomPreviewLineweights(Geometry=item_18, Shader=ColourSwatch(SwatchColor=RGB(33, 33, 33)), Thickness=Slider(6, range=0..10), Absolute=False)
previewlw_19 = CustomPreviewLineweights(Geometry=item_19, Shader=ColourSwatch(SwatchColor=RGB(33, 33, 33)), Thickness=Slider(6, range=0..10), Absolute=False)
previewlw_20 = CustomPreviewLineweights(Geometry=item_20, Shader=ColourSwatch(SwatchColor=RGB(33, 33, 33)), Thickness=Slider(6, range=0..10), Absolute=False)
previewlw_21 = CustomPreviewLineweights(Geometry=item_21, Shader=ColourSwatch(SwatchColor=RGB(33, 33, 33)), Thickness=Slider(6, range=0..10), Absolute=False)
previewlw_22 = CustomPreviewLineweights(Geometry=item_22, Shader=ColourSwatch(SwatchColor=RGB(33, 33, 33)), Thickness=Slider(6, range=0..10), Absolute=False)
previewlw_23 = CustomPreviewLineweights(Geometry=item_23, Shader=ColourSwatch(SwatchColor=RGB(33, 33, 33)), Thickness=Slider(6, range=0..10), Absolute=False)
previewlw_24 = CustomPreviewLineweights(Geometry=item_24, Shader=ColourSwatch(SwatchColor=RGB(33, 33, 33)), Thickness=Slider(6, range=0..10), Absolute=False)
previewlw_25 = CustomPreviewLineweights(Geometry=item_25, Shader=ColourSwatch(SwatchColor=RGB(33, 33, 33)), Thickness=Slider(6, range=0..10), Absolute=False)
previewlw_26 = CustomPreviewLineweights(Geometry=item_26, Shader=ColourSwatch(SwatchColor=RGB(33, 33, 33)), Thickness=Slider(6, range=0..10), Absolute=False)
previewlw_27 = CustomPreviewLineweights(Geometry=item_27, Shader=ColourSwatch(SwatchColor=RGB(33, 33, 33)), Thickness=Slider(6, range=0..10), Absolute=False)
previewlw_28 = CustomPreviewLineweights(Geometry=item_28, Shader=ColourSwatch(SwatchColor=RGB(33, 33, 33)), Thickness=Slider(6, range=0..10), Absolute=False)
previewlw_29 = CustomPreviewLineweights(Geometry=item_29, Shader=ColourSwatch(SwatchColor=RGB(33, 33, 33)), Thickness=Slider(6, range=0..10), Absolute=False)
previewlw_30 = CustomPreviewLineweights(Geometry=item_30, Shader=ColourSwatch(SwatchColor=RGB(33, 33, 33)), Thickness=Slider(6, range=0..10), Absolute=False)
previewlw_31 = CustomPreviewLineweights(Geometry=item_31, Shader=ColourSwatch(SwatchColor=RGB(33, 33, 33)), Thickness=Slider(6, range=0..10), Absolute=False)
previewlw_32 = CustomPreviewLineweights(Geometry=item_36, Shader=ColourSwatch(SwatchColor=RGB(33, 33, 33)), Thickness=Slider(6, range=0..10), Absolute=False)
previewlw_33 = CustomPreviewLineweights(Geometry=item_33, Shader=ColourSwatch(SwatchColor=RGB(33, 33, 33)), Thickness=Slider(6, range=0..10), Absolute=False)
previewlw_34 = CustomPreviewLineweights(Geometry=item_34, Shader=ColourSwatch(SwatchColor=RGB(33, 33, 33)), Thickness=Slider(6, range=0..10), Absolute=False)
previewlw_35 = CustomPreviewLineweights(Geometry=item_35, Shader=ColourSwatch(SwatchColor=RGB(33, 33, 33)), Thickness=Slider(6, range=0..10), Absolute=False)
previewlw_36 = CustomPreviewLineweights(Geometry=item_37, Shader=ColourSwatch(SwatchColor=RGB(33, 33, 33)), Thickness=Slider(6, range=0..10), Absolute=False)
previewlw_37 = CustomPreviewLineweights(Geometry=item_38, Shader=ColourSwatch(SwatchColor=RGB(33, 33, 33)), Thickness=Slider(6, range=0..10), Absolute=False)
previewlw_38 = CustomPreviewLineweights(Geometry=item_39, Shader=ColourSwatch(SwatchColor=RGB(33, 33, 33)), Thickness=Slider(6, range=0..10), Absolute=False)
previewlw_39 = CustomPreviewLineweights(Geometry=item_40, Shader=ColourSwatch(SwatchColor=RGB(33, 33, 33)), Thickness=Slider(6, range=0..10), Absolute=False)
previewlw_40 = CustomPreviewLineweights(Geometry=item_41, Shader=ColourSwatch(SwatchColor=RGB(33, 33, 33)), Thickness=Slider(6, range=0..10), Absolute=False)
previewlw_41 = CustomPreviewLineweights(Geometry=item_42, Shader=ColourSwatch(SwatchColor=RGB(33, 33, 33)), Thickness=Slider(6, range=0..10), Absolute=False)
previewlw_42 = CustomPreviewLineweights(Geometry=item_43, Shader=ColourSwatch(SwatchColor=RGB(33, 33, 33)), Thickness=Slider(6, range=0..10), Absolute=False)
previewlw_43 = CustomPreviewLineweights(Geometry=item_44, Shader=ColourSwatch(SwatchColor=RGB(33, 33, 33)), Thickness=Slider(6, range=0..10), Absolute=False)
previewlw_44 = CustomPreviewLineweights(Geometry=item_45, Shader=ColourSwatch(SwatchColor=RGB(33, 33, 33)), Thickness=Slider(6, range=0..10), Absolute=False)
previewlw_45 = CustomPreviewLineweights(Geometry=item_46, Shader=ColourSwatch(SwatchColor=RGB(33, 33, 33)), Thickness=Slider(6, range=0..10), Absolute=False)
previewlw_46 = CustomPreviewLineweights(Geometry=item_47, Shader=ColourSwatch(SwatchColor=RGB(33, 33, 33)), Thickness=Slider(6, range=0..10), Absolute=False)
previewlw_47 = CustomPreviewLineweights(Geometry=item_48, Shader=ColourSwatch(SwatchColor=RGB(33, 33, 33)), Thickness=Slider(6, range=0..10), Absolute=False)
previewlw_48 = CustomPreviewLineweights(
    Geometry=[item_57, item_49],
    Shader=ColourSwatch(SwatchColor=RGB(33, 33, 33)),
    Thickness=Slider(6, range=0..10),
    Absolute=False)
previewlw_49 = CustomPreviewLineweights(Geometry=item_50, Shader=ColourSwatch(SwatchColor=RGB(33, 33, 33)), Thickness=Slider(6, range=0..10), Absolute=False)
previewlw_50 = CustomPreviewLineweights(Geometry=item_51, Shader=ColourSwatch(SwatchColor=RGB(33, 33, 33)), Thickness=Slider(6, range=0..10), Absolute=False)
previewlw_51 = CustomPreviewLineweights(Geometry=item_52, Shader=ColourSwatch(SwatchColor=RGB(33, 33, 33)), Thickness=Slider(6, range=0..10), Absolute=False)
previewlw_52 = CustomPreviewLineweights(Geometry=item_53, Shader=ColourSwatch(SwatchColor=RGB(33, 33, 33)), Thickness=Slider(6, range=0..10), Absolute=False)
previewlw_53 = CustomPreviewLineweights(Geometry=item_54, Shader=ColourSwatch(SwatchColor=RGB(33, 33, 33)), Thickness=Slider(6, range=0..10), Absolute=False)
previewlw_54 = CustomPreviewLineweights(Geometry=item_55, Shader=ColourSwatch(SwatchColor=RGB(33, 33, 33)), Thickness=Slider(6, range=0..10), Absolute=False)
previewlw_55 = CustomPreviewLineweights(Geometry=item_56, Shader=ColourSwatch(SwatchColor=RGB(33, 33, 33)), Thickness=Slider(6, range=0..10), Absolute=False)
previewlw_56 = CustomPreviewLineweights(Geometry=item_58, Shader=ColourSwatch(SwatchColor=RGB(33, 33, 33)), Thickness=Slider(6, range=0..10), Absolute=False)
previewlw_57 = CustomPreviewLineweights(Geometry=item_59, Shader=ColourSwatch(SwatchColor=RGB(33, 33, 33)), Thickness=Slider(6, range=0..10), Absolute=False)
previewlw_58 = CustomPreviewLineweights(Geometry=item_60, Shader=ColourSwatch(SwatchColor=RGB(33, 33, 33)), Thickness=Slider(6, range=0..10), Absolute=False)
previewlw_59 = CustomPreviewLineweights(Geometry=item_61, Shader=ColourSwatch(SwatchColor=RGB(33, 33, 33)), Thickness=Slider(6, range=0..10), Absolute=False)
previewlw_60 = CustomPreviewLineweights(Geometry=item_62, Shader=ColourSwatch(SwatchColor=RGB(33, 33, 33)), Thickness=Slider(6, range=0..10), Absolute=False)

# ---- group: Prepare and Sort
c_script_14 = CSharpScript(
    name=txt_name,
    placementIn=int_placement,
    importanceIn=int_importance,
    scoreIn=num_score,
    pathIn=geo,
    blockedIn=geo_3,
    drawingIn=geo_2,
    Reference=["C:\USERS\ECORI\SOURCE\IAAC\AIA_STUDIO\HYPERGRAPH\SAMPLES\_REQUIREDDLLS\MathNet.Numerics.dll", "C:\USERS\ECORI\SOURCE\IAAC\AIA_STUDIO\HYPERGRAPH\SAMPLES\_REQUIREDDLLS\RGeoLib.dll", "C:\USERS\ECORI\SOURCE\IAAC\AIA_STUDIO\HYPERGRAPH\SAMPLES\_REQUIREDDLLS\Dbscan.dll"])  # -> out, simplify(furniture); inputs name: String, placementIn: list of Int32, importanceIn: Int32, scoreIn: Double, pathIn: Polyline, blockedIn: Polyline, drawingIn: list of Polyline; same code as c_script
data_dining_studio = Data(c_script_14.furniture)

c_script_15 = CSharpScript(
    name=txt_name_2,
    placementIn=int_placement_2,
    importanceIn=int_importance_2,
    scoreIn=num_score_2,
    pathIn=geo_4,
    blockedIn=geo_5,
    drawingIn=geo_6,
    Reference=["C:\USERS\ECORI\SOURCE\IAAC\AIA_STUDIO\HYPERGRAPH\SAMPLES\_REQUIREDDLLS\MathNet.Numerics.dll", "C:\USERS\ECORI\SOURCE\IAAC\AIA_STUDIO\HYPERGRAPH\SAMPLES\_REQUIREDDLLS\RGeoLib.dll", "C:\USERS\ECORI\SOURCE\IAAC\AIA_STUDIO\HYPERGRAPH\SAMPLES\_REQUIREDDLLS\Dbscan.dll"])  # -> out, simplify(furniture); inputs name: String, placementIn: list of Int32, importanceIn: Int32, scoreIn: Double, pathIn: Polyline, blockedIn: Polyline, drawingIn: list of Polyline; same code as c_script
data_bed_queen = Data(c_script_15.furniture)

c_script_16 = CSharpScript(
    name=txt_name_3,
    placementIn=int_placement_3,
    importanceIn=int_importance_3,
    scoreIn=num_score_3,
    pathIn=geo_7,
    blockedIn=geo_9,
    drawingIn=geo_8,
    Reference=["C:\USERS\ECORI\SOURCE\IAAC\AIA_STUDIO\HYPERGRAPH\SAMPLES\_REQUIREDDLLS\MathNet.Numerics.dll", "C:\USERS\ECORI\SOURCE\IAAC\AIA_STUDIO\HYPERGRAPH\SAMPLES\_REQUIREDDLLS\RGeoLib.dll", "C:\USERS\ECORI\SOURCE\IAAC\AIA_STUDIO\HYPERGRAPH\SAMPLES\_REQUIREDDLLS\Dbscan.dll"])  # -> out, simplify(furniture); inputs name: String, placementIn: list of Int32, importanceIn: Int32, scoreIn: Double, pathIn: Polyline, blockedIn: Polyline, drawingIn: list of Polyline; same code as c_script
data_bath_studio = Data(c_script_16.furniture)

c_script_17 = CSharpScript(
    name=txt_name_6,
    placementIn=int_placement_6,
    importanceIn=int_importance_6,
    scoreIn=num_score_4,
    pathIn=geo_16,
    blockedIn=geo_17,
    drawingIn=geo_18,
    Reference=["C:\USERS\ECORI\SOURCE\IAAC\AIA_STUDIO\HYPERGRAPH\SAMPLES\_REQUIREDDLLS\MathNet.Numerics.dll", "C:\USERS\ECORI\SOURCE\IAAC\AIA_STUDIO\HYPERGRAPH\SAMPLES\_REQUIREDDLLS\RGeoLib.dll", "C:\USERS\ECORI\SOURCE\IAAC\AIA_STUDIO\HYPERGRAPH\SAMPLES\_REQUIREDDLLS\Dbscan.dll"])  # -> out, simplify(furniture); inputs name: String, placementIn: list of Int32, importanceIn: Int32, scoreIn: Double, pathIn: Polyline, blockedIn: Polyline, drawingIn: list of Polyline; same code as c_script
data_bath_studio_2 = Data(c_script_17.furniture)

c_script_18 = CSharpScript(
    name=txt_name_5,
    placementIn=int_placement_5,
    importanceIn=int_importance_5,
    scoreIn=num_score_6,
    pathIn=geo_13,
    blockedIn=geo_15,
    drawingIn=geo_14,
    Reference=["C:\USERS\ECORI\SOURCE\IAAC\AIA_STUDIO\HYPERGRAPH\SAMPLES\_REQUIREDDLLS\MathNet.Numerics.dll", "C:\USERS\ECORI\SOURCE\IAAC\AIA_STUDIO\HYPERGRAPH\SAMPLES\_REQUIREDDLLS\RGeoLib.dll", "C:\USERS\ECORI\SOURCE\IAAC\AIA_STUDIO\HYPERGRAPH\SAMPLES\_REQUIREDDLLS\Dbscan.dll"])  # -> out, simplify(furniture); inputs name: String, placementIn: list of Int32, importanceIn: Int32, scoreIn: Double, pathIn: Polyline, blockedIn: Polyline, drawingIn: list of Polyline; same code as c_script
data_bed_queen_2 = Data(c_script_18.furniture)

c_script_19 = CSharpScript(
    name=txt_name_4,
    placementIn=int_placement_4,
    importanceIn=int_importance_4,
    scoreIn=num_score_5,
    pathIn=geo_10,
    blockedIn=geo_12,
    drawingIn=geo_11,
    Reference=["C:\USERS\ECORI\SOURCE\IAAC\AIA_STUDIO\HYPERGRAPH\SAMPLES\_REQUIREDDLLS\MathNet.Numerics.dll", "C:\USERS\ECORI\SOURCE\IAAC\AIA_STUDIO\HYPERGRAPH\SAMPLES\_REQUIREDDLLS\RGeoLib.dll", "C:\USERS\ECORI\SOURCE\IAAC\AIA_STUDIO\HYPERGRAPH\SAMPLES\_REQUIREDDLLS\Dbscan.dll"])  # -> out, simplify(furniture); inputs name: String, placementIn: list of Int32, importanceIn: Int32, scoreIn: Double, pathIn: Polyline, blockedIn: Polyline, drawingIn: list of Polyline; same code as c_script
data_bed_queen_3 = Data(c_script_19.furniture)

c_script_20 = CSharpScript(
    name=txt_name_7,
    placementIn=int_placement_7,
    importanceIn=int_importance_7,
    scoreIn=num_score_7,
    pathIn=geo_19,
    blockedIn=geo_20,
    drawingIn=geo_21,
    Reference=["C:\USERS\ECORI\SOURCE\IAAC\AIA_STUDIO\HYPERGRAPH\SAMPLES\_REQUIREDDLLS\MathNet.Numerics.dll", "C:\USERS\ECORI\SOURCE\IAAC\AIA_STUDIO\HYPERGRAPH\SAMPLES\_REQUIREDDLLS\RGeoLib.dll", "C:\USERS\ECORI\SOURCE\IAAC\AIA_STUDIO\HYPERGRAPH\SAMPLES\_REQUIREDDLLS\Dbscan.dll"])  # -> out, simplify(furniture); inputs name: String, placementIn: list of Int32, importanceIn: Int32, scoreIn: Double, pathIn: Polyline, blockedIn: Polyline, drawingIn: list of Polyline; same code as c_script
data_kitchen_studio = Data(c_script_20.furniture)

c_script_21 = CSharpScript(
    name=txt_name_8,
    placementIn=int_placement_8,
    importanceIn=int_importance_8,
    scoreIn=num_score_8,
    pathIn=geo_22,
    blockedIn=geo_24,
    drawingIn=geo_23,
    Reference=["C:\USERS\ECORI\SOURCE\IAAC\AIA_STUDIO\HYPERGRAPH\SAMPLES\_REQUIREDDLLS\MathNet.Numerics.dll", "C:\USERS\ECORI\SOURCE\IAAC\AIA_STUDIO\HYPERGRAPH\SAMPLES\_REQUIREDDLLS\RGeoLib.dll", "C:\USERS\ECORI\SOURCE\IAAC\AIA_STUDIO\HYPERGRAPH\SAMPLES\_REQUIREDDLLS\Dbscan.dll"])  # -> out, simplify(furniture); inputs name: String, placementIn: list of Int32, importanceIn: Int32, scoreIn: Double, pathIn: Polyline, blockedIn: Polyline, drawingIn: list of Polyline; same code as c_script
data_dining_studio_2 = Data(c_script_21.furniture)

c_script_22 = CSharpScript(
    name=txt_name_9,
    placementIn=int_placement_9,
    importanceIn=int_importance_9,
    scoreIn=num_score_9,
    pathIn=geo_25,
    blockedIn=geo_27,
    drawingIn=geo_26,
    Reference=["C:\USERS\ECORI\SOURCE\IAAC\AIA_STUDIO\HYPERGRAPH\SAMPLES\_REQUIREDDLLS\MathNet.Numerics.dll", "C:\USERS\ECORI\SOURCE\IAAC\AIA_STUDIO\HYPERGRAPH\SAMPLES\_REQUIREDDLLS\RGeoLib.dll", "C:\USERS\ECORI\SOURCE\IAAC\AIA_STUDIO\HYPERGRAPH\SAMPLES\_REQUIREDDLLS\Dbscan.dll"])  # -> out, simplify(furniture); inputs name: String, placementIn: list of Int32, importanceIn: Int32, scoreIn: Double, pathIn: Polyline, blockedIn: Polyline, drawingIn: list of Polyline; same code as c_script
data_bath_studio_3 = Data(c_script_22.furniture)

c_script_23 = CSharpScript(
    name=txt_name_11,
    placementIn=int_placement_11,
    importanceIn=int_importance_10,
    scoreIn=num_score_10,
    pathIn=geo_31,
    blockedIn=geo_33,
    drawingIn=geo_32,
    Reference=["C:\USERS\ECORI\SOURCE\IAAC\AIA_STUDIO\HYPERGRAPH\SAMPLES\_REQUIREDDLLS\MathNet.Numerics.dll", "C:\USERS\ECORI\SOURCE\IAAC\AIA_STUDIO\HYPERGRAPH\SAMPLES\_REQUIREDDLLS\RGeoLib.dll", "C:\USERS\ECORI\SOURCE\IAAC\AIA_STUDIO\HYPERGRAPH\SAMPLES\_REQUIREDDLLS\Dbscan.dll"])  # -> out, simplify(furniture); inputs name: String, placementIn: list of Int32, importanceIn: Int32, scoreIn: Double, pathIn: Polyline, blockedIn: Polyline, drawingIn: list of Polyline; same code as c_script
data_bed_queen_4 = Data(c_script_23.furniture)

c_script_24 = CSharpScript(
    name=txt_name_10,
    placementIn=int_placement_10,
    importanceIn=int_importance_11,
    scoreIn=num_score_11,
    pathIn=geo_28,
    blockedIn=geo_29,
    drawingIn=geo_30,
    Reference=["C:\USERS\ECORI\SOURCE\IAAC\AIA_STUDIO\HYPERGRAPH\SAMPLES\_REQUIREDDLLS\MathNet.Numerics.dll", "C:\USERS\ECORI\SOURCE\IAAC\AIA_STUDIO\HYPERGRAPH\SAMPLES\_REQUIREDDLLS\RGeoLib.dll", "C:\USERS\ECORI\SOURCE\IAAC\AIA_STUDIO\HYPERGRAPH\SAMPLES\_REQUIREDDLLS\Dbscan.dll"])  # -> out, simplify(furniture); inputs name: String, placementIn: list of Int32, importanceIn: Int32, scoreIn: Double, pathIn: Polyline, blockedIn: Polyline, drawingIn: list of Polyline; same code as c_script
data_living_studio = Data(c_script_24.furniture)

c_script_25 = CSharpScript(
    name=txt_name_12,
    placementIn=int_placement_12,
    importanceIn=int_importance_12,
    scoreIn=num_score_23,
    pathIn=geo_34,
    blockedIn=geo_36,
    drawingIn=geo_35,
    Reference=["C:\USERS\ECORI\SOURCE\IAAC\AIA_STUDIO\HYPERGRAPH\SAMPLES\_REQUIREDDLLS\MathNet.Numerics.dll", "C:\USERS\ECORI\SOURCE\IAAC\AIA_STUDIO\HYPERGRAPH\SAMPLES\_REQUIREDDLLS\RGeoLib.dll", "C:\USERS\ECORI\SOURCE\IAAC\AIA_STUDIO\HYPERGRAPH\SAMPLES\_REQUIREDDLLS\Dbscan.dll"])  # -> out, simplify(furniture); inputs name: String, placementIn: list of Int32, importanceIn: Int32, scoreIn: Double, pathIn: Polyline, blockedIn: Polyline, drawingIn: list of Polyline; same code as c_script
data_bath_studio_4 = Data(c_script_25.furniture)

c_script_26 = CSharpScript(
    name=txt_name_16,
    placementIn=int_placement_16,
    importanceIn=int_importance_15,
    scoreIn=num_score_24,
    pathIn=geo_46,
    blockedIn=geo_47,
    drawingIn=geo_48,
    Reference=["C:\USERS\ECORI\SOURCE\IAAC\AIA_STUDIO\HYPERGRAPH\SAMPLES\_REQUIREDDLLS\MathNet.Numerics.dll", "C:\USERS\ECORI\SOURCE\IAAC\AIA_STUDIO\HYPERGRAPH\SAMPLES\_REQUIREDDLLS\RGeoLib.dll", "C:\USERS\ECORI\SOURCE\IAAC\AIA_STUDIO\HYPERGRAPH\SAMPLES\_REQUIREDDLLS\Dbscan.dll"])  # -> out, simplify(furniture); inputs name: String, placementIn: list of Int32, importanceIn: Int32, scoreIn: Double, pathIn: Polyline, blockedIn: Polyline, drawingIn: list of Polyline; same code as c_script
data_bath_studio_5 = Data(c_script_26.furniture)

c_script_27 = CSharpScript(
    name=txt_name_15,
    placementIn=int_placement_15,
    importanceIn=int_importance_14,
    scoreIn=num_score_22,
    pathIn=geo_43,
    blockedIn=geo_45,
    drawingIn=geo_44,
    Reference=["C:\USERS\ECORI\SOURCE\IAAC\AIA_STUDIO\HYPERGRAPH\SAMPLES\_REQUIREDDLLS\MathNet.Numerics.dll", "C:\USERS\ECORI\SOURCE\IAAC\AIA_STUDIO\HYPERGRAPH\SAMPLES\_REQUIREDDLLS\RGeoLib.dll", "C:\USERS\ECORI\SOURCE\IAAC\AIA_STUDIO\HYPERGRAPH\SAMPLES\_REQUIREDDLLS\Dbscan.dll"])  # -> out, simplify(furniture); inputs name: String, placementIn: list of Int32, importanceIn: Int32, scoreIn: Double, pathIn: Polyline, blockedIn: Polyline, drawingIn: list of Polyline; same code as c_script
data_kitchen_studio_2 = Data(c_script_27.furniture)

c_script_28 = CSharpScript(
    name=txt_name_13,
    placementIn=int_placement_13,
    importanceIn=int_importance_13,
    scoreIn=num_score_25,
    pathIn=geo_37,
    blockedIn=geo_39,
    drawingIn=geo_38,
    Reference=["C:\USERS\ECORI\SOURCE\IAAC\AIA_STUDIO\HYPERGRAPH\SAMPLES\_REQUIREDDLLS\MathNet.Numerics.dll", "C:\USERS\ECORI\SOURCE\IAAC\AIA_STUDIO\HYPERGRAPH\SAMPLES\_REQUIREDDLLS\RGeoLib.dll", "C:\USERS\ECORI\SOURCE\IAAC\AIA_STUDIO\HYPERGRAPH\SAMPLES\_REQUIREDDLLS\Dbscan.dll"])  # -> out, simplify(furniture); inputs name: String, placementIn: list of Int32, importanceIn: Int32, scoreIn: Double, pathIn: Polyline, blockedIn: Polyline, drawingIn: list of Polyline; same code as c_script
data_bed_queen_5 = Data(c_script_28.furniture)

c_script_29 = CSharpScript(
    name=txt_name_14,
    placementIn=int_placement_14,
    importanceIn=int_importance_16,
    scoreIn=num_score_26,
    pathIn=geo_40,
    blockedIn=geo_41,
    drawingIn=geo_42,
    Reference=["C:\USERS\ECORI\SOURCE\IAAC\AIA_STUDIO\HYPERGRAPH\SAMPLES\_REQUIREDDLLS\MathNet.Numerics.dll", "C:\USERS\ECORI\SOURCE\IAAC\AIA_STUDIO\HYPERGRAPH\SAMPLES\_REQUIREDDLLS\RGeoLib.dll", "C:\USERS\ECORI\SOURCE\IAAC\AIA_STUDIO\HYPERGRAPH\SAMPLES\_REQUIREDDLLS\Dbscan.dll"])  # -> out, simplify(furniture); inputs name: String, placementIn: list of Int32, importanceIn: Int32, scoreIn: Double, pathIn: Polyline, blockedIn: Polyline, drawingIn: list of Polyline; same code as c_script
data_bed_queen_6 = Data(c_script_29.furniture)

c_script_30 = CSharpScript(
    name=txt_name_17,
    placementIn=int_placement_17,
    importanceIn=int_importance_17,
    scoreIn=num_score_27,
    pathIn=geo_49,
    blockedIn=geo_50,
    drawingIn=geo_51,
    Reference=["C:\USERS\ECORI\SOURCE\IAAC\AIA_STUDIO\HYPERGRAPH\SAMPLES\_REQUIREDDLLS\MathNet.Numerics.dll", "C:\USERS\ECORI\SOURCE\IAAC\AIA_STUDIO\HYPERGRAPH\SAMPLES\_REQUIREDDLLS\RGeoLib.dll", "C:\USERS\ECORI\SOURCE\IAAC\AIA_STUDIO\HYPERGRAPH\SAMPLES\_REQUIREDDLLS\Dbscan.dll"])  # -> out, simplify(furniture); inputs name: String, placementIn: list of Int32, importanceIn: Int32, scoreIn: Double, pathIn: Polyline, blockedIn: Polyline, drawingIn: list of Polyline; same code as c_script
data_kitchen_studio_3 = Data(c_script_30.furniture)

c_script_31 = CSharpScript(
    name=txt_name_18,
    placementIn=int_placement_18,
    importanceIn=int_importance_18,
    scoreIn=num_score_28,
    pathIn=geo_52,
    blockedIn=geo_53,
    drawingIn=geo_54,
    Reference=["C:\USERS\ECORI\SOURCE\IAAC\AIA_STUDIO\HYPERGRAPH\SAMPLES\_REQUIREDDLLS\MathNet.Numerics.dll", "C:\USERS\ECORI\SOURCE\IAAC\AIA_STUDIO\HYPERGRAPH\SAMPLES\_REQUIREDDLLS\RGeoLib.dll", "C:\USERS\ECORI\SOURCE\IAAC\AIA_STUDIO\HYPERGRAPH\SAMPLES\_REQUIREDDLLS\Dbscan.dll"])  # -> out, simplify(furniture); inputs name: String, placementIn: list of Int32, importanceIn: Int32, scoreIn: Double, pathIn: Polyline, blockedIn: Polyline, drawingIn: list of Polyline; same code as c_script
data_kitchen_studio_4 = Data(c_script_31.furniture)

c_script_32 = CSharpScript(
    name=txt_name_21,
    placementIn=int_placement_21,
    importanceIn=int_importance_21,
    scoreIn=num_score_31,
    pathIn=geo_61,
    blockedIn=geo_63,
    drawingIn=geo_62,
    Reference=["C:\USERS\ECORI\SOURCE\IAAC\AIA_STUDIO\HYPERGRAPH\SAMPLES\_REQUIREDDLLS\MathNet.Numerics.dll", "C:\USERS\ECORI\SOURCE\IAAC\AIA_STUDIO\HYPERGRAPH\SAMPLES\_REQUIREDDLLS\RGeoLib.dll", "C:\USERS\ECORI\SOURCE\IAAC\AIA_STUDIO\HYPERGRAPH\SAMPLES\_REQUIREDDLLS\Dbscan.dll"])  # -> out, simplify(furniture); inputs name: String, placementIn: list of Int32, importanceIn: Int32, scoreIn: Double, pathIn: Polyline, blockedIn: Polyline, drawingIn: list of Polyline; same code as c_script
data_bed_queen_7 = Data(c_script_32.furniture)

c_script_33 = CSharpScript(
    name=txt_name_19,
    placementIn=int_placement_19,
    importanceIn=int_importance_19,
    scoreIn=num_score_29,
    pathIn=geo_55,
    blockedIn=geo_57,
    drawingIn=geo_56,
    Reference=["C:\USERS\ECORI\SOURCE\IAAC\AIA_STUDIO\HYPERGRAPH\SAMPLES\_REQUIREDDLLS\MathNet.Numerics.dll", "C:\USERS\ECORI\SOURCE\IAAC\AIA_STUDIO\HYPERGRAPH\SAMPLES\_REQUIREDDLLS\RGeoLib.dll", "C:\USERS\ECORI\SOURCE\IAAC\AIA_STUDIO\HYPERGRAPH\SAMPLES\_REQUIREDDLLS\Dbscan.dll"])  # -> out, simplify(furniture); inputs name: String, placementIn: list of Int32, importanceIn: Int32, scoreIn: Double, pathIn: Polyline, blockedIn: Polyline, drawingIn: list of Polyline; same code as c_script
data_dining_studio_3 = Data(c_script_33.furniture)

c_script_34 = CSharpScript(
    name=txt_name_20,
    placementIn=int_placement_20,
    importanceIn=int_importance_20,
    scoreIn=num_score_30,
    pathIn=geo_58,
    blockedIn=geo_60,
    drawingIn=geo_59,
    Reference=["C:\USERS\ECORI\SOURCE\IAAC\AIA_STUDIO\HYPERGRAPH\SAMPLES\_REQUIREDDLLS\MathNet.Numerics.dll", "C:\USERS\ECORI\SOURCE\IAAC\AIA_STUDIO\HYPERGRAPH\SAMPLES\_REQUIREDDLLS\RGeoLib.dll", "C:\USERS\ECORI\SOURCE\IAAC\AIA_STUDIO\HYPERGRAPH\SAMPLES\_REQUIREDDLLS\Dbscan.dll"])  # -> out, simplify(furniture); inputs name: String, placementIn: list of Int32, importanceIn: Int32, scoreIn: Double, pathIn: Polyline, blockedIn: Polyline, drawingIn: list of Polyline; same code as c_script
data_bath_studio_6 = Data(c_script_34.furniture)

c_script_35 = CSharpScript(
    name=txt_name_22,
    placementIn=int_placement_22,
    importanceIn=int_importance_22,
    scoreIn=num_score_32,
    pathIn=geo_64,
    blockedIn=geo_65,
    drawingIn=geo_66,
    Reference=["C:\USERS\ECORI\SOURCE\IAAC\AIA_STUDIO\HYPERGRAPH\SAMPLES\_REQUIREDDLLS\MathNet.Numerics.dll", "C:\USERS\ECORI\SOURCE\IAAC\AIA_STUDIO\HYPERGRAPH\SAMPLES\_REQUIREDDLLS\RGeoLib.dll", "C:\USERS\ECORI\SOURCE\IAAC\AIA_STUDIO\HYPERGRAPH\SAMPLES\_REQUIREDDLLS\Dbscan.dll"])  # -> out, simplify(furniture); inputs name: String, placementIn: list of Int32, importanceIn: Int32, scoreIn: Double, pathIn: Polyline, blockedIn: Polyline, drawingIn: list of Polyline; same code as c_script
data_living_studio_2 = Data(c_script_35.furniture)

c_script_36 = CSharpScript(
    name=txt_name_28,
    placementIn=int_placement_28,
    importanceIn=int_importance_29,
    scoreIn=num_score_46,
    pathIn=geo_82,
    blockedIn=geo_84,
    drawingIn=geo_83,
    Reference=["C:\USERS\ECORI\SOURCE\IAAC\AIA_STUDIO\HYPERGRAPH\SAMPLES\_REQUIREDDLLS\MathNet.Numerics.dll", "C:\USERS\ECORI\SOURCE\IAAC\AIA_STUDIO\HYPERGRAPH\SAMPLES\_REQUIREDDLLS\RGeoLib.dll", "C:\USERS\ECORI\SOURCE\IAAC\AIA_STUDIO\HYPERGRAPH\SAMPLES\_REQUIREDDLLS\Dbscan.dll"])  # -> out, simplify(furniture); inputs name: String, placementIn: list of Int32, importanceIn: Int32, scoreIn: Double, pathIn: Polyline, blockedIn: Polyline, drawingIn: list of Polyline; same code as c_script
data_bed_queen_8 = Data(c_script_36.furniture)

c_script_37 = CSharpScript(
    name=txt_name_26,
    placementIn=int_placement_26,
    importanceIn=int_importance_28,
    scoreIn=num_score_44,
    pathIn=geo_76,
    blockedIn=geo_78,
    drawingIn=geo_77,
    Reference=["C:\USERS\ECORI\SOURCE\IAAC\AIA_STUDIO\HYPERGRAPH\SAMPLES\_REQUIREDDLLS\MathNet.Numerics.dll", "C:\USERS\ECORI\SOURCE\IAAC\AIA_STUDIO\HYPERGRAPH\SAMPLES\_REQUIREDDLLS\RGeoLib.dll", "C:\USERS\ECORI\SOURCE\IAAC\AIA_STUDIO\HYPERGRAPH\SAMPLES\_REQUIREDDLLS\Dbscan.dll"])  # -> out, simplify(furniture); inputs name: String, placementIn: list of Int32, importanceIn: Int32, scoreIn: Double, pathIn: Polyline, blockedIn: Polyline, drawingIn: list of Polyline; same code as c_script
data_bath_studio_7 = Data(c_script_37.furniture)

c_script_38 = CSharpScript(
    name=txt_name_36,
    placementIn=int_placement_36,
    importanceIn=int_importance_31,
    scoreIn=num_score_45,
    pathIn=geo_106,
    blockedIn=geo_107,
    drawingIn=geo_108,
    Reference=["C:\USERS\ECORI\SOURCE\IAAC\AIA_STUDIO\HYPERGRAPH\SAMPLES\_REQUIREDDLLS\MathNet.Numerics.dll", "C:\USERS\ECORI\SOURCE\IAAC\AIA_STUDIO\HYPERGRAPH\SAMPLES\_REQUIREDDLLS\RGeoLib.dll", "C:\USERS\ECORI\SOURCE\IAAC\AIA_STUDIO\HYPERGRAPH\SAMPLES\_REQUIREDDLLS\Dbscan.dll"])  # -> out, simplify(furniture); inputs name: String, placementIn: list of Int32, importanceIn: Int32, scoreIn: Double, pathIn: Polyline, blockedIn: Polyline, drawingIn: list of Polyline; same code as c_script
data_bath_studio_8 = Data(c_script_38.furniture)

c_script_39 = CSharpScript(
    name=txt_name_35,
    placementIn=int_placement_35,
    importanceIn=int_importance_30,
    scoreIn=num_score_43,
    pathIn=geo_103,
    blockedIn=geo_105,
    drawingIn=geo_104,
    Reference=["C:\USERS\ECORI\SOURCE\IAAC\AIA_STUDIO\HYPERGRAPH\SAMPLES\_REQUIREDDLLS\MathNet.Numerics.dll", "C:\USERS\ECORI\SOURCE\IAAC\AIA_STUDIO\HYPERGRAPH\SAMPLES\_REQUIREDDLLS\RGeoLib.dll", "C:\USERS\ECORI\SOURCE\IAAC\AIA_STUDIO\HYPERGRAPH\SAMPLES\_REQUIREDDLLS\Dbscan.dll"])  # -> out, simplify(furniture); inputs name: String, placementIn: list of Int32, importanceIn: Int32, scoreIn: Double, pathIn: Polyline, blockedIn: Polyline, drawingIn: list of Polyline; same code as c_script
data_kitchen_studio_5 = Data(c_script_39.furniture)

c_script_40 = CSharpScript(
    name=txt_name_27,
    placementIn=int_placement_27,
    importanceIn=int_importance_24,
    scoreIn=num_score_13,
    pathIn=geo_79,
    blockedIn=geo_80,
    drawingIn=geo_81,
    Reference=["C:\USERS\ECORI\SOURCE\IAAC\AIA_STUDIO\HYPERGRAPH\SAMPLES\_REQUIREDDLLS\MathNet.Numerics.dll", "C:\USERS\ECORI\SOURCE\IAAC\AIA_STUDIO\HYPERGRAPH\SAMPLES\_REQUIREDDLLS\RGeoLib.dll", "C:\USERS\ECORI\SOURCE\IAAC\AIA_STUDIO\HYPERGRAPH\SAMPLES\_REQUIREDDLLS\Dbscan.dll"])  # -> out, simplify(furniture); inputs name: String, placementIn: list of Int32, importanceIn: Int32, scoreIn: Double, pathIn: Polyline, blockedIn: Polyline, drawingIn: list of Polyline; same code as c_script
data_bed_queen_9 = Data(c_script_40.furniture)

c_script_41 = CSharpScript(
    name=txt_name_37,
    placementIn=int_placement_37,
    importanceIn=int_importance_32,
    scoreIn=num_score_47,
    pathIn=geo_109,
    blockedIn=geo_110,
    drawingIn=geo_111,
    Reference=["C:\USERS\ECORI\SOURCE\IAAC\AIA_STUDIO\HYPERGRAPH\SAMPLES\_REQUIREDDLLS\MathNet.Numerics.dll", "C:\USERS\ECORI\SOURCE\IAAC\AIA_STUDIO\HYPERGRAPH\SAMPLES\_REQUIREDDLLS\RGeoLib.dll", "C:\USERS\ECORI\SOURCE\IAAC\AIA_STUDIO\HYPERGRAPH\SAMPLES\_REQUIREDDLLS\Dbscan.dll"])  # -> out, simplify(furniture); inputs name: String, placementIn: list of Int32, importanceIn: Int32, scoreIn: Double, pathIn: Polyline, blockedIn: Polyline, drawingIn: list of Polyline; same code as c_script
data_kitchen_studio_6 = Data(c_script_41.furniture)

c_script_42 = CSharpScript(
    name=txt_name_38,
    placementIn=int_placement_38,
    importanceIn=int_importance_33,
    scoreIn=num_score_48,
    pathIn=geo_112,
    blockedIn=geo_113,
    drawingIn=geo_114,
    Reference=["C:\USERS\ECORI\SOURCE\IAAC\AIA_STUDIO\HYPERGRAPH\SAMPLES\_REQUIREDDLLS\MathNet.Numerics.dll", "C:\USERS\ECORI\SOURCE\IAAC\AIA_STUDIO\HYPERGRAPH\SAMPLES\_REQUIREDDLLS\RGeoLib.dll", "C:\USERS\ECORI\SOURCE\IAAC\AIA_STUDIO\HYPERGRAPH\SAMPLES\_REQUIREDDLLS\Dbscan.dll"])  # -> out, simplify(furniture); inputs name: String, placementIn: list of Int32, importanceIn: Int32, scoreIn: Double, pathIn: Polyline, blockedIn: Polyline, drawingIn: list of Polyline; same code as c_script
data_kitchen_studio_7 = Data(c_script_42.furniture)

c_script_43 = CSharpScript(
    name=txt_name_39,
    placementIn=int_placement_39,
    importanceIn=int_importance_34,
    scoreIn=num_score_49,
    pathIn=geo_115,
    blockedIn=geo_117,
    drawingIn=geo_116,
    Reference=["C:\USERS\ECORI\SOURCE\IAAC\AIA_STUDIO\HYPERGRAPH\SAMPLES\_REQUIREDDLLS\MathNet.Numerics.dll", "C:\USERS\ECORI\SOURCE\IAAC\AIA_STUDIO\HYPERGRAPH\SAMPLES\_REQUIREDDLLS\RGeoLib.dll", "C:\USERS\ECORI\SOURCE\IAAC\AIA_STUDIO\HYPERGRAPH\SAMPLES\_REQUIREDDLLS\Dbscan.dll"])  # -> out, simplify(furniture); inputs name: String, placementIn: list of Int32, importanceIn: Int32, scoreIn: Double, pathIn: Polyline, blockedIn: Polyline, drawingIn: list of Polyline; same code as c_script
data_dining_studio_4 = Data(c_script_43.furniture)

c_script_44 = CSharpScript(
    name=txt_name_40,
    placementIn=int_placement_40,
    importanceIn=int_importance_36,
    scoreIn=num_score_50,
    pathIn=geo_118,
    blockedIn=geo_120,
    drawingIn=geo_119,
    Reference=["C:\USERS\ECORI\SOURCE\IAAC\AIA_STUDIO\HYPERGRAPH\SAMPLES\_REQUIREDDLLS\MathNet.Numerics.dll", "C:\USERS\ECORI\SOURCE\IAAC\AIA_STUDIO\HYPERGRAPH\SAMPLES\_REQUIREDDLLS\RGeoLib.dll", "C:\USERS\ECORI\SOURCE\IAAC\AIA_STUDIO\HYPERGRAPH\SAMPLES\_REQUIREDDLLS\Dbscan.dll"])  # -> out, simplify(furniture); inputs name: String, placementIn: list of Int32, importanceIn: Int32, scoreIn: Double, pathIn: Polyline, blockedIn: Polyline, drawingIn: list of Polyline; same code as c_script
data_bath_studio_9 = Data(c_script_44.furniture)

c_script_45 = CSharpScript(
    name=txt_name_34,
    placementIn=int_placement_34,
    importanceIn=int_importance_23,
    scoreIn=num_score_19,
    pathIn=geo_100,
    blockedIn=geo_101,
    drawingIn=geo_102,
    Reference=["C:\USERS\ECORI\SOURCE\IAAC\AIA_STUDIO\HYPERGRAPH\SAMPLES\_REQUIREDDLLS\MathNet.Numerics.dll", "C:\USERS\ECORI\SOURCE\IAAC\AIA_STUDIO\HYPERGRAPH\SAMPLES\_REQUIREDDLLS\RGeoLib.dll", "C:\USERS\ECORI\SOURCE\IAAC\AIA_STUDIO\HYPERGRAPH\SAMPLES\_REQUIREDDLLS\Dbscan.dll"])  # -> out, simplify(furniture); inputs name: String, placementIn: list of Int32, importanceIn: Int32, scoreIn: Double, pathIn: Polyline, blockedIn: Polyline, drawingIn: list of Polyline; same code as c_script
data_living_studio_3 = Data(c_script_45.furniture)

c_script_46 = CSharpScript(
    name=txt_name_41,
    placementIn=int_placement_41,
    importanceIn=int_importance_37,
    scoreIn=num_score_52,
    pathIn=geo_121,
    blockedIn=geo_122,
    drawingIn=geo_123,
    Reference=["C:\USERS\ECORI\SOURCE\IAAC\AIA_STUDIO\HYPERGRAPH\SAMPLES\_REQUIREDDLLS\MathNet.Numerics.dll", "C:\USERS\ECORI\SOURCE\IAAC\AIA_STUDIO\HYPERGRAPH\SAMPLES\_REQUIREDDLLS\RGeoLib.dll", "C:\USERS\ECORI\SOURCE\IAAC\AIA_STUDIO\HYPERGRAPH\SAMPLES\_REQUIREDDLLS\Dbscan.dll"])  # -> out, simplify(furniture); inputs name: String, placementIn: list of Int32, importanceIn: Int32, scoreIn: Double, pathIn: Polyline, blockedIn: Polyline, drawingIn: list of Polyline; same code as c_script
data_kitchen_studio_8 = Data(c_script_46.furniture)

c_script_47 = CSharpScript(
    name=txt_name_33,
    placementIn=int_placement_33,
    importanceIn=int_importance_27,
    scoreIn=num_score_18,
    pathIn=geo_97,
    blockedIn=geo_98,
    drawingIn=geo_99,
    Reference=["C:\USERS\ECORI\SOURCE\IAAC\AIA_STUDIO\HYPERGRAPH\SAMPLES\_REQUIREDDLLS\MathNet.Numerics.dll", "C:\USERS\ECORI\SOURCE\IAAC\AIA_STUDIO\HYPERGRAPH\SAMPLES\_REQUIREDDLLS\RGeoLib.dll", "C:\USERS\ECORI\SOURCE\IAAC\AIA_STUDIO\HYPERGRAPH\SAMPLES\_REQUIREDDLLS\Dbscan.dll"])  # -> out, simplify(furniture); inputs name: String, placementIn: list of Int32, importanceIn: Int32, scoreIn: Double, pathIn: Polyline, blockedIn: Polyline, drawingIn: list of Polyline; same code as c_script
data_living_studio_4 = Data(c_script_47.furniture)

c_script_48 = CSharpScript(
    name=txt_name_32,
    placementIn=int_placement_32,
    importanceIn=int_importance_26,
    scoreIn=num_score_17,
    pathIn=geo_94,
    blockedIn=geo_95,
    drawingIn=geo_96,
    Reference=["C:\USERS\ECORI\SOURCE\IAAC\AIA_STUDIO\HYPERGRAPH\SAMPLES\_REQUIREDDLLS\MathNet.Numerics.dll", "C:\USERS\ECORI\SOURCE\IAAC\AIA_STUDIO\HYPERGRAPH\SAMPLES\_REQUIREDDLLS\RGeoLib.dll", "C:\USERS\ECORI\SOURCE\IAAC\AIA_STUDIO\HYPERGRAPH\SAMPLES\_REQUIREDDLLS\Dbscan.dll"])  # -> out, simplify(furniture); inputs name: String, placementIn: list of Int32, importanceIn: Int32, scoreIn: Double, pathIn: Polyline, blockedIn: Polyline, drawingIn: list of Polyline; same code as c_script
data_living_studio_5 = Data(c_script_48.furniture)

c_script_49 = CSharpScript(
    name=txt_name_48,
    placementIn=int_placement_48,
    importanceIn=int_importance_46,
    scoreIn=num_score_56,
    pathIn=geo_142,
    blockedIn=geo_143,
    drawingIn=geo_144,
    Reference=["C:\USERS\ECORI\SOURCE\IAAC\AIA_STUDIO\HYPERGRAPH\SAMPLES\_REQUIREDDLLS\MathNet.Numerics.dll", "C:\USERS\ECORI\SOURCE\IAAC\AIA_STUDIO\HYPERGRAPH\SAMPLES\_REQUIREDDLLS\RGeoLib.dll", "C:\USERS\ECORI\SOURCE\IAAC\AIA_STUDIO\HYPERGRAPH\SAMPLES\_REQUIREDDLLS\Dbscan.dll"])  # -> out, simplify(furniture); inputs name: String, placementIn: list of Int32, importanceIn: Int32, scoreIn: Double, pathIn: Polyline, blockedIn: Polyline, drawingIn: list of Polyline; same code as c_script
data_bed_queen_10 = Data(c_script_49.furniture)

c_script_50 = CSharpScript(
    name=txt_name_43,
    placementIn=int_placement_43,
    importanceIn=int_importance_45,
    scoreIn=num_score_57,
    pathIn=geo_127,
    blockedIn=geo_129,
    drawingIn=geo_128,
    Reference=["C:\USERS\ECORI\SOURCE\IAAC\AIA_STUDIO\HYPERGRAPH\SAMPLES\_REQUIREDDLLS\MathNet.Numerics.dll", "C:\USERS\ECORI\SOURCE\IAAC\AIA_STUDIO\HYPERGRAPH\SAMPLES\_REQUIREDDLLS\RGeoLib.dll", "C:\USERS\ECORI\SOURCE\IAAC\AIA_STUDIO\HYPERGRAPH\SAMPLES\_REQUIREDDLLS\Dbscan.dll"])  # -> out, simplify(furniture); inputs name: String, placementIn: list of Int32, importanceIn: Int32, scoreIn: Double, pathIn: Polyline, blockedIn: Polyline, drawingIn: list of Polyline; same code as c_script
data_bath_studio_10 = Data(c_script_50.furniture)

c_script_51 = CSharpScript(
    name=txt_name_53,
    placementIn=int_placement_53,
    importanceIn=int_importance_47,
    scoreIn=num_score_58,
    pathIn=geo_157,
    blockedIn=geo_158,
    drawingIn=geo_159,
    Reference=["C:\USERS\ECORI\SOURCE\IAAC\AIA_STUDIO\HYPERGRAPH\SAMPLES\_REQUIREDDLLS\MathNet.Numerics.dll", "C:\USERS\ECORI\SOURCE\IAAC\AIA_STUDIO\HYPERGRAPH\SAMPLES\_REQUIREDDLLS\RGeoLib.dll", "C:\USERS\ECORI\SOURCE\IAAC\AIA_STUDIO\HYPERGRAPH\SAMPLES\_REQUIREDDLLS\Dbscan.dll"])  # -> out, simplify(furniture); inputs name: String, placementIn: list of Int32, importanceIn: Int32, scoreIn: Double, pathIn: Polyline, blockedIn: Polyline, drawingIn: list of Polyline; same code as c_script
data_bath_studio_11 = Data(c_script_51.furniture)

c_script_52 = CSharpScript(
    name=txt_name_42,
    placementIn=int_placement_42,
    importanceIn=int_importance_39,
    scoreIn=num_score_33,
    pathIn=geo_125,
    blockedIn=geo_124,
    drawingIn=geo_126,
    Reference=["C:\USERS\ECORI\SOURCE\IAAC\AIA_STUDIO\HYPERGRAPH\SAMPLES\_REQUIREDDLLS\MathNet.Numerics.dll", "C:\USERS\ECORI\SOURCE\IAAC\AIA_STUDIO\HYPERGRAPH\SAMPLES\_REQUIREDDLLS\RGeoLib.dll", "C:\USERS\ECORI\SOURCE\IAAC\AIA_STUDIO\HYPERGRAPH\SAMPLES\_REQUIREDDLLS\Dbscan.dll"])  # -> out, simplify(furniture); inputs name: String, placementIn: list of Int32, importanceIn: Int32, scoreIn: Double, pathIn: Polyline, blockedIn: Polyline, drawingIn: list of Polyline; same code as c_script
data_bed_queen_11 = Data(c_script_52.furniture)

c_script_53 = CSharpScript(
    name=txt_name_44,
    placementIn=int_placement_44,
    importanceIn=int_importance_38,
    scoreIn=num_score_34,
    pathIn=geo_130,
    blockedIn=geo_131,
    drawingIn=geo_132,
    Reference=["C:\USERS\ECORI\SOURCE\IAAC\AIA_STUDIO\HYPERGRAPH\SAMPLES\_REQUIREDDLLS\MathNet.Numerics.dll", "C:\USERS\ECORI\SOURCE\IAAC\AIA_STUDIO\HYPERGRAPH\SAMPLES\_REQUIREDDLLS\RGeoLib.dll", "C:\USERS\ECORI\SOURCE\IAAC\AIA_STUDIO\HYPERGRAPH\SAMPLES\_REQUIREDDLLS\Dbscan.dll"])  # -> out, simplify(furniture); inputs name: String, placementIn: list of Int32, importanceIn: Int32, scoreIn: Double, pathIn: Polyline, blockedIn: Polyline, drawingIn: list of Polyline; same code as c_script
data_bed_queen_12 = Data(c_script_53.furniture)

c_script_54 = CSharpScript(
    name=txt_name_47,
    placementIn=int_placement_47,
    importanceIn=int_importance_41,
    scoreIn=num_score_37,
    pathIn=geo_139,
    blockedIn=geo_140,
    drawingIn=geo_141,
    Reference=["C:\USERS\ECORI\SOURCE\IAAC\AIA_STUDIO\HYPERGRAPH\SAMPLES\_REQUIREDDLLS\MathNet.Numerics.dll", "C:\USERS\ECORI\SOURCE\IAAC\AIA_STUDIO\HYPERGRAPH\SAMPLES\_REQUIREDDLLS\RGeoLib.dll", "C:\USERS\ECORI\SOURCE\IAAC\AIA_STUDIO\HYPERGRAPH\SAMPLES\_REQUIREDDLLS\Dbscan.dll"])  # -> out, simplify(furniture); inputs name: String, placementIn: list of Int32, importanceIn: Int32, scoreIn: Double, pathIn: Polyline, blockedIn: Polyline, drawingIn: list of Polyline; same code as c_script
data_bed_queen_13 = Data(c_script_54.furniture)

c_script_55 = CSharpScript(
    name=txt_name_55,
    placementIn=int_placement_55,
    importanceIn=int_importance_48,
    scoreIn=num_score_59,
    pathIn=geo_163,
    blockedIn=geo_164,
    drawingIn=geo_165,
    Reference=["C:\USERS\ECORI\SOURCE\IAAC\AIA_STUDIO\HYPERGRAPH\SAMPLES\_REQUIREDDLLS\MathNet.Numerics.dll", "C:\USERS\ECORI\SOURCE\IAAC\AIA_STUDIO\HYPERGRAPH\SAMPLES\_REQUIREDDLLS\RGeoLib.dll", "C:\USERS\ECORI\SOURCE\IAAC\AIA_STUDIO\HYPERGRAPH\SAMPLES\_REQUIREDDLLS\Dbscan.dll"])  # -> out, simplify(furniture); inputs name: String, placementIn: list of Int32, importanceIn: Int32, scoreIn: Double, pathIn: Polyline, blockedIn: Polyline, drawingIn: list of Polyline; same code as c_script
data_kitchen_studio_9 = Data(c_script_55.furniture)

c_script_56 = CSharpScript(
    name=txt_name_56,
    placementIn=int_placement_56,
    importanceIn=int_importance_49,
    scoreIn=num_score_60,
    pathIn=geo_166,
    blockedIn=geo_167,
    drawingIn=geo_168,
    Reference=["C:\USERS\ECORI\SOURCE\IAAC\AIA_STUDIO\HYPERGRAPH\SAMPLES\_REQUIREDDLLS\MathNet.Numerics.dll", "C:\USERS\ECORI\SOURCE\IAAC\AIA_STUDIO\HYPERGRAPH\SAMPLES\_REQUIREDDLLS\RGeoLib.dll", "C:\USERS\ECORI\SOURCE\IAAC\AIA_STUDIO\HYPERGRAPH\SAMPLES\_REQUIREDDLLS\Dbscan.dll"])  # -> out, simplify(furniture); inputs name: String, placementIn: list of Int32, importanceIn: Int32, scoreIn: Double, pathIn: Polyline, blockedIn: Polyline, drawingIn: list of Polyline; same code as c_script
data_kitchen_studio_10 = Data(c_script_56.furniture)

c_script_57 = CSharpScript(
    name=txt_name_58,
    placementIn=int_placement_58,
    importanceIn=int_importance_51,
    scoreIn=num_score_62,
    pathIn=geo_172,
    blockedIn=geo_173,
    drawingIn=geo_174,
    Reference=["C:\USERS\ECORI\SOURCE\IAAC\AIA_STUDIO\HYPERGRAPH\SAMPLES\_REQUIREDDLLS\MathNet.Numerics.dll", "C:\USERS\ECORI\SOURCE\IAAC\AIA_STUDIO\HYPERGRAPH\SAMPLES\_REQUIREDDLLS\RGeoLib.dll", "C:\USERS\ECORI\SOURCE\IAAC\AIA_STUDIO\HYPERGRAPH\SAMPLES\_REQUIREDDLLS\Dbscan.dll"])  # -> out, simplify(furniture); inputs name: String, placementIn: list of Int32, importanceIn: Int32, scoreIn: Double, pathIn: Polyline, blockedIn: Polyline, drawingIn: list of Polyline; same code as c_script
data_bed_queen_14 = Data(c_script_57.furniture)

c_script_58 = CSharpScript(
    name=txt_name_57,
    placementIn=int_placement_57,
    importanceIn=int_importance_50,
    scoreIn=num_score_61,
    pathIn=geo_169,
    blockedIn=geo_171,
    drawingIn=geo_170,
    Reference=["C:\USERS\ECORI\SOURCE\IAAC\AIA_STUDIO\HYPERGRAPH\SAMPLES\_REQUIREDDLLS\MathNet.Numerics.dll", "C:\USERS\ECORI\SOURCE\IAAC\AIA_STUDIO\HYPERGRAPH\SAMPLES\_REQUIREDDLLS\RGeoLib.dll", "C:\USERS\ECORI\SOURCE\IAAC\AIA_STUDIO\HYPERGRAPH\SAMPLES\_REQUIREDDLLS\Dbscan.dll"])  # -> out, simplify(furniture); inputs name: String, placementIn: list of Int32, importanceIn: Int32, scoreIn: Double, pathIn: Polyline, blockedIn: Polyline, drawingIn: list of Polyline; same code as c_script
data_bath_studio_12 = Data(c_script_58.furniture)

c_script_59 = CSharpScript(
    name=txt_name_52,
    placementIn=int_placement_52,
    importanceIn=int_importance_43,
    scoreIn=num_score_41,
    pathIn=geo_154,
    blockedIn=geo_155,
    drawingIn=geo_156,
    Reference=["C:\USERS\ECORI\SOURCE\IAAC\AIA_STUDIO\HYPERGRAPH\SAMPLES\_REQUIREDDLLS\MathNet.Numerics.dll", "C:\USERS\ECORI\SOURCE\IAAC\AIA_STUDIO\HYPERGRAPH\SAMPLES\_REQUIREDDLLS\RGeoLib.dll", "C:\USERS\ECORI\SOURCE\IAAC\AIA_STUDIO\HYPERGRAPH\SAMPLES\_REQUIREDDLLS\Dbscan.dll"])  # -> out, simplify(furniture); inputs name: String, placementIn: list of Int32, importanceIn: Int32, scoreIn: Double, pathIn: Polyline, blockedIn: Polyline, drawingIn: list of Polyline; same code as c_script
data_living_studio_6 = Data(c_script_59.furniture)

c_script_60 = CSharpScript(
    name=txt_name_54,
    placementIn=int_placement_54,
    importanceIn=int_importance_44,
    scoreIn=num_score_42,
    pathIn=geo_162,
    blockedIn=geo_160,
    drawingIn=geo_161,
    Reference=["C:\USERS\ECORI\SOURCE\IAAC\AIA_STUDIO\HYPERGRAPH\SAMPLES\_REQUIREDDLLS\MathNet.Numerics.dll", "C:\USERS\ECORI\SOURCE\IAAC\AIA_STUDIO\HYPERGRAPH\SAMPLES\_REQUIREDDLLS\RGeoLib.dll", "C:\USERS\ECORI\SOURCE\IAAC\AIA_STUDIO\HYPERGRAPH\SAMPLES\_REQUIREDDLLS\Dbscan.dll"])  # -> out, simplify(furniture); inputs name: String, placementIn: list of Int32, importanceIn: Int32, scoreIn: Double, pathIn: Polyline, blockedIn: Polyline, drawingIn: list of Polyline; same code as c_script
data_living_studio_7 = Data(c_script_60.furniture)

c_script_61 = CSharpScript(
    name=txt_name_59,
    placementIn=int_placement_59,
    importanceIn=int_importance_53,
    scoreIn=num_score_51,
    pathIn=geo_176,
    blockedIn=geo_175,
    drawingIn=geo_177,
    Reference=["C:\USERS\ECORI\SOURCE\IAAC\AIA_STUDIO\HYPERGRAPH\SAMPLES\_REQUIREDDLLS\MathNet.Numerics.dll", "C:\USERS\ECORI\SOURCE\IAAC\AIA_STUDIO\HYPERGRAPH\SAMPLES\_REQUIREDDLLS\RGeoLib.dll", "C:\USERS\ECORI\SOURCE\IAAC\AIA_STUDIO\HYPERGRAPH\SAMPLES\_REQUIREDDLLS\Dbscan.dll"])  # -> out, simplify(furniture); inputs name: String, placementIn: list of Int32, importanceIn: Int32, scoreIn: Double, pathIn: Polyline, blockedIn: Polyline, drawingIn: list of Polyline; same code as c_script
data_bed_secondary = Data(c_script_61.furniture)

c_script_62 = CSharpScript(
    name=txt_name_60,
    placementIn=int_placement_60,
    importanceIn=int_importance_52,
    scoreIn=num_score_53,
    pathIn=geo_178,
    blockedIn=geo_179,
    drawingIn=geo_180,
    Reference=["C:\USERS\ECORI\SOURCE\IAAC\AIA_STUDIO\HYPERGRAPH\SAMPLES\_REQUIREDDLLS\MathNet.Numerics.dll", "C:\USERS\ECORI\SOURCE\IAAC\AIA_STUDIO\HYPERGRAPH\SAMPLES\_REQUIREDDLLS\RGeoLib.dll", "C:\USERS\ECORI\SOURCE\IAAC\AIA_STUDIO\HYPERGRAPH\SAMPLES\_REQUIREDDLLS\Dbscan.dll"])  # -> out, simplify(furniture); inputs name: String, placementIn: list of Int32, importanceIn: Int32, scoreIn: Double, pathIn: Polyline, blockedIn: Polyline, drawingIn: list of Polyline; same code as c_script
data_bed_secondary_2 = Data(c_script_62.furniture)

# ----
merge = Merge(Data1=data_bed_queen_3, Data2=data_bed_queen_2, Data3=data_bed_queen)  # -> flatten(Result)
merge_2 = Merge(Data1=data_bed_queen_5, Data2=data_bed_queen_6, Data3=data_bed_queen_4)  # -> flatten(Result)
merge_3 = Merge(Data1=data_bed_queen_9, Data2=data_bed_queen_8, Data3=data_bed_queen_7)  # -> flatten(Result)
merge_4 = Merge(Data1=data_kitchen_studio_9, Data2=data_kitchen_studio_10, Data3=data_kitchen_studio_8)  # -> flatten(Result)
merge_5 = Merge(Data1=data_bed_queen_13, Data2=data_bed_queen_14, Data3=data_bed_queen_10)  # -> flatten(Result)
merge_6 = Merge(Data1=data_bed_secondary_2, Data2=data_bed_secondary)  # -> flatten(Result)
merge_7 = Merge(Data1=data_kitchen_studio_6, Data2=data_kitchen_studio_7, Data3=data_kitchen_studio_5)  # -> flatten(Result)
merge_8 = Merge(Data1=data_bed_single, Data2=data_bed_single_2, Data3=data_bed_single_3)  # -> flatten(Result)
merge_9 = Merge(Data1=data_bed_queen_12, Data2=data_bed_queen_11)  # -> flatten(Result)
merge_10 = Merge(Data1=data_bed_single_4, Data2=data_bed_single_5, Data3=data_bed_single_6)  # -> flatten(Result)
merge_11 = Merge(Data1=data_bed_single_8, Data2=data_bed_single_10)  # -> flatten(Result)
merge_12 = Merge(Data1=data_bed_single_7, Data2=data_bed_single_9, Data3=data_bed_single_11)  # -> flatten(Result)
merge_13 = Merge(Data1=data_kitchen_studio_3, Data2=data_kitchen_studio_4, Data3=data_kitchen_studio_2)  # -> flatten(Result)
merge_14 = Merge(Data1=data_living_studio_5, Data2=data_living_studio_4, Data3=data_living_studio_3)  # -> flatten(Result)
merge_15 = Merge(Data2=data_bed_single_12, Data3=data_bed_single_13)  # -> flatten(Result)
merge_16 = Merge(Data1=data_living_studio_6, Data2=data_living_studio_7)  # -> flatten(Result)
_2_bed_storage_secondary = Data(merge_11)
_3_bed_storage_secondary = Data(merge_15)
_2_bed_bed_secondary = Data(merge_9)
_3_bed_bed_secondary = Data(merge_6)
studio_kitchen = Data(data_kitchen_studio)
_1_bed_storage = Data(merge_8)
_2_bed_storage = Data(merge_10)
_3_bed_storage = Data(merge_12)
_1_bed_kitchen = Data(merge_13)
_2_bed_kitchen = Data(merge_7)
_3_bed_kitchen = Data(merge_4)
studio_dining = Data(data_dining_studio)
studio_bath_1 = Data(data_bath_studio_3)
studio_bath_2 = Data(data_bath_studio)
studio_bath_3 = Data(data_bath_studio_2)
studio_living = Data(data_living_studio)
_1_bed_dining = Data(data_dining_studio_2)
_2_bed_dining = Data(data_dining_studio_3)
_3_bed_dining = Data(data_dining_studio_4)
_1_bed_living = Data(data_living_studio_2)
_1_bed_bath_1 = Data(data_bath_studio_6)
_1_bed_bath_2 = Data(data_bath_studio_4)
_1_bed_bath_3 = Data(data_bath_studio_5)
_2_bed_bath_1 = Data(data_bath_studio_9)
_2_bed_bath_2 = Data(data_bath_studio_7)
_2_bed_bath_3 = Data(data_bath_studio_8)
_3_bed_bath_1 = Data(data_bath_studio_12)
_3_bed_bath_2 = Data(data_bath_studio_10)
_3_bed_bath_3 = Data(data_bath_studio_11)
_2_bed_living = Data(merge_14)
_3_bed_living = Data(merge_16)
studio_bed = Data(merge)
_1_bed_bed = Data(merge_2)
_2_bed_bed = Data(merge_3)
_3_bed_bed = Data(merge_5)
_1_bed_living_2 = ClusterOutput(_1_bed_living)
studio_bed_2 = ClusterOutput(studio_bed)
studio_living_2 = ClusterOutput(studio_living)
studio_kitchen_2 = ClusterOutput(studio_kitchen)
studio_dining_2 = ClusterOutput(studio_dining)
studio_bath_1_2 = ClusterOutput(studio_bath_1)
studio_bath_2_2 = ClusterOutput(studio_bath_2)
studio_bath_3_2 = ClusterOutput(studio_bath_3)
_1_bed_bed_2 = ClusterOutput(_1_bed_bed)
_1_bed_storage_2 = ClusterOutput(_1_bed_storage)
_1_bed_kitchen_2 = ClusterOutput(_1_bed_kitchen)
_1_bed_dining_2 = ClusterOutput(_1_bed_dining)
_1_bed_bath_1_2 = ClusterOutput(_1_bed_bath_1)
_1_bed_bath_2_2 = ClusterOutput(_1_bed_bath_2)
_1_bed_bath_3_2 = ClusterOutput(_1_bed_bath_3)
_2_bed_bed_2 = ClusterOutput(_2_bed_bed)
_2_bed_storage_2 = ClusterOutput(_2_bed_storage)
_2_bed_bed_secondary_2 = ClusterOutput(_2_bed_bed_secondary)
_2_bed_storage_secondary_2 = ClusterOutput(_2_bed_storage_secondary)
_2_bed_living_2 = ClusterOutput(_2_bed_living)
_2_bed_kitchen_2 = ClusterOutput(_2_bed_kitchen)
_2_bed_dining_2 = ClusterOutput(_2_bed_dining)
_2_bed_bath_1_2 = ClusterOutput(_2_bed_bath_1)
_2_bed_bath_2_2 = ClusterOutput(_2_bed_bath_2)
_2_bed_bath_3_2 = ClusterOutput(_2_bed_bath_3)
_3_bed_bed_2 = ClusterOutput(_3_bed_bed)
_3_bed_storage_2 = ClusterOutput(_3_bed_storage)
_3_bed_bed_secondary_2 = ClusterOutput(_3_bed_bed_secondary)
_3_bed_storage_secondary_2 = ClusterOutput(_3_bed_storage_secondary)
_3_bed_living_2 = ClusterOutput(_3_bed_living)
_3_bed_kitchen_2 = ClusterOutput(_3_bed_kitchen)
_3_bed_dining_2 = ClusterOutput(_3_bed_dining)
_3_bed_bath_1_2 = ClusterOutput(_3_bed_bath_1)
_3_bed_bath_2_2 = ClusterOutput(_3_bed_bath_2)
_3_bed_bath_3_2 = ClusterOutput(_3_bed_bath_3)

# ==== cluster Cluster
C = ClusterInput()
geo = ClusterInput()
internalwallthickness = ClusterInput()
outsidewallthickness = ClusterInput()

explode = Explode(Curve=C, Recursive=True)  # -> Segments, Vertices
offset_from_corners_m = Slider(0.3, range=0..1)
wwr = Slider(0.4, range=0..1)
geo_2 = Geometry(geo)
vec_to_zero = Vector(Vector(0, 0, 0))
internalwallthickness_2 = Number(internalwallthickness)
outsidewallthickness_2 = Number(outsidewallthickness)
move = Move(Geometry=explode.Segments, Motion=vec_to_zero)  # -> Geometry, Transform
explode_2 = Explode(Curve=geo_2, Recursive=True)  # -> flatten(Segments), Vertices
end = EndPoints(Curve=move.Geometry)  # -> Start, End
vec2pt = Vector2Pt(PointA=end.Start, PointB=end.End, Unitize=False)  # -> Vector, Length
vdis = VectorDisplay()
multiplication = Multiplication(A=offset_from_corners_m, B=2)
len = Length(Curve=explode_2.Segments)
vdisex = VectorDisplayEx(Point=end.Start, Vector=vec2pt.Vector, Colour=ColourSwatch(SwatchColor=RGB(255, 255, 255)), Width=Slider(2, range=0..10))
addition = Addition(A=multiplication, B=Slider(2, range=0..10))
division = Division(A=len, B=offset_from_corners_m)
divide = DivideCurve(Curve=explode_2.Segments, Count=division, Kinks=False)  # -> Points, Tangents, Parameters
cull_i = CullIndex(List=divide.Points, Indices="0", Wrap=True)
cull_i_2 = CullIndex(List=cull_i, Indices="-1", Wrap=True)
pline = PolyLine(Vertices=cull_i_2, Closed=False)
len_2 = Length(Curve=pline)
number_slider = Slider(0.1, range=0..1)
number_slider_2 = Slider(0.04, range=0..0.1)
division_2 = Division(A=len_2, B=Slider(1.5, range=0..10))
offset = OffsetCurve(Curve=pline, Distance=number_slider_2, Corners=1)
divide_2 = DivideCurve(Curve=offset, Count=division_2, Kinks=False)  # -> Points, Tangents, Parameters
end_2 = EndPoints(Curve=pline)  # -> Start, End
shatter = Shatter(Curve=offset, Parameters=divide_2.Parameters)
end_3 = EndPoints(Curve=offset)  # -> Start, End
neg = Negative(Value=number_slider_2)
ln = Line(StartPoint=end_2.End, EndPoint=end_3.End)
ln_2 = Line(StartPoint=end_2.Start, EndPoint=end_3.Start)
offset_2 = OffsetCurve(Curve=shatter, Distance=neg, Corners=1)
subtraction = Subtraction(A=internalwallthickness_2, B=number_slider_2)
end_4 = EndPoints(Curve=simplify(shatter))  # -> Start, End
end_5 = EndPoints(Curve=simplify(offset_2))  # -> Start, End
midpt = CurveMiddle(Curve=shatter)
midpt_2 = CurveMiddle(Curve=offset_2)
line = Line([ln_2, ln])
end_6 = EndPoints(Curve=line)  # -> Start, End
subtraction_2 = Subtraction(A=outsidewallthickness_2, B=number_slider_2)
move_2 = Move(Geometry=line, Motion=line)  # -> Geometry, Transform
subtraction_3 = Subtraction(A=end_4.End, B=midpt)
subtraction_4 = Subtraction(A=midpt_2, B=end_5.End)
subtraction_5 = Subtraction(A=end_5.End, B=midpt_2)
pt = Point(end_6.End)
subtraction_6 = Subtraction(A=midpt, B=end_4.End)
pt_2 = Point(end_6.Start)
ln_3 = Line(StartPoint=simplify(graft(end_4.Start)), EndPoint=simplify(graft(end_5.Start)))
unit = UnitVector(Vector=subtraction_3)
unit_2 = UnitVector(Vector=subtraction_4)
unit_3 = UnitVector(Vector=move_2.Geometry)  # -> simplify(Vector)
unit_4 = UnitVector(Vector=subtraction_5)
unit_5 = UnitVector(Vector=subtraction_6)
neg_2 = Negative(Value=unit_3)
multiplication_2 = Multiplication(A=unit, B=number_slider)  # -> simplify(Result)
multiplication_3 = Multiplication(A=unit_2, B=number_slider)
multiplication_4 = Multiplication(A=unit_4, B=number_slider)
multiplication_5 = Multiplication(A=unit_5, B=number_slider)
move_3 = Move(Geometry=end_5.End, Motion=multiplication_3)  # -> Geometry, Transform
move_4 = Move(Geometry=end_4.Start, Motion=multiplication_2)  # -> Geometry, Transform
move_5 = Move(Geometry=end_5.Start, Motion=multiplication_4)  # -> Geometry, Transform
move_6 = Move(Geometry=end_4.End, Motion=multiplication_5)  # -> Geometry, Transform
panel = Panel(unit)
line_2 = LineSDL(Start=pt, Direction=unit_3, Length=subtraction)
line_3 = LineSDL(Start=pt_2, Direction=neg_2, Length=outsidewallthickness_2)
ln_4 = Line(StartPoint=graft(move_4.Geometry), EndPoint=graft(move_5.Geometry))
ln_5 = Line(StartPoint=graft(move_6.Geometry), EndPoint=graft(move_3.Geometry))
geo_3 = Geometry(offset)
geo_4 = Geometry(pline)
geo_5 = Geometry(ln_4)
geo_6 = Geometry(ln_5)
geo_7 = Geometry(line_3)
geo_8 = Geometry(line_2)
geo_9 = Geometry(ln_2)
geo_10 = Geometry(ln)

internalwallthickness_3 = ClusterOutput(internalwallthickness_2)
outsidewallthickness_3 = ClusterOutput(outsidewallthickness_2)
Z = UnitZ(Factor=Slider(0.01, range=0..0.01))
move_7 = Move(Geometry=flatten([geo_4, geo_3]), Motion=Z)  # -> Geometry, Transform
move_8 = Move(Geometry=flatten([geo_9, geo_8, geo_7, geo_10]), Motion=Z)  # -> Geometry, Transform
V = ClusterOutput(Z)
move_9 = Move(Geometry=flatten([geo_5, geo_6]), Motion=Z)  # -> Geometry, Transform
G = ClusterOutput(move_7.Geometry)
number_slider_3 = ClusterOutput(Slider(2, range=0..10))
G_2 = ClusterOutput(move_8.Geometry)
swatch = ClusterOutput(ColourSwatch(SwatchColor=RGB(0, 0, 0)))
G_3 = ClusterOutput(move_9.Geometry)
swatch_2 = ClusterOutput(ColourSwatch(SwatchColor=RGB(0, 0, 0)))
number_slider_4 = ClusterOutput(Slider(2, range=0..10))
number_slider_5 = ClusterOutput(Slider(1, range=0..10))

# ==== cluster Cluster_2
crv = ClusterInput()
outsidewallthickness = ClusterInput()
internalwallthickness = ClusterInput()
crv_2 = Curve(crv)
join = JoinCurves(Curves=crv_2, Preserve=False)
outsidewallthickness_2 = Number(outsidewallthickness)
internalwallthickness_2 = Number(internalwallthickness)
explode = Explode(Curve=join, Recursive=True)  # -> Segments, Vertices
trim = TrimTree(Tree=explode.Segments, Depth=1)
len = Length(Curve=trim)
sort = SortList(Keys=len, ValuesA=trim)  # -> Keys, ValuesA
rev = ReverseList(List=sort.ValuesA)
item = ListItem(List=rev, Index=0, Wrap=True)
crv_entrance = Curve(item)
end = EndPoints(Curve=crv_entrance)  # -> Start, End
explode_2 = Explode(Curve=flatten(crv_entrance), Recursive=True)  # -> Segments, Vertices
panel = Panel("door alignment left")
vec2pt = Vector2Pt(PointA=end.Start, PointB=end.End, Unitize=False)  # -> Vector, Length
geo = Geometry(flatten(explode_2.Segments))
vdis = VectorDisplay(Anchor=end.End, Vector=vec2pt.Vector)
rdlines = RemoveDuplicateLinesKaramba3D(Line=geo, LimitDistance=0.005)  # -> OutLine, Info, Indexes
len_2 = Length(Curve=rdlines.OutLine)
offset = Number(Slider(0.3, range=0..1))
addition = Addition(A=offset, B=Slider(0.9, range=0..1))
larger = LargerThan(FirstNumber=len_2, SecondNumber=addition)  # -> LargerThan, OrEqualTo
dispatch = Dispatch(List=rdlines.OutLine, DispatchPattern=larger.LargerThan)  # -> ListA, ListB
end_2 = EndPoints(Curve=dispatch.ListA)  # -> Start, End
vec2pt_2 = Vector2Pt(PointA=end_2.Start, PointB=end_2.End, Unitize=False)  # -> Vector, Length
unit = UnitVector(Vector=vec2pt_2.Vector)
multiplication = Multiplication(A=unit, B=offset)
multiplication_2 = Multiplication(A=unit, B=addition)
move = Move(Geometry=end_2.Start, Motion=multiplication)  # -> Geometry, Transform
move_2 = Move(Geometry=end_2.Start, Motion=multiplication_2)  # -> Geometry, Transform
ln = Line(StartPoint=move.Geometry, EndPoint=move_2.Geometry)
door = Line(ln)
door_2 = Line(ln)
neg = Negative(Value=outsidewallthickness_2)
subtraction = Subtraction(A=neg, B=internalwallthickness_2)
offset_2 = OffsetCurve(Curve=door_2, Distance=neg, Corners=1)
offset_3 = OffsetCurve(Curve=door_2, Distance=internalwallthickness_2, Corners=1)
offset_4 = OffsetCurve(Curve=door_2, Distance=subtraction, Corners=1)
end_3 = EndPoints(Curve=offset_3)  # -> Start, End
end_4 = EndPoints(Curve=offset_2)  # -> Start, End
midpt = CurveMiddle(Curve=offset_4)
midpt_2 = CurveMiddle(Curve=offset_3)
vec2pt_3 = Vector2Pt(PointA=midpt, PointB=midpt_2, Unitize=False)  # -> Vector, Length
subtraction_2 = Subtraction(A=midpt, B=vec2pt_3.Vector)
ln_2 = Line(StartPoint=end_3.Start, EndPoint=end_4.Start)
ln_3 = Line(StartPoint=end_3.End, EndPoint=end_4.End)
crv_3 = Curve(flatten(offset_3))
vdis_2 = VectorDisplay(Anchor=subtraction_2, Vector=vec2pt_3.Vector)
flip = FlipCurve(Curve=crv_3)  # -> Curve, Flag
crv_4 = Curve(flatten([offset_3, ln_3, ln_2, offset_2]))
midpt_3 = CurveMiddle(Curve=flip.Curve)
scale = Scale(Geometry=flip.Curve, Center=midpt_3, Factor=Slider(0.9, range=0..1))  # -> Geometry, Transform
end_5 = EndPoints(Curve=scale.Geometry)  # -> Start, End
rotate = Rotate(Geometry=scale.Geometry, Angle=1.570796327, Plane=end_5.Start)  # -> Geometry, Transform
end_6 = EndPoints(Curve=rotate.Geometry)  # -> Start, End
xy = XYPlane(Origin=Point(0, 0, 0))
arc = ArcSED(Start=end_5.End, End=end_6.End, Direction=rotate.Geometry)  # -> Arc, Plane, Radius
Y = UnitY(Factor=1)
crv_arrow_entrance = Curve(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)
X = UnitX(Factor=1)
pi = Pi(Factor=1)
angle = Angle(VectorA=X, VectorB=vec2pt_3.Vector, Plane=xy)  # -> Angle, Reflex
division = Division(A=pi, B=2)
crv_5 = Curve(flatten(crv_4))
door_3 = Line(door_2)
addition_2 = Addition(A=angle.Angle, B=division)
crv_6 = Curve([arc.Arc, rotate.Geometry])
rotate_2 = Rotate(Geometry=crv_arrow_entrance, Angle=addition_2, Plane=PlaneXY(0, 0, 0))  # -> Geometry, Transform
crv_7 = ClusterOutput(crv_6)
T = ClusterInput()
T_2 = ClusterInput()
move_3 = Move(Geometry=rotate_2.Geometry, Motion=midpt)  # -> Geometry, Transform
move_4 = Move(Geometry=flatten(crv_5), Motion=T)  # -> Geometry, Transform
move_5 = Move(Geometry=flatten(door_3), Motion=T_2)  # -> Geometry, Transform
boundary = BoundarySurfaces(Edges=move_3.Geometry)
G = ClusterOutput(move_3.Geometry)
swatch = ClusterOutput(ColourSwatch(SwatchColor=RGB(0, 0, 0)))
swatch_2 = ClusterOutput(ColourSwatch(SwatchColor=RGB(0, 0, 0)))
G_2 = ClusterOutput(move_4.Geometry)
G_3 = ClusterOutput(move_5.Geometry)
S = ClusterOutput(boundary)
number_slider = ClusterOutput(Slider(3, range=0..10))
swatch_3 = ClusterOutput(ColourSwatch(SwatchColor=RGB(0, 0, 0)))
swatch_4 = ClusterOutput(ColourSwatch(SwatchColor=RGB(0, 0, 0)))
number_slider_2 = ClusterOutput(Slider(2, range=0..10))
number_slider_3 = ClusterOutput(Slider(2, range=0..10))
swatch_5 = ClusterOutput(ColourSwatch(SwatchColor=RGB(255, 255, 255)))
number_slider_4 = ClusterOutput(Slider(2, range=0..10))

# ==== cluster Cluster_3
T = ClusterInput()
move = Move(Motion=T)  # -> Geometry, Transform
G = ClusterOutput(move.Geometry)
swatch = ClusterOutput(ColourSwatch(SwatchColor=RGB(0, 0, 0)))
swatch_2 = ClusterOutput(ColourSwatch(SwatchColor=RGB(0, 0, 0)))
swatch_3 = ClusterOutput(ColourSwatch(SwatchColor=RGB(255, 255, 255)))
number_slider = ClusterOutput(Slider(2, range=0..10))
number_slider_2 = ClusterOutput(Slider(2, range=0..10))
number_slider_3 = ClusterOutput(Slider(2, range=0..10))
crv = ClusterInput()
crv_2 = ClusterInput()
crv_3 = Curve(crv)
crv_4 = Curve(crv_2)
crv_5 = ClusterOutput(crv_3)
crv_6 = ClusterOutput(crv_4)
